# Grasshopper definition extract_maintenance_gripper.gh (Grasshopper 1.0.8)

py3 = Python3Script(run=Toggle(True))  # -> target_points, target_planes, target_names, tool_positions, tool_names, object_positions, object_names, path_points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
# ---------- py3: Python ----------
import sys
sys.path.append(r'C:\RoboDK\Python')

from robodk import robolink
import Rhino.Geometry as rg
import Rhino
import os

RDK = robolink.Robolink()

meshes = []
info = ""

TEMP_DIR = r'C:\Temp\RoboDK_GH'

def get_mesh_from_stl(stl_path):
    doc = Rhino.RhinoDoc.ActiveDoc
    before = set(obj.Id for obj in doc.Objects)
    Rhino.RhinoApp.RunScript(f'_-Import "{stl_path}" _Enter', False)
    new_meshes = []
    to_delete = []
    for obj in doc.Objects:
        if obj.Id not in before:
            to_delete.append(obj.Id)
            if obj.Geometry.ObjectType == Rhino.DocObjects.ObjectType.Mesh:
                new_meshes.append(obj.Geometry.Duplicate())
    for oid in to_delete:
        doc.Objects.Delete(oid, True)
    return new_meshes

if run:
    os.makedirs(TEMP_DIR, exist_ok=True)

    # Find item by name
    item = RDK.Item('MaintenanceGripper')

    if item.Valid():
        pose = item.PoseAbs()
        stl_path = os.path.join(TEMP_DIR, 'MaintenanceGripper.stl')

        if not os.path.exists(stl_path):
            item.Save(stl_path)

        raw_meshes = get_mesh_from_stl(stl_path)

        # Apply world transform
        t = rg.Transform(1.0)
        t.M00 = float(pose[0,0]); t.M01 = float(pose[0,1]); t.M02 = float(pose[0,2]); t.M03 = float(pose[0,3])
        t.M10 = float(pose[1,0]); t.M11 = float(pose[1,1]); t.M12 = float(pose[1,2]); t.M13 = float(pose[1,3])
        t.M20 = float(pose[2,0]); t.M21 = float(pose[2,1]); t.M22 = float(pose[2,2]); t.M23 = float(pose[2,3])
        t.M30 = 0.0;              t.M31 = 0.0;              t.M32 = 0.0;              t.M33 = 1.0

        for m in raw_meshes:
            m.Transform(t)
            meshes.append(m)

        info = f"Loaded MaintenanceGripper — {len(meshes)} meshes"
    else:
        info = "MaintenanceGripper not found — check exact name in RoboDK"

else:
    info = "Toggle on to fetch"
# ---------- end py3 ----------
pt = Point(py3.target_points)
pt_2 = Point(py3.path_points)
pt_3 = Point(py3.tool_positions)
panel = Panel(py3.debug)
panel_2 = Panel(py3.target_names)
pt_4 = Point(py3.object_positions)
mesh = Mesh(py3.meshes)
panel_3 = Panel(py3.object_names)
panel_4 = Panel(py3.mesh_names)
panel_5 = Panel(py3.tool_names)
panel_6 = Panel(py3.info)
