# Grasshopper definition importing_from_robo_dk_to_rhino.gh (Grasshopper 1.0.8)

py3 = Python3Script(run=Toggle(True))  # -> target_points, target_planes, target_names, tool_positions, tool_names, object_positions, object_names, path_points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
# ---------- py3: Python ----------
import sys
sys.path.append(r'C:\RoboDK\Python')

from robodk import robolink, robomath
import Rhino.Geometry as rg
import Rhino
import os

RDK = robolink.Robolink()

target_points = []
target_planes = []
target_names = []
tool_positions = []
tool_names = []
object_positions = []
object_names = []
meshes = []
mesh_names = []
info = ""

TEMP_DIR = r'C:\Temp\RoboDK_GH'

def pose_to_point(pose):
    try:
        return rg.Point3d(float(pose[0,3]), float(pose[1,3]), float(pose[2,3]))
    except:
        return None

def pose_to_plane(pose):
    try:
        origin = rg.Point3d(float(pose[0,3]), float(pose[1,3]), float(pose[2,3]))
        x_axis = rg.Vector3d(float(pose[0,0]), float(pose[1,0]), float(pose[2,0]))
        y_axis = rg.Vector3d(float(pose[0,1]), float(pose[1,1]), float(pose[2,1]))
        return rg.Plane(origin, x_axis, y_axis)
    except:
        return None

def get_mesh_from_stl(stl_path):
    """Import STL, grab geometry, delete from doc, return mesh list"""
    doc = Rhino.RhinoDoc.ActiveDoc
    before = set(obj.Id for obj in doc.Objects)
    Rhino.RhinoApp.RunScript(f'_-Import "{stl_path}" _Enter', False)
    new_meshes = []
    to_delete = []
    for obj in doc.Objects:
        if obj.Id not in before:
            to_delete.append(obj.Id)
            if obj.Geometry.ObjectType == Rhino.DocObjects.ObjectType.Mesh:
                new_meshes.append(obj.Geometry.Duplicate())
    for oid in to_delete:
        doc.Objects.Delete(oid, True)
    return new_meshes

def import_item_mesh(item, label, pose):
    try:
        safe_name = "".join(c if c.isalnum() or c == '_' else '_' for c in label)
        stl_path = os.path.join(TEMP_DIR, f"{safe_name}.stl")
        
        # CACHE — only export if file doesn't exist yet
        if not os.path.exists(stl_path):
            item.Save(stl_path)
        
        if not os.path.exists(stl_path) or os.path.getsize(stl_path) < 100:
            return []

        raw_meshes = get_mesh_from_stl(stl_path)
        
        if not raw_meshes:
            return []

        # Build transform from RoboDK world pose
        # RoboDK uses mm, Rhino uses mm - should be 1:1
        t = rg.Transform(1.0)
        t.M00 = float(pose[0,0]); t.M01 = float(pose[0,1]); t.M02 = float(pose[0,2]); t.M03 = float(pose[0,3])
        t.M10 = float(pose[1,0]); t.M11 = float(pose[1,1]); t.M12 = float(pose[1,2]); t.M13 = float(pose[1,3])
        t.M20 = float(pose[2,0]); t.M21 = float(pose[2,1]); t.M22 = float(pose[2,2]); t.M23 = float(pose[2,3])
        t.M30 = 0.0;              t.M31 = 0.0;              t.M32 = 0.0;              t.M33 = 1.0

        result = []
        for m in raw_meshes:
            m.Transform(t)
            result.append(m)
        return result

    except Exception as e:
        return []

if run:
    log = []
    os.makedirs(TEMP_DIR, exist_ok=True)

    # ---- TARGETS ----
    try:
        targets = RDK.ItemList(robolink.ITEM_TYPE_TARGET)
        for t in targets:
            try:
                pose = t.Pose()
                pt = pose_to_point(pose)
                pl = pose_to_plane(pose)
                if pt: target_points.append(pt)
                if pl: target_planes.append(pl)
                target_names.append(str(t.Name()))
            except:
                pass
        log.append(f"Targets: {len(target_points)}")
    except Exception as e:
        log.append(f"Targets error: {str(e)}")

    # ---- TOOLS ----
    try:
        tools = RDK.ItemList(robolink.ITEM_TYPE_TOOL)
        for t in tools:
            try:
                pose = t.PoseAbs()
                pt = pose_to_point(pose)
                if pt: tool_positions.append(pt)
                tool_names.append(str(t.Name()))
                for m in import_item_mesh(t, f"tool_{t.Name()}", pose):
                    meshes.append(m)
                    mesh_names.append(str(t.Name()))
            except:
                pass
        log.append(f"Tools: {len(tool_positions)}")
    except Exception as e:
        log.append(f"Tools error: {str(e)}")

    # ---- OBJECTS ----
    try:
        objects = RDK.ItemList(robolink.ITEM_TYPE_OBJECT)
        for o in objects:
            try:
                pose = o.PoseAbs()
                pt = pose_to_point(pose)
                if pt: object_positions.append(pt)
                object_names.append(str(o.Name()))
                for m in import_item_mesh(o, f"obj_{o.Name()}", pose):
                    meshes.append(m)
                    mesh_names.append(str(o.Name()))
            except:
                pass
        log.append(f"Objects: {len(object_positions)}")
    except Exception as e:
        log.append(f"Objects error: {str(e)}")

    log.append(f"Meshes: {len(meshes)}")
    info = " | ".join(log)

else:
    info = "Toggle on to fetch from RoboDK"
# ---------- end py3 ----------
pt = Point(py3.target_points)
pt_2 = Point(py3.path_points)
pt_3 = Point(py3.tool_positions)
panel = Panel(py3.debug)
panel_2 = Panel(py3.target_names)
pt_4 = Point(py3.object_positions)
mesh = Mesh(py3.meshes)
panel_3 = Panel(py3.object_names)
panel_4 = Panel(py3.mesh_names)
panel_5 = Panel(py3.tool_names)
panel_6 = Panel(py3.info)
