# Grasshopper definition cone_to_creal_yarn_model.gh (Grasshopper 1.0.8)

number_slider = Slider(172, range=0..1000)
pt = Point(Point(0, 0, 0))
cluster = Cluster(
    G=pt,
    A_2=number_slider,
    A_3=number_slider,
    B=Slider(0.37, range=0..1),
    G_2=Toggle(True),
    A=Slider(100, range=0..200),
    P=pt,
    t=Slider(0.25, range=0..1),
    D=Slider(0, range=0..90),
    R=Slider(0.53, range=0..1))

# ==== cluster Cluster
A = ClusterInput()
A_2 = ClusterInput()
B = ClusterInput()
P = ClusterInput()
division = Division(A=A, B=2)
A_3 = ClusterInput()
multiplication = Multiplication(A=A_2, B=B)
D = ClusterInput()
cir = Circle(Plane=P, Radius=division)
subtraction = Subtraction(A=A_3, B=multiplication)
rad = Radians(Degrees=D)
Z = UnitZ(Factor=1)
t = ClusterInput()
G = ClusterInput()
Z_2 = UnitZ(Factor=subtraction)
eval = EvaluateCurve(Curve=reparameterize(cir), Parameter=t)  # -> Point, Tangent, Angle
move = Move(Geometry=G, Motion=Z_2)  # -> Geometry, Transform
vec2pt = Vector2Pt(PointA=move.Geometry, PointB=eval.Point, Unitize=False)  # -> Vector, Length
neg = Negative(Value=eval.Tangent)
line = LineSDL(Start=move.Geometry, Direction=Z, Length=multiplication)
xprod = CrossProduct(VectorA=vec2pt.Vector, VectorB=Z, Unitize=False)  # -> Vector, Length
filter = StreamFilter(Gate=Toggle(True), Stream0=eval.Tangent, Stream1=neg)
vrot = Rotate(Vector=Z, Axis=xprod.Vector, Angle=rad)
R = ClusterInput()
end = EndPoints(Curve=line)  # -> Start, End
biarc = BiArc(StartPoint=eval.Point, StartTangent=filter, EndPoint=move.Geometry, EndTangent=vrot, Ratio=R)  # -> FirstArc, SecondArc, BiArc
ln = Line(StartPoint=eval.Point, EndPoint=end.End)
join = JoinCurves(Curves=[biarc.BiArc, line], Preserve=False)
G_2 = ClusterInput()
filter_2 = StreamFilter(Gate=G_2, Stream0=ln, Stream1=join)
s_1 = ClusterOutput(filter_2)
