# Grasshopper definition experimenting_with_more_bins_for_bender.gh (Grasshopper 1.0.8)

number_slider = Slider(44.6, range=0..1000)
brep = Brep(<brep referenced from the Rhino model>)
pt = Point(Point(0, 0, 0))
number_slider_2 = Slider(150, range=0..5000)
number_slider_3 = Slider(406.4, range=0..1000)
number_slider_4 = Slider(7, range=1..50)
number_slider_5 = Slider(339.6, range=0..1000)
number_slider_6 = Slider(2679.7, range=0..5000)
pt_2 = Point(Point(2409.247621, 1159.851361, 1369.105749))
bbox = BoundingBox(Content=brep, Plane=PlaneXY(0, 0, 0))  # -> Box, Box_2
pt_3 = Point(Point(2409.247621, 943.7312349, 2083.044141))
number_slider_7 = Slider(1, range=1..50)
debox = DeconstructBox(Box=bbox.Box)  # -> Plane, X, Y, Z
mesh = Mesh(<mesh referenced from the Rhino model>)
division = Division(A=number_slider_5, B="2")
pt_4 = Point(Point(3279.61159, 943.7312349, 2.058135835))
dedomain = DeconstructDomain(Domain=debox.X)  # -> Start, End
number_slider_8 = Slider(600, range=0..5000)
cluster = Cluster_3(C=mesh)
pt_5 = Point(Point(0, 0, 0))
number_slider_9 = Slider(400, range=0..1000)
division_2 = Division(A=number_slider_9, B="-2")
division_3 = Division(A=number_slider_8, B="2")
subtraction = Subtraction(A=dedomain.End, B=dedomain.Start)
machine_cone_pickup_offset = Slider(100, range=0..500)
addition = Addition(A=division_3, B="1200")
vec = VectorXYZ(XComponent="0", YComponent="0", ZComponent=cluster)  # -> Vector, Length
pt_6 = ConstructPoint(XCoordinate=addition, YCoordinate=division_2, ZCoordinate="500")
vec_2 = VectorXYZ(
    XComponent=Slider(-52.794, range=-8000..2000),
    YComponent=Slider(-514.324, range=-2000..2000),
    ZComponent=Slider(257, range=-2000..2000))  # -> Vector, Length
number_slider_10 = Slider(8, range=0..100)
cluster_2 = Cluster(
    relay_2=number_slider_3,
    Y=number_slider_6,
    N=number_slider_5,
    C=number_slider_4,
    relay_3=number_slider_2,
    B_2=division,
    G=brep,
    A=pt,
    relay=number_slider,
    B=pt_3)  # -> out_cones, L, out_cone_centroid_bottoms, out_rectangle, out_names
cluster_3 = Cluster(
    relay_2=number_slider_3,
    Y=number_slider_6,
    N=number_slider_5,
    C=number_slider_4,
    relay_3=number_slider_2,
    B_2=division,
    G=brep,
    A=pt,
    relay=number_slider,
    B=pt_2,
    row_1_prefix="Back_",
    row_2_prefix="Front_")  # -> out_cones, L, out_cone_centroid_bottoms, out_rectangle, out_names
cluster_4 = Cluster(
    relay_2=number_slider_3,
    Y=number_slider_6,
    N=number_slider_5,
    C=number_slider_7,
    relay_3=number_slider_2,
    B_2=division,
    G=brep,
    A=pt,
    relay=number_slider,
    B=pt_4)  # -> out_cones, L, out_cone_centroid_bottoms, out_rectangle, out_names
cluster_5 = Cluster_3(C=brep)
pt_7 = Point(Point(2658.44867, 975.3163464, 1555.577932))
pt_8 = Point(pt_6)
vec_3 = VectorXYZ(XComponent="0", YComponent=Slider(823.616, range=-2000..2000), ZComponent="0")  # -> Vector, Length
merge = Merge(
    Data1=number_slider_3,
    Data2=number_slider_4,
    Data3=number_slider_6,
    Data4=number_slider_6,
    Data5=number_slider_2,
    Data6=number_slider,
    Data7=number_slider_7)
yarn_radius = Slider(2, range=0..5)
pt_9 = Point(Point(2880.910316, 975.3163464, 1555.577932))
pt_10 = Point(Point(-25.84423693, 54.40978648, 416.4686422))
pt_11 = Point(Point(0, 0, 0))
pt_12 = Point(Point(2934.405819, 1218.210956, 2033.903443))
pt_13 = Point(Point(2934.405819, 2258.685291, 2033.903443))
cluster_6 = Cluster_5(
    Z=Slider(176.929, range=0..2000),
    B=Slider(200, range=0..2000),
    relay_2=Slider(120.436, range=0..2000),
    relay=Slider(105.153, range=0..2000),
    B_2=Slider(3, range=0..2000))  # -> R, B_3, P
pt_14 = Point(Point(2934.405819, 1218.210956, 2033.903443))
pt_15 = ConstructPoint(XCoordinate=0, YCoordinate=0, ZCoordinate=0)
pt_16 = Point(Point(3091.937875, 1223.763175, 2033.903443))
division_4 = Division(A=subtraction, B="2")
mesh_2 = Mesh(<mesh referenced from the Rhino model>)
subtraction_2 = Subtraction(A=cluster_5, B="7")
move = Move(Geometry=cluster_6.R, Motion=vec.Vector)  # -> Geometry, Transform
cluster_7 = Cluster_3(C=move.Geometry)
vec_4 = VectorXYZ(XComponent="0", YComponent="1", ZComponent="0")  # -> Vector, Length
pt_17 = Point(Point(2934.405819, 3753.066381, 2033.903443))
pt_18 = Point(Point(3076.70422, 3737.626507, 2033.903443))
move_2 = Move(Geometry=cluster_6.B_3, Motion=vec.Vector)  # -> Geometry, Transform
cluster_8 = Cluster_3(C=move_2.Geometry)
addition_2 = Addition(A=cluster_7, B=cluster, C=cluster_8)
move_3 = Move(Geometry=cluster_6.P, Motion=vec.Vector)  # -> Geometry, Transform
pt_19 = Point(Point(2658.44867, 3929.71677, 1555.577932))
pt_20 = ConstructPoint(XCoordinate=0, YCoordinate=0, ZCoordinate=addition_2)
pt_21 = Point(Point(2880.910316, 3951.765053, 1555.577932))
pt_22 = Point(Point(2934.405819, 3753.066381, 2033.903443))
addition_3 = Addition(A="42", B="1")
pt_23 = Point(Point(2934.405819, 2708.838534, 2033.903443))
cluster_9 = Cluster(
    relay_2=number_slider_9,
    Y=number_slider_8,
    N=subtraction,
    C=Slider(3, range=1..50),
    relay_3=division_4,
    B_2="0",
    G=brep,
    A=pt_5,
    relay=division_4,
    B=pt_8,
    row_1_prefix="Base_Right_",
    row_2_prefix="Base_Left_")  # -> out_cones, L, out_cone_centroid_bottoms, out_rectangle, out_names
vec_5 = VectorXYZ(XComponent="0", YComponent="0", ZComponent="1")  # -> Vector, Length
vec_6 = VectorXYZ(XComponent="0", YComponent="0", ZComponent="-1")  # -> Vector, Length
vec_7 = VectorXYZ(XComponent="0", YComponent="0", ZComponent="1")  # -> Vector, Length
vec_8 = VectorXYZ(XComponent="0", YComponent="0", ZComponent=subtraction_2)  # -> Vector, Length
bbox_2 = BoundingBox(Content=move_2.Geometry, Plane=PlaneXY(0, 0, 0))  # -> Box, Box_2
pl = PlaneNormal(Origin=pt_15, ZAxis=vec_4.Vector)
pdecon = Deconstruct(Point=pt_8)  # -> XComponent, YComponent, ZComponent
pl_2 = PlaneNormal(Origin=pt_20, ZAxis=vec_6.Vector)
addition_4 = Addition(A=addition_3, B="1")
pl_3 = PlaneNormal(Origin=pt_10, ZAxis=vec_7.Vector)
debox_2 = DeconstructBox(Box=bbox_2.Box)  # -> Plane, X, Y, Z
merge_2 = Merge(Data1=move.Geometry, Data2=mesh)
pl_4 = PlaneNormal(Origin=pt_11, ZAxis=vec_5.Vector)
rotate = Rotate(Geometry=mesh_2, Angle="-1*pi/180*90", Plane=pl)  # -> Geometry, Transform
subtraction_3 = Subtraction(A=pdecon.YComponent, B=division_2)
subtraction_4 = Subtraction(A=pdecon.XComponent, B=division_3)
move_4 = Move(Geometry=cluster_3.out_cone_centroid_bottoms, Motion=vec_8.Vector)  # -> Geometry, Transform
random = Random(Range=Domain(0, 1), Number=cluster_3.L, Seed=addition_4)
rotate_2 = Rotate(Geometry=pl_2, Angle="pi/2", Plane=pl_2)  # -> Geometry, Transform
cluster_10 = Cluster_4(start_line_1=pt_7, B=pt_9, A=pt_12, B_2=pt_13, N=number_slider_10)
random_2 = Random(Range=Domain(0, 1), Number=cluster_3.L, Seed=addition_3)
cluster_11 = Cluster_4(start_line_1=pt_14, B=pt_16, A=pt_12, B_2=pt_13, N=number_slider_10)
py3 = Python3Script(seed="42", count=cluster_3.L)  # -> flatten(a)
# ---------- py3: Python ----------
import random

# Inputs: count (integer), seed (integer)

random.seed(seed)
a = [random.choice([True, False]) for _ in range(count)]
# ---------- end py3 ----------
cluster_12 = Cluster_4(start_line_1=pt_19, B=pt_21, A=pt_22, B_2=pt_23, N=number_slider_10)
dedomain_2 = DeconstructDomain(Domain=debox_2.Z)  # -> Start, End
dedomain_3 = DeconstructDomain(Domain=debox_2.Y)  # -> Start, End
cluster_13 = Cluster_4(start_line_1=pt_7, B=pt_9, A=pt_14, B_2=pt_16, N=number_slider_10)
panel = Panel(cluster_3.L)
panel_2 = Panel(cluster_2.L)
pt_24 = ConstructPoint(XCoordinate=subtraction_4, YCoordinate=subtraction_3, ZCoordinate=pdecon.ZComponent)
panel_3 = Panel(cluster_4.L)
cluster_14 = Cluster_4(start_line_1=pt_17, B=pt_18, A=pt_22, B_2=pt_23, N=number_slider_10)
cluster_15 = Cluster_4(start_line_1=pt_19, B=pt_21, A=pt_17, B_2=pt_18, N=number_slider_10)
addition_5 = Addition(A=dedomain_2.Start, B=dedomain_2.End)
panel_4 = Panel(cluster_4.out_cones)
pt_25 = Point(Point(0, 0, 0))
division_5 = Division(A=addition_5, B="2")
rotate_3 = Rotate(Geometry=cluster_9.out_cone_centroid_bottoms, Angle="pi/2", Plane=pt_8)  # -> Geometry, Transform
rotate_4 = Rotate(Geometry=cluster_9.out_cones, Angle="pi/2", Plane=pt_8)  # -> Geometry, Transform
py3_2 = Python3Script()  # -> out, a, planes, frame_names
# ---------- py3_2: Python ----------
"""# GhPython component (Rhino 8 / CPython 3): RoboDK frames as Rhino Planes
#
# Inputs:
#   yaml_path  (str)   -- path to robodk.yaml (optional, uses default if blank)
#   group      (str)   -- "rail_points" or "approach_frames" (default: "rail_points")
#   scale      (float) -- unit scale for x/y/z (default 1.0 mm; use 0.001 for metres)
#
# Outputs:
#   planes      -- list of Rhino.Geometry.Plane
#   origins     -- list of Rhino.Geometry.Point3d
#   frame_names -- list of str

import sys
sys.path.insert(0, r"C:\Users\samst\Framework\clones\custom_estimates_using_dhr_methods\misc_extraction_utils")

from robodk_yaml_reader import load_all_frames, filter_frames
import Rhino.Geometry as rg

try:
    yaml_path
except NameError:
    yaml_path = None

try:
    group
except NameError:
    group = None

try:
    scale
except NameError:
    scale = None

if group is None or group == "":
    group = "rail_points"

if scale is None:
    scale = 1.0

PATTERNS = {
    "rail_points":     r"^OptimizationApproachMachine\d+$",
    "approach_frames": r"CurtainSafe$",
}

if group not in PATTERNS:
    raise KeyError("group must be one of: {}".format(list(PATTERNS.keys())))

all_frames = load_all_frames(yaml_path)
entries    = filter_frames(all_frames, PATTERNS[group])

planes      = []
origins     = []
frame_names = []

for e in entries:
    origin = rg.Point3d(e["x"] * scale, e["y"] * scale, e["z"] * scale)
    xaxis  = rg.Vector3d(e["xaxis"][0], e["xaxis"][1], e["xaxis"][2])
    yaxis  = rg.Vector3d(e["yaxis"][0], e["yaxis"][1], e["yaxis"][2])

    planes.append(rg.Plane(origin, xaxis, yaxis))
    origins.append(origin)
    frame_names.append(e["name"])"""
# ---------- end py3_2 ----------
rotate_5 = Rotate(Geometry=cluster_9.out_rectangle, Angle="pi/2", Plane=pt_8)  # -> Geometry, Transform
merge_3 = Merge(Data1=cluster_13, Data2=cluster_11)
addition_6 = Addition(A=cluster_3.L, B=cluster_2.L, C=cluster_4.L)
merge_4 = Merge(Data1=cluster_15, Data2=cluster_14)
pt_26 = ConstructPoint(XCoordinate=0, YCoordinate=dedomain_3.End, ZCoordinate=division_5)
vec_9 = VectorXYZ(XComponent="0", YComponent="-1", ZComponent="0")  # -> Vector, Length
merge_5 = Merge(Data1=cluster_10, Data2=cluster_12)  # -> flatten(Result)
py3_3 = Python3Script(base_origin=pt_25)  # -> out, a, flatten(planes), names, move_types, edge_lines, edge_names, edge_statuses
# ---------- py3_3: Python ----------
# GhPython component (Rhino 8 / CPython 3)
#
# Reads all_waypoints.yaml (the amalgamated file produced by amalgamate_waypoints.py)
# and displays every waypoint as a Plane and every edge as a Line in Grasshopper.
#
# Which file to read is determined by robo_dk_output/waypoint_sources.json ("output" key).
# To add more source YAMLs, edit waypoint_sources.json and re-run amalgamate_waypoints.py.
#
# ΓöÇΓöÇ What is a waypoint? ΓöÇΓöÇΓöÇΓöÇΓöÇΓöÇΓöÇΓöÇΓöÇΓöÇΓöÇΓöÇΓöÇΓöÇΓöÇΓöÇΓöÇΓöÇΓöÇΓöÇΓöÇΓöÇΓöÇΓöÇΓöÇΓöÇΓöÇΓöÇΓöÇΓöÇΓöÇΓöÇΓöÇΓöÇΓöÇΓöÇΓöÇΓöÇΓöÇΓöÇΓöÇΓöÇΓöÇΓöÇΓöÇΓöÇΓöÇΓöÇΓöÇΓöÇΓöÇΓöÇΓöÇΓöÇΓöÇ
# A waypoint is a named robot pose (position + orientation) stored in the YAML.
# Each waypoint has:
#   - A name  (e.g. "base_cone_grab_0", "base_cone_grab_0_approach")
#   - XYZ position in mm, expressed in robot-local coordinates (relative to the
#     robot base frame at j7=0).  Add base_origin to convert to Rhino world space.
#   - RX/RY/RZ orientation in degrees (ZYX Euler: rotate X first, then Y, then Z).
#   - move_type: how the robot moves to this pose.
#       MoveJ  ΓÇö joint-space move (fast, curved path, used for approach waypoints)
#       MoveL  ΓÇö linear Cartesian move (straight line, used for final grab/place)
#
# ΓöÇΓöÇ What is an edge? ΓöÇΓöÇΓöÇΓöÇΓöÇΓöÇΓöÇΓöÇΓöÇΓöÇΓöÇΓöÇΓöÇΓöÇΓöÇΓöÇΓöÇΓöÇΓöÇΓöÇΓöÇΓöÇΓöÇΓöÇΓöÇΓöÇΓöÇΓöÇΓöÇΓöÇΓöÇΓöÇΓöÇΓöÇΓöÇΓöÇΓöÇΓöÇΓöÇΓöÇΓöÇΓöÇΓöÇΓöÇΓöÇΓöÇΓöÇΓöÇΓöÇΓöÇΓöÇΓöÇΓöÇΓöÇΓöÇΓöÇΓöÇ
# An edge is a directed connection between two waypoints that the robot may
# traverse.  Edges are bidirectional in storage (AΓåÆB and BΓåÆA are separate entries)
# because the robot configuration when entering a zone differs from when exiting.
# Each edge has a `tested` field:
#   null  ΓÇö not yet tested for collisions in RoboDK
#   true  ΓÇö tested and collision-free (safe to traverse)
#   false ΓÇö tested and collides (must not traverse)
#
# ΓöÇΓöÇ GH Inputs ΓöÇΓöÇΓöÇΓöÇΓöÇΓöÇΓöÇΓöÇΓöÇΓöÇΓöÇΓöÇΓöÇΓöÇΓöÇΓöÇΓöÇΓöÇΓöÇΓöÇΓöÇΓöÇΓöÇΓöÇΓöÇΓöÇΓöÇΓöÇΓöÇΓöÇΓöÇΓöÇΓöÇΓöÇΓöÇΓöÇΓöÇΓöÇΓöÇΓöÇΓöÇΓöÇΓöÇΓöÇΓöÇΓöÇΓöÇΓöÇΓöÇΓöÇΓöÇΓöÇΓöÇΓöÇΓöÇΓöÇΓöÇΓöÇΓöÇΓöÇΓöÇΓöÇΓöÇΓöÇ
#   base_origin (Point3d, optional)
#       The robot base origin expressed in Rhino world space (mm).
#       Waypoint XYZ coordinates are robot-local, so they are offset by this
#       point to place them correctly in the Rhino model.
#       Default: world origin (0, 0, 0) ΓÇö use this if your Rhino robot model
#       sits at the world origin.
#
# ΓöÇΓöÇ GH Outputs ΓöÇΓöÇΓöÇΓöÇΓöÇΓöÇΓöÇΓöÇΓöÇΓöÇΓöÇΓöÇΓöÇΓöÇΓöÇΓöÇΓöÇΓöÇΓöÇΓöÇΓöÇΓöÇΓöÇΓöÇΓöÇΓöÇΓöÇΓöÇΓöÇΓöÇΓöÇΓöÇΓöÇΓöÇΓöÇΓöÇΓöÇΓöÇΓöÇΓöÇΓöÇΓöÇΓöÇΓöÇΓöÇΓöÇΓöÇΓöÇΓöÇΓöÇΓöÇΓöÇΓöÇΓöÇΓöÇΓöÇΓöÇΓöÇΓöÇΓöÇΓöÇΓöÇΓöÇ
#   planes        ΓÇö list of Plane, one per waypoint.
#                   Origin = waypoint XYZ (offset by base_origin).
#                   XAxis/YAxis = orientation from ZYX Euler angles.
#                   Use these to preview approach directions.
#
#   names         ΓÇö list of str, parallel to `planes`.
#                   Waypoint name, e.g. "base_cone_grab_0_approach".
#
#   move_types    ΓÇö list of str, parallel to `planes`.
#                   "MoveJ" or "MoveL" ΓÇö use this to colour-code the planes.
#
#   edge_lines    ΓÇö list of Line, one per edge in the YAML.
#                   Draws from the origin of the `from` waypoint to the origin
#                   of the `to` waypoint.  Visualise as curves in GH.
#
#   edge_names    ΓÇö list of str, parallel to `edge_lines`.
#                   "from_name -> to_name" label for each edge.
#
#   edge_statuses ΓÇö list of str, parallel to `edge_lines`.
#                   "null" / "true" / "false" ΓÇö use this to colour edges:
#                   grey = untested, green = clear, red = collision.

import math
import Rhino.Geometry as rg

# ΓöÇΓöÇ path_config.yaml is the single source of truth ΓöÇΓöÇΓöÇΓöÇΓöÇΓöÇΓöÇΓöÇΓöÇΓöÇΓöÇΓöÇΓöÇΓöÇΓöÇΓöÇΓöÇΓöÇΓöÇΓöÇΓöÇΓöÇΓöÇΓöÇΓöÇΓöÇΓöÇ
_REPO_ROOT = r"C:\Users\samst\Framework\clones\custom_estimates_using_dhr_methods"
_YAML_PATH = _REPO_ROOT + r"\robo_dk_output\path_config.yaml"

# ΓöÇΓöÇ Initialise all outputs so GH never sees an unbound name ΓöÇΓöÇΓöÇΓöÇΓöÇΓöÇΓöÇΓöÇΓöÇΓöÇΓöÇΓöÇΓöÇΓöÇΓöÇΓöÇΓöÇΓöÇ
planes        = []
names         = []
move_types    = []
edge_lines    = []
edge_names    = []
edge_statuses = []

# ΓöÇΓöÇ Optional GH input: base_origin ΓöÇΓöÇΓöÇΓöÇΓöÇΓöÇΓöÇΓöÇΓöÇΓöÇΓöÇΓöÇΓöÇΓöÇΓöÇΓöÇΓöÇΓöÇΓöÇΓöÇΓöÇΓöÇΓöÇΓöÇΓöÇΓöÇΓöÇΓöÇΓöÇΓöÇΓöÇΓöÇΓöÇΓöÇΓöÇΓöÇΓöÇΓöÇΓöÇΓöÇΓöÇΓöÇΓöÇ
try:
    _base_origin = base_origin  # noqa: F821
except NameError:
    _base_origin = None

# Resolve Guid ΓåÆ Point3d if GH passes an object reference
import System
import scriptcontext as sc
if _base_origin is not None and isinstance(_base_origin, System.Guid):
    _obj = sc.doc.Objects.FindId(_base_origin)
    if _obj:
        _geo = _obj.Geometry
        if isinstance(_geo, rg.Point):
            _base_origin = _geo.Location
        elif hasattr(_geo, 'GetBoundingBox'):
            _base_origin = _geo.GetBoundingBox(True).Center
if _base_origin is not None and not isinstance(_base_origin, rg.Point3d):
    _base_origin = None

_base_x = _base_origin.X if _base_origin is not None else 0.0
_base_y = _base_origin.Y if _base_origin is not None else 0.0
_base_z = _base_origin.Z if _base_origin is not None else 0.0

# ΓöÇΓöÇ PyYAML import ΓöÇΓöÇΓöÇΓöÇΓöÇΓöÇΓöÇΓöÇΓöÇΓöÇΓöÇΓöÇΓöÇΓöÇΓöÇΓöÇΓöÇΓöÇΓöÇΓöÇΓöÇΓöÇΓöÇΓöÇΓöÇΓöÇΓöÇΓöÇΓöÇΓöÇΓöÇΓöÇΓöÇΓöÇΓöÇΓöÇΓöÇΓöÇΓöÇΓöÇΓöÇΓöÇΓöÇΓöÇΓöÇΓöÇΓöÇΓöÇΓöÇΓöÇΓöÇΓöÇΓöÇΓöÇΓöÇΓöÇΓöÇΓöÇΓöÇΓöÇΓöÇ
try:
    import yaml
except ImportError:
    raise ImportError(
        "PyYAML not found. Install it into Rhino 8 Python from an external terminal:\n"
        r'  C:\Users\samst\.rhinocode\py39-rh8\python.exe -m pip install pyyaml'
    )

def _f(wp, key):
    """Extract a float value from a waypoint dict."""
    v = wp.get(key, 0.0)
    try:
        return float(v)
    except (TypeError, ValueError):
        return 0.0


def _plane_from_zyx(ox, oy, oz, rx_deg, ry_deg, rz_deg):
    """Build a Rhino Plane from ZYX Euler angles (degrees).

    Convention matches RoboDK: R = Rz * Ry * Rx.
    Column 0 of R ΓåÆ XAxis, column 1 ΓåÆ YAxis.
    """
    rx = math.radians(rx_deg)
    ry = math.radians(ry_deg)
    rz = math.radians(rz_deg)
    cx, sx = math.cos(rx), math.sin(rx)
    cy, sy = math.cos(ry), math.sin(ry)
    cz, sz = math.cos(rz), math.sin(rz)
    x_axis = rg.Vector3d(cz*cy,         sz*cy,         -sy)
    y_axis = rg.Vector3d(cz*sy*sx-sz*cx, sz*sy*sx+cz*cx, cy*sx)
    return rg.Plane(rg.Point3d(ox, oy, oz), x_axis, y_axis)


# ΓöÇΓöÇ Main ΓöÇΓöÇΓöÇΓöÇΓöÇΓöÇΓöÇΓöÇΓöÇΓöÇΓöÇΓöÇΓöÇΓöÇΓöÇΓöÇΓöÇΓöÇΓöÇΓöÇΓöÇΓöÇΓöÇΓöÇΓöÇΓöÇΓöÇΓöÇΓöÇΓöÇΓöÇΓöÇΓöÇΓöÇΓöÇΓöÇΓöÇΓöÇΓöÇΓöÇΓöÇΓöÇΓöÇΓöÇΓöÇΓöÇΓöÇΓöÇΓöÇΓöÇΓöÇΓöÇΓöÇΓöÇΓöÇΓöÇΓöÇΓöÇΓöÇΓöÇΓöÇΓöÇΓöÇΓöÇΓöÇΓöÇΓöÇΓöÇΓöÇΓöÇ
def _run():
    print(f"Reading: {_YAML_PATH}")
    with open(_YAML_PATH, 'r') as fh:
        data = yaml.safe_load(fh)
    print(f"File read ok")
    print(f"YAML parsed: {type(data)}, keys={list(data.keys()) if isinstance(data, dict) else 'N/A'}")
    if not data:
        print("ERROR: YAML is empty or None")
        return

    # path_config.yaml stores waypoints as a dict (name ΓåÆ attrs), not a list
    raw_wps = data.get('waypoints') or {}
    if isinstance(raw_wps, dict):
        wp_list = [{"name": k, **v} for k, v in raw_wps.items() if isinstance(v, dict)]
    else:
        wp_list = raw_wps  # fallback if already a list
    print(f"Waypoints in YAML: {len(wp_list)}")
    print(f"base_origin offset: ({_base_x}, {_base_y}, {_base_z})")

    name_to_pt = {}  # for edge endpoint lookup

    for wp in wp_list:
        if not isinstance(wp, dict):
            continue
        # Skip joints-only waypoints (home, transport) ΓÇö no Cartesian pose to draw
        if 'x' not in wp and 'y' not in wp and 'z' not in wp:
            continue
        name      = str(wp.get('name', ''))
        move_type = str(wp.get('move_type', ''))

        ox = _base_x + _f(wp, 'x')
        oy = _base_y + _f(wp, 'y')
        oz = _base_z + _f(wp, 'z')

        plane = _plane_from_zyx(ox, oy, oz, _f(wp, 'rx'), _f(wp, 'ry'), _f(wp, 'rz'))
        planes.append(plane)
        names.append(name)
        move_types.append(move_type)
        name_to_pt[name] = rg.Point3d(ox, oy, oz)

    print(f"Planes built: {len(planes)}")


    for edge in (data.get('edges') or []):
        if not isinstance(edge, dict):
            continue
        from_pt = name_to_pt.get(str(edge.get('from', '')))
        to_pt   = name_to_pt.get(str(edge.get('to',   '')))
        if from_pt is None or to_pt is None:
            continue
        tested = edge.get('tested')
        edge_lines.append(rg.Line(from_pt, to_pt))
        edge_names.append("{} -> {}".format(edge['from'], edge['to']))
        edge_statuses.append('null' if tested is None else str(tested).lower())


try:
    _run()
except Exception as _e:
    import traceback
    raise RuntimeError("visualize_waypoints error:\n{}".format(traceback.format_exc())) from _e
# ---------- end py3_3 ----------
vec_10 = VectorXYZ(XComponent="0", YComponent="1", ZComponent="0")  # -> Vector, Length
cluster_16 = Cluster_6(C=rotate.Geometry)
cluster_17 = Cluster_6(C=rotate_4.Geometry)
multiplication = Multiplication(A=Slider(-35, range=-180..180), B="pi/180")
merge_6 = Merge(Data1=merge_3, Data2=merge_4)
panel_5 = Panel(py3_2.frame_names)
pl_5 = PlaneNormal(Origin=pt_26, ZAxis=vec_9.Vector)
pl_6 = PlaneNormal(Origin=pt_24, ZAxis=vec_10.Vector)
cluster_18 = Cluster_7(P=py3_2.planes)
panel_6 = Panel(addition_6)
tag = TextTag(Location=py3_2.planes, Text=py3_2.frame_names)
pln = Plane(py3_3.planes)
rotate_6 = Rotate(Geometry=pl_5, Angle="pi/2", Plane=pl_5)  # -> Geometry, Transform
py3_4 = Python3Script(
    static_geometry=flatten(merge_2),
    moving_geometry=move_2.Geometry,
    joint_axis_plane=move_3.Geometry,
    trigger=Toggle(False),
    joint_open_angle="0",
    joint_closed_angle="90",
    import_angle="0",
    pickup_plane=rotate_6.Geometry,
    knotting_plane=pl_3,
    flange_plane=pl_4,
    pickup_on_moving=Toggle(True),
    knotting_on_moving=Toggle(True))  # -> out, a; inputs static_geometry: tree
# ---------- py3_4: Python ----------
from Grasshopper import DataTree
import Rhino
import Rhino.Geometry as rg
import scriptcontext as sc
import System
import struct
import os
import sys

# ---------------------------------------------------------------------------
# Script 2 — End effector with moving joint and 4 auto-computed TCP tools
# GH inputs:
#   static_geometry    : breps/meshes for static part of EE
#   moving_geometry    : breps/meshes for moving part of EE
#   flange_plane       : plane at robot flange (tool0) origin
#   joint_axis_plane   : plane at pivot point, Z = rotation axis
#   joint_open_angle   : float (degrees) — open position
#   joint_closed_angle : float (degrees) — closed position
#   import_angle       : float (degrees) — display angle in RoboDK
#   reference_angle    : float (degrees) — angle at which pickup/knotting planes are defined
#   pickup_plane       : plane at pickup TCP at reference_angle
#   knotting_plane     : plane at knotting TCP at reference_angle
#   pickup_on_moving   : bool — True if pickup is on the moving part
#   knotting_on_moving : bool — True if knotting is on the moving part
#   trigger            : bool
#
# The script auto-computes open and closed positions by rotating
# pickup_plane and knotting_plane around the joint axis.
# ---------------------------------------------------------------------------

if trigger:
    sc.sticky["last_ee_stl_path"] = ""
    print("Trigger activated, forcing re-run")

def flatten_input(gh_input, exclude_type=None):
    result = []
    if hasattr(gh_input, 'Branches'):
        for branch in gh_input.Branches:
            for item in branch:
                if item is not None:
                    result.append(item)
    elif hasattr(gh_input, '__iter__') and (exclude_type is None or not isinstance(gh_input, exclude_type)):
        for item in gh_input:
            if item is not None:
                result.append(item)
    elif gh_input is not None:
        result.append(gh_input)
    return result

def resolve_plane(item):
    if item is None:
        return None
    if isinstance(item, rg.Plane):
        return item
    if isinstance(item, System.Guid):
        rhino_obj = sc.doc.Objects.FindId(item)
        if rhino_obj:
            geo = rhino_obj.Geometry
            if isinstance(geo, rg.Plane):
                return geo
            if hasattr(geo, 'FrameAt'):
                ok, frame = geo.FrameAt(0, 0)
                if ok:
                    return frame
            centre = geo.GetBoundingBox(True).Center
            return rg.Plane(centre, rg.Vector3d.ZAxis)
        print(f"  Could not find Guid: {item}")
        return None
    if isinstance(item, rg.Point3d):
        return rg.Plane(item, rg.Vector3d.ZAxis)
    if isinstance(item, rg.Point):
        return rg.Plane(item.Location, rg.Vector3d.ZAxis)
    if hasattr(item, 'X') and hasattr(item, 'Y') and hasattr(item, 'Z'):
        return rg.Plane(rg.Point3d(item.X, item.Y, item.Z), rg.Vector3d.ZAxis)
    print(f"  Unknown plane type: {type(item)}")
    return None

def resolve_first_plane(gh_input):
    items = flatten_input(gh_input, exclude_type=rg.Plane)
    if not items:
        return resolve_plane(gh_input)
    for item in items:
        pl = resolve_plane(item)
        if pl is not None:
            return pl
    return None

def resolve_bool(gh_input):
    if gh_input is None:
        return None
    items = flatten_input(gh_input)
    if items:
        return bool(items[0])
    return None

def resolve_float(gh_input):
    if gh_input is None:
        return None
    if isinstance(gh_input, (int, float)):
        return float(gh_input)
    if isinstance(gh_input, str):
        try:
            return float(gh_input.strip())
        except ValueError:
            return None
    items = flatten_input(gh_input)
    if items:
        val = items[0]
        if isinstance(val, str):
            try:
                return float(val.strip())
            except ValueError:
                return None
        try:
            return float(val)
        except (TypeError, ValueError):
            return None
    return None

def build_mesh_from_geo_list(geo_list):
    mesh_list = rg.Mesh()
    for geo in geo_list:
        if isinstance(geo, rg.Mesh):
            geo.Faces.ConvertQuadsToTriangles()
            mesh_list.Append(geo)
        elif isinstance(geo, rg.Brep):
            meshes = rg.Mesh.CreateFromBrep(geo, rg.MeshingParameters.Coarse)
            if meshes:
                for m in meshes:
                    m.Faces.ConvertQuadsToTriangles()
                    mesh_list.Append(m)
        elif isinstance(geo, System.Guid):
            rhino_obj = sc.doc.Objects.FindId(geo)
            if rhino_obj:
                obj_geo = rhino_obj.Geometry
                if isinstance(obj_geo, rg.Mesh):
                    obj_geo.Faces.ConvertQuadsToTriangles()
                    mesh_list.Append(obj_geo)
                elif isinstance(obj_geo, rg.Brep):
                    meshes = rg.Mesh.CreateFromBrep(obj_geo, rg.MeshingParameters.Coarse)
                    if meshes:
                        for m in meshes:
                            m.Faces.ConvertQuadsToTriangles()
                            mesh_list.Append(m)
    mesh_list.Faces.ConvertQuadsToTriangles()
    return mesh_list

def write_stl(mesh, stl_path):
    triangles = []
    for i in range(mesh.Faces.Count):
        face = mesh.Faces[i]
        triangles.append((
            mesh.Vertices[face.A],
            mesh.Vertices[face.B],
            mesh.Vertices[face.C]
        ))
    os.makedirs(os.path.dirname(stl_path), exist_ok=True)
    with open(stl_path, 'wb') as f:
        f.write(b'\0' * 80)
        f.write(struct.pack('<I', len(triangles)))
        for v0, v1, v2 in triangles:
            f.write(struct.pack('<fff', 0, 0, 0))
            f.write(struct.pack('<fff', v0.X, v0.Y, v0.Z))
            f.write(struct.pack('<fff', v1.X, v1.Y, v1.Z))
            f.write(struct.pack('<fff', v2.X, v2.Y, v2.Z))
            f.write(struct.pack('<H', 0))
    return len(triangles)

def write_minimal_stl(path):
    os.makedirs(os.path.dirname(path), exist_ok=True)
    with open(path, 'wb') as f:
        f.write(b'\0' * 80)
        f.write(struct.pack('<I', 1))
        f.write(struct.pack('<fff', 0, 0, 1))
        for _ in range(3):
            f.write(struct.pack('<fff', 0, 0, 0))
        f.write(struct.pack('<H', 0))

# ---------------------------------------------------------------------------
# Collect inputs
# ---------------------------------------------------------------------------
static_geo_list   = flatten_input(static_geometry)           if 'static_geometry'   in dir() else []
moving_geo_list   = flatten_input(moving_geometry)           if 'moving_geometry'   in dir() else []
resolved_flange   = resolve_first_plane(flange_plane)        if 'flange_plane'      in dir() else None
resolved_axis     = resolve_first_plane(joint_axis_plane)    if 'joint_axis_plane'  in dir() else None
resolved_pickup   = resolve_first_plane(pickup_plane)        if 'pickup_plane'      in dir() else None
resolved_knot     = resolve_first_plane(knotting_plane)      if 'knotting_plane'    in dir() else None
pickup_moving     = resolve_bool(pickup_on_moving   if 'pickup_on_moving'   in dir() else None)
knotting_moving   = resolve_bool(knotting_on_moving if 'knotting_on_moving' in dir() else None)
open_angle        = resolve_float(joint_open_angle   if 'joint_open_angle'   in dir() else None)
closed_angle      = resolve_float(joint_closed_angle if 'joint_closed_angle' in dir() else None)
import_angle_val  = resolve_float(import_angle       if 'import_angle'       in dir() else None)
ref_angle_val     = resolve_float(reference_angle    if 'reference_angle'    in dir() else None)

# Defaults
open_angle       = open_angle       if open_angle       is not None else 0.0
closed_angle     = closed_angle     if closed_angle     is not None else 90.0
import_angle_val = import_angle_val if import_angle_val is not None else 0.0
ref_angle_val    = ref_angle_val    if ref_angle_val    is not None else 0.0

print(f"Static geo items   : {len(static_geo_list)}")
print(f"Moving geo items   : {len(moving_geo_list)}")
print(f"flange_plane       : {resolved_flange}")
print(f"joint_axis_plane   : {resolved_axis}")
print(f"open_angle         : {open_angle} deg")
print(f"closed_angle       : {closed_angle} deg")
print(f"import_angle       : {import_angle_val} deg")
print(f"reference_angle    : {ref_angle_val} deg")
print(f"pickup_plane       : {resolved_pickup}")
print(f"knotting_plane     : {resolved_knot}")
print(f"pickup_on_moving   : {pickup_moving}")
print(f"knotting_on_moving : {knotting_moving}")

# ---------------------------------------------------------------------------
# Gate
# ---------------------------------------------------------------------------
if not trigger and sc.sticky.get("last_ee_stl_path", "") != "":
    a = sc.sticky.get("last_ee_stl_path", "")
    print("Trigger not set — skipping.")
else:
    print("Rebuilding...")

    static_stl_path = "C:/temp/end_effector_static.stl"
    moving_stl_path = "C:/temp/end_effector_moving.stl"

    if static_geo_list:
        static_mesh = build_mesh_from_geo_list(static_geo_list)
        static_tris = write_stl(static_mesh, static_stl_path)
        print(f"Static STL: {static_tris} triangles -> {static_stl_path}")
    else:
        print("WARNING: no static geometry")

    if moving_geo_list:
        moving_mesh = build_mesh_from_geo_list(moving_geo_list)
        moving_tris = write_stl(moving_mesh, moving_stl_path)
        print(f"Moving STL: {moving_tris} triangles -> {moving_stl_path}")
    else:
        print("WARNING: no moving geometry")

    try:
        sys.path.append("C:/RoboDK/Python")
        from robodk.robolink import Robolink
        from robodk.robomath import Mat, invH, rotz, pi

        def identity():
            return Mat([[1,0,0,0],[0,1,0,0],[0,0,1,0],[0,0,0,1]])

        def plane_to_mat(plane):
            x = plane.XAxis
            y = plane.YAxis
            z = plane.Normal
            o = plane.Origin
            return Mat([
                [x.X, y.X, z.X, o.X],
                [x.Y, y.Y, z.Y, o.Y],
                [x.Z, y.Z, z.Z, o.Z],
                [0,   0,   0,   1  ],
            ])

        def offset_mat(from_plane, to_plane):
            """Pose of to_plane expressed in from_plane frame."""
            return invH(plane_to_mat(from_plane)) * plane_to_mat(to_plane)

        RDK = Robolink()
        station = RDK.Item("", 1)
        print(f"Station: {station.Name()}")

        def purge_all(name):
            count = 0
            for _ in range(50):
                item = RDK.Item(name)
                if not item.Valid():
                    break
                item.Delete()
                count += 1
            if count:
                print(f"  purged {count}x '{name}'")

        def add_file_and_get_item(path):
            before = set(it.item for it in RDK.ItemList(5, False))
            RDK.AddFile(path)
            for it in RDK.ItemList(5, False):
                if it.item not in before:
                    print(f"  -> loaded '{it.Name()}' id={it.item}")
                    return it
            stem = os.path.splitext(os.path.basename(path))[0]
            fb = RDK.Item(stem)
            print(f"  -> fallback '{stem}' valid={fb.Valid()}")
            return fb

        # Purge old items
        for name in ["end_effector_static", "end_effector_moving", "end_effector",
                     "EndEffector", "MovingPart",
                     "pickup_open", "pickup_closed",
                     "knotting_open", "knotting_closed",
                     "pickup_point", "knotting_point"]:
            purge_all(name)

        robot = RDK.Item("Fanuc R2000iC 125L")
        if not robot.Valid(): robot = RDK.Item("", 4)
        if not robot.Valid(): robot = RDK.Item("", 2)
        print(f"Robot: {robot.Name()}")

        ee_parent = robot if robot.Valid() else station

        # EE organisational frame
        ee_frame = RDK.AddFrame("EndEffector", ee_parent)
        ee_frame.setPose(identity())

        # Static geometry
        if static_geo_list:
            static_obj = add_file_and_get_item(static_stl_path)
            if static_obj.Valid():
                static_obj.setColor([0.6, 0.6, 0.65, 1.0])
                static_obj.setParent(ee_frame)
                print("Static EE: ok")

        # Flange plane — default to world origin XY if not connected
        fo = resolved_flange if resolved_flange is not None else rg.Plane(
            rg.Point3d(0, 0, 0), rg.Vector3d.ZAxis)

        # Moving part frame
        if resolved_axis is not None:
            axis_offset  = offset_mat(fo, resolved_axis)
            import_rad   = import_angle_val * pi / 180.0
            moving_frame = RDK.AddFrame("MovingPart", ee_frame)
            moving_frame.setPose(axis_offset * rotz(import_rad))

            if moving_geo_list:
                moving_obj = add_file_and_get_item(moving_stl_path)
                if moving_obj.Valid():
                    moving_obj.setColor([0.6, 0.6, 0.65, 1.0])
                    moving_obj.setParent(moving_frame)
                    moving_obj.setPose(invH(axis_offset))
                    print("Moving EE: ok")

            angle_name = "MovingPart|open=" + str(open_angle) + "|closed=" + str(closed_angle) + "|import=" + str(import_angle_val)
            moving_frame.setName(angle_name)
            print("Joint angles encoded: " + angle_name)
        else:
            print("WARNING: no joint_axis_plane — moving part not created")

        # ── Tool creation ────────────────────────────────────────────────────
        # For static tools: offset = inv(flange) * tcp
        # For moving tools: offset = inv(flange) * axis * rotz(target - ref) * inv(axis) * tcp
        #   This rotates the TCP from its reference angle to the target angle
        #   around the joint axis, then expresses the result in the flange frame.

        def compute_tcp_offset(tcp_plane, on_moving, target_angle_deg):
            if not on_moving or resolved_axis is None:
                # Static — direct offset from flange
                return offset_mat(fo, tcp_plane)
            else:
                # Rotating — rotate TCP from reference angle to target angle
                delta_rad   = (target_angle_deg - ref_angle_val) * pi / 180.0
                flange_mat  = plane_to_mat(fo)
                axis_mat    = plane_to_mat(resolved_axis)
                tcp_mat     = plane_to_mat(tcp_plane)
                # TCP in axis frame
                tcp_in_axis = invH(axis_mat) * tcp_mat
                # Rotated TCP in axis frame
                rotated_tcp = rotz(delta_rad) * tcp_in_axis
                # Back to flange frame
                return invH(flange_mat) * axis_mat * rotated_tcp

        def create_tool(name, tcp_plane, on_moving, target_angle_deg):
            if tcp_plane is None:
                print(f"WARNING: {name} — no plane, skipping")
                return
            purge_all(name)
            offset = compute_tcp_offset(tcp_plane, on_moving, target_angle_deg)
            stl = "C:/temp/" + name + ".stl"
            write_minimal_stl(stl)
            tool = RDK.AddFile(stl, robot)
            tool.setName(name)
            tool.setPoseTool(offset)
            check = tool.PoseTool()
            print(name + " offset: (" + str(round(offset[0,3],1)) + ", " + str(round(offset[1,3],1)) + ", " + str(round(offset[2,3],1)) + ")")
            print(name + " readback: (" + str(round(check[0,3],1)) + ", " + str(round(check[1,3],1)) + ", " + str(round(check[2,3],1)) + ")")

        pm  = pickup_moving   or False
        km  = knotting_moving or False

        create_tool("pickup_open",     resolved_pickup, pm, open_angle)
        create_tool("pickup_closed",   resolved_pickup, pm, closed_angle)
        create_tool("knotting_open",   resolved_knot,   km, open_angle)
        create_tool("knotting_closed", resolved_knot,   km, closed_angle)

        print("Done")

    except Exception as e:
        print(f"RoboDK error: {e}")
        import traceback
        traceback.print_exc()

    sc.sticky["last_ee_stl_path"] = static_stl_path
    a = static_stl_path
# ---------- end py3_4 ----------
panel_7 = Panel(py3_4.out)
vec2pt = Vector2Pt(PointA=cluster_16, PointB=cluster_17, Unitize=False)  # -> Vector, Length
line = Line(py3_3.edge_lines)
rotate_7 = Rotate(Geometry=rotate_4.Geometry, Angle=multiplication, Plane=pl_6)  # -> Geometry, Transform
panel_8 = Panel(py3_4.a)
panel_9 = Panel(py3_3.out)
move_5 = Move(Geometry=rotate.Geometry, Motion=vec2pt.Vector)  # -> Geometry, Transform
tag_2 = TextTag(Location=py3_3.planes, Text=py3_3.names)
vec_11 = VectorXYZ(XComponent=0, YComponent=0, ZComponent=Slider(0, range=0..500))  # -> Vector, Length
panel_10 = Panel(py3_3.a)
move_6 = Move(Geometry=rotate_7.Geometry, Motion=vec_2.Vector)  # -> flatten(Geometry), Transform
brep_2 = Brep(<brep referenced from the Rhino model>)
panel_11 = Panel(py3_3.names)
filter = StreamFilter(Gate=Toggle(True), Stream0=merge_5, Stream1=merge_6)  # -> flatten(Stream)
move_7 = Move(Geometry=move_5.Geometry, Motion=vec_11.Vector)  # -> Geometry, Transform
cluster_19 = Cluster_2(
    A=Slider(480, range=0..1000),
    B=random,
    P=move_4.Geometry,
    A_2=Slider(173.8, range=0..200),
    t=random_2,
    D=Slider(0, range=0..90),
    panel_3=py3,
    R=Slider(0.412, range=0..1))  # -> flatten(R_2)
mesh_3 = MeshBrep(
    Brep=move_6.Geometry,
    Settings={GridMaxCount=0, GridMinCount=16, JaggedSeams=False, MaxEdgeLength=5000, MinEdgeLength=50, MinTolerance=0, Refine=True, RefineAngle=0, RelativeTolerance=0.65, SimplePlanes=True, Tolerance=0})  # -> flatten(Mesh)
xz = XZPlane(Origin=Point(0, 0, 0))
rotate_8 = Rotate(Geometry=move_7.Geometry, Angle=multiplication, Plane=pl_6)  # -> Geometry, Transform
py3_5 = Python3Script(name="celling", trigger=Button(), geometry=brep_2, color=ColourSwatch(SwatchColor=RGB(215, 211, 35)))  # -> out, a
# ---------- py3_5: Python ----------
import Rhino.Geometry as rg
import scriptcontext as sc
import System
import struct
import os
import sys

# ---------------------------------------------------------------------------
# Inputs:
#   geometry   : any geometry (mesh, brep, guid) — flat list or tree
#   name       : string — name for the object in RoboDK
#   color      : colour — optional, defaults to grey
#   trigger    : boolean — set True to push
# ---------------------------------------------------------------------------

if trigger:
    sc.sticky[f"last_{name}_done"] = False
    print(f"Trigger activated for '{name}'")

if not trigger and sc.sticky.get(f"last_{name}_done", False):
    print("No trigger — skipping")
else:
    # -----------------------------------------------------------------------
    # Flatten any input type into a list of geometry items
    # -----------------------------------------------------------------------
    def flatten(gh_input):
        result = []
        if hasattr(gh_input, 'Branches'):
            for branch in gh_input.Branches:
                for item in branch:
                    if item is not None:
                        result.append(item)
        elif hasattr(gh_input, '__iter__') and not isinstance(gh_input, (rg.Mesh, rg.Point3d)):
            for item in gh_input:
                if item is not None:
                    result.append(item)
        elif gh_input is not None:
            result.append(gh_input)
        return result

    geo_list = flatten(geometry)
    print(f"'{name}': {len(geo_list)} items")

    # -----------------------------------------------------------------------
    # Build combined mesh
    # -----------------------------------------------------------------------
    mesh_list = rg.Mesh()
    for geo in geo_list:
        if isinstance(geo, rg.Mesh):
            geo.Faces.ConvertQuadsToTriangles()
            mesh_list.Append(geo)
        elif isinstance(geo, rg.Brep):
            meshes = rg.Mesh.CreateFromBrep(geo, rg.MeshingParameters.Coarse)
            if meshes:
                for m in meshes:
                    m.Faces.ConvertQuadsToTriangles()
                    mesh_list.Append(m)
        elif isinstance(geo, System.Guid):
            obj = sc.doc.Objects.FindId(geo)
            if obj:
                g = obj.Geometry
                if isinstance(g, rg.Mesh):
                    g.Faces.ConvertQuadsToTriangles()
                    mesh_list.Append(g)
                elif isinstance(g, rg.Brep):
                    meshes = rg.Mesh.CreateFromBrep(g, rg.MeshingParameters.Coarse)
                    if meshes:
                        for m in meshes:
                            m.Faces.ConvertQuadsToTriangles()
                            mesh_list.Append(m)

    mesh_list.Faces.ConvertQuadsToTriangles()
    triangles = []
    for i in range(mesh_list.Faces.Count):
        face = mesh_list.Faces[i]
        triangles.append((
            mesh_list.Vertices[face.A],
            mesh_list.Vertices[face.B],
            mesh_list.Vertices[face.C]
        ))
    print(f"  {len(triangles)} triangles")

    # -----------------------------------------------------------------------
    # Write STL
    # -----------------------------------------------------------------------
    safe_name = name.replace(" ", "_")
    stl_path = f"C:/temp/{safe_name}.stl"
    os.makedirs("C:/temp", exist_ok=True)
    with open(stl_path, 'wb') as f:
        f.write(b'\0' * 80)
        f.write(struct.pack('<I', len(triangles)))
        for v0, v1, v2 in triangles:
            f.write(struct.pack('<fff', 0, 0, 0))
            f.write(struct.pack('<fff', v0.X, v0.Y, v0.Z))
            f.write(struct.pack('<fff', v1.X, v1.Y, v1.Z))
            f.write(struct.pack('<fff', v2.X, v2.Y, v2.Z))
            f.write(struct.pack('<H', 0))
    print(f"  STL -> {stl_path}")

    # -----------------------------------------------------------------------
    # Resolve colour input to [R, G, B, A] 0-1
    # -----------------------------------------------------------------------
    def resolve_color(c, default):
        if c is None:
            return default
        raw = c
        if hasattr(c, 'Branches'):
            try: raw = list(c.Branches[0])[0]
            except: return default
        if type(raw).__name__ == 'Color' or (hasattr(raw, 'R') and hasattr(raw, 'G') and hasattr(raw, 'B')):
            return [raw.R/255.0, raw.G/255.0, raw.B/255.0, raw.A/255.0 if hasattr(raw,'A') else 1.0]
        return default

    rgba = resolve_color(color, [0.6, 0.6, 0.65, 1.0])

    # -----------------------------------------------------------------------
    # Push to RoboDK
    # -----------------------------------------------------------------------
    try:
        sys.path.append("C:/RoboDK/Python")
        from robodk.robolink import Robolink

        RDK = Robolink()
        station = RDK.Item("", 1)
        print(f"  Station: {station.Name()}")

        # Purge any existing item with this name
        for _ in range(50):
            old = RDK.Item(safe_name)
            if not old.Valid(): break
            old.Delete()
            print(f"  purged old '{safe_name}'")

        # Load via snapshot
        before = set(it.item for it in RDK.ItemList(6, False))
        RDK.AddFile(stl_path)
        new_item = None
        for it in RDK.ItemList(6, False):
            if it.item not in before:
                new_item = it
                break
        if new_item is None:
            new_item = RDK.Item(safe_name)

        if new_item.Valid():
            new_item.setColor(rgba)
            print(f"  '{new_item.Name()}' loaded, color={[round(v,2) for v in rgba]}")
        else:
            print(f"  WARNING: item not valid after load")

        sc.sticky[f"last_{name}_done"] = True

    except Exception as e:
        print(f"RoboDK error: {e}")
        import traceback
        traceback.print_exc()
# ---------- end py3_5 ----------
panel_12 = Panel(py3_3.planes)
merge_7 = Merge(Data1=cluster_19, Data2=filter)
move_8 = Move(Geometry=rotate_8.Geometry, Motion=vec_2.Vector)  # -> flatten(Geometry), Transform
mirror = Mirror(Geometry=move_8.Geometry, Plane=xz)  # -> Geometry, Transform
cluster_20 = Cluster_7(P=flatten(py3_3.planes))
pipe = Pipe(Curve=merge_7, Radius=yarn_radius, Caps="1", FitRail=False)  # -> flatten(Pipe)
toggle = BooleanToggle(False)
merge_8 = Merge(Data1=move_8.Geometry, Data2=mirror.Geometry)  # -> flatten(Result)
number_slider_11 = Slider(45, range=-180..180)
toggle_2 = BooleanToggle(False)
filter_2 = StreamFilter(Gate=toggle, Stream1=cluster_4.out_cones)
number_slider_12 = Slider(488.239, range=-8000..2000)
filter_3 = StreamFilter(Gate=toggle, Stream1=cluster_2.out_cone_centroid_bottoms)
filter_4 = StreamFilter(Gate=toggle_2, Stream1=cluster_2.out_cones)
filter_5 = StreamFilter(Gate=toggle_2, Stream1=cluster_4.out_cone_centroid_bottoms)
bbox_3 = BoundingBox(Content=move_8.Geometry, Plane=PlaneXY(0, 0, 0), UnionBox=True)  # -> Box, Box_2
X = UnitX(Factor=1)
Y = UnitY(Factor=1)
debox_3 = DeconstructBox(Box=bbox_3.Box)  # -> Plane, X, Y, Z
multiplication_2 = Multiplication(A=X, B=number_slider_12)
dedomain_4 = DeconstructDomain(Domain=debox_3.X)  # -> Start, End
merge_9 = Merge(Data1=cluster_3.out_cones, Data2=filter_4, Data3=filter_2)  # -> flatten(Result)
addition_7 = Addition(A=cluster_5, B=Slider(402.308, range=0..1000))

# ---- group: Absolute Maximum
merge_10 = Merge(Data1=dedomain_4.Start, Data2=dedomain_4.End)
abs = Absolute(Value=merge_10)
sort = SortList(Keys=abs, ValuesA=merge_10)  # -> Keys, ValuesA
item = ListItem(List=sort.ValuesA, Index=1, Wrap=True)

# ----
multiplication_3 = Multiplication(A=Y, B=number_slider_12)
Z = UnitZ(Factor=cluster_5)
move_9 = Move(Geometry=rotate_3.Geometry, Motion=Z)  # -> flatten(Geometry), Transform
rotate_9 = Rotate(Geometry=move_9.Geometry, Angle=multiplication, Plane=pl_6)  # -> Geometry, Transform
move_10 = Move(Geometry=rotate_9.Geometry, Motion=vec_2.Vector)  # -> flatten(Geometry), Transform
deplane = DeconstructPlane(Plane=move_10.Geometry)  # -> Origin, XAxis, YAxis, ZAxis
panel_13 = Panel(move_10.Geometry)
amp = Amplitude(Vector=deplane.ZAxis, Amplitude=Slider(455, range=0..500))
move_11 = Move(Geometry=move_10.Geometry, Motion=amp)  # -> flatten(Geometry), Transform
merge_11 = Merge(Data1=cluster_3.out_cone_centroid_bottoms, Data2=filter_5, Data3=filter_3)
Z_2 = UnitZ(Factor=machine_cone_pickup_offset)
arrlinear = LinearArray(Geometry=merge_8, Direction=multiplication_2, Count="2")  # -> flatten(Geometry), Transform
flatten = FlattenTree(Tree=merge_9, Path="{0}")
lng = ListLength(List=merge_11)
Z_3 = UnitZ(Factor=addition_7)
division_6 = Division(A=Slider(-3003.267, range=-5000..1000), B="2")
arrlinear_2 = LinearArray(Geometry=move_8.Geometry, Direction=multiplication_3, Count="3")  # -> flatten(Geometry), Transform
division_7 = Division(A=lng, B="2")
cluster_21 = Cluster_8(A=number_slider_11, A_2=division_7)
cluster_22 = Cluster_8(A=number_slider_11, A_2=division_7)
merge_12 = Merge(Data1=cluster_21, Data2=cluster_22)
rotate_10 = Rotate(Geometry=merge_11, Angle=merge_12, Plane=merge_11)  # -> Geometry, Transform
mesh_4 = MeshBrep(
    Brep=flatten,
    Settings={GridMaxCount=0, GridMinCount=16, JaggedSeams=False, MaxEdgeLength=5000, MinEdgeLength=50, MinTolerance=0, Refine=True, RefineAngle=0, RelativeTolerance=0.65, SimplePlanes=True, Tolerance=0})  # -> flatten(Mesh)
Y_2 = UnitY(Factor=1)
number_slider_13 = Slider(200, range=0..1000)
vec_12 = VectorXYZ(XComponent="-600", YComponent=0, ZComponent="50")  # -> Vector, Length
addition_8 = Addition(A=division_6, B=item)
move_12 = Move(Geometry=merge_11, Motion=Z_3)  # -> flatten(Geometry), Transform
panel_14 = Panel(merge_12)
cluster_23 = Cluster_7(P=flatten(rotate_10.Geometry))
move_13 = Move(Geometry=rotate_10.Geometry, Motion=Z)  # -> flatten(Geometry), Transform
yz = YZPlane(Origin=Point(0, 0, 0))
vec_13 = VectorXYZ(XComponent=addition_8, YComponent=0, ZComponent=0)  # -> Vector, Length
lng_2 = ListLength(List=move_12.Geometry)
multiplication_4 = Multiplication(A=Y_2, B=number_slider_12)
move_14 = Move(Geometry=arrlinear_2.Geometry, Motion=vec_12.Vector)  # -> Geometry, Transform
division_8 = Division(A=lng_2, B="2")
move_15 = Move(Geometry=move_13.Geometry, Motion=Z_2)  # -> flatten(Geometry), Transform
move_16 = Move(Geometry=yz, Motion=vec_13.Vector)  # -> Geometry, Transform
swatch = ColourSwatch(SwatchColor=RGB(204, 35, 35))
mesh_5 = MeshBrep(
    Brep=pipe,
    Settings={GridMaxCount=0, GridMinCount=16, JaggedSeams=False, MaxEdgeLength=5000, MinEdgeLength=50, MinTolerance=0, Refine=True, RefineAngle=0, RelativeTolerance=0.65, SimplePlanes=True, Tolerance=0})  # -> flatten(Mesh)
merge_13 = Merge(Data1=merge_8, Data2=arrlinear.Geometry)  # -> flatten(Result)
split = SplitList(List=move_12.Geometry, Index=division_8)  # -> ListA, ListB
mirror_2 = Mirror(Geometry=move_8.Geometry, Plane=move_16.Geometry)  # -> Geometry, Transform
arrlinear_3 = LinearArray(Geometry=mirror_2.Geometry, Direction=multiplication_4, Count="2")  # -> flatten(Geometry), Transform
multiplication_5 = Multiplication(A=number_slider_13, B="-1")
X_2 = UnitX(Factor=number_slider_13)
X_3 = UnitX(Factor="-150")
X_4 = UnitX(Factor=multiplication_5)
move_17 = Move(Geometry=split.ListB, Motion=X_2)  # -> Geometry, Transform
move_18 = Move(Geometry=split.ListA, Motion=X_4)  # -> Geometry, Transform
move_19 = Move(Geometry=arrlinear_3.Geometry, Motion=X_3)  # -> Geometry, Transform
merge_14 = Merge(Data1=move_18.Geometry, Data2=move_17.Geometry)  # -> flatten(Result)
py3_6 = Python3Script(
    cones=flatten(mesh_4),
    grab_points=flatten(move_13.Geometry),
    trigger=flatten(Button()),
    strings=flatten(mesh_5),
    string_grab_points=flatten(move_12.Geometry),
    cone_color=swatch,
    string_color=swatch,
    approach_points=flatten(move_15.Geometry),
    string_approach_points=flatten(merge_14),
    names=flatten(cluster_3.out_names),
    update_and_amalgamate_waypoints=Toggle(True))  # -> out, a; inputs cones: list, grab_points: list, trigger: list, strings: list, string_grab_points: list, approach_points: list, string_approach_points: list, names: list
# ---------- py3_6: Python ----------
# GhPython component (Rhino 8 / CPython 3)
# Export machine cone grab points to YAML and import STLs + targets into RoboDK.
#
# GH Inputs:
#   cones                  : geometry (DataTree one branch per cone, or flat list)
#   grab_points            : flat list of Planes ΓÇö cone grab planes
#   approach_points        : flat list of Planes ΓÇö cone approach planes (pre-computed in GH)
#   string_grab_points     : flat list of Planes ΓÇö string grab planes
#   string_approach_points : flat list of Planes ΓÇö string approach planes (pre-computed in GH)
#   strings                : geometry (flat list)
#   names                  : flat list of str ΓÇö one name per cone; used for RoboDK items and YAML (optional, defaults to "cone_0", "cone_1", ...)
#   cone_color             : Colour (optional, default red)
#   string_color           : Colour (optional, default green)
#   trigger                : Boolean (default True)
#
# GH Outputs:
#   a : last STL path written (str)

from Grasshopper import DataTree
import Rhino
import Rhino.Geometry as rg
import scriptcontext as sc
import System
import struct
import os
import sys
import math

# ΓöÇΓöÇ Optional inputs with defaults ΓöÇΓöÇΓöÇΓöÇΓöÇΓöÇΓöÇΓöÇΓöÇΓöÇΓöÇΓöÇΓöÇΓöÇΓöÇΓöÇΓöÇΓöÇΓöÇΓöÇΓöÇΓöÇΓöÇΓöÇΓöÇΓöÇΓöÇΓöÇΓöÇΓöÇΓöÇΓöÇΓöÇΓöÇΓöÇΓöÇΓöÇΓöÇΓöÇΓöÇΓöÇΓöÇΓöÇΓöÇΓöÇ
try:
    trigger
except NameError:
    trigger = True

try:
    approach_points
except NameError:
    approach_points = None

try:
    string_approach_points
except NameError:
    string_approach_points = None

try:
    names
except NameError:
    names = None

try:
    update_and_amalgamate_waypoints
except NameError:
    update_and_amalgamate_waypoints = False

YAML_PATH = r"C:\Users\samst\Framework\clones\custom_estimates_using_dhr_methods\robo_dk_output\machine_cone_waypoints.yaml"

# ΓöÇΓöÇ Output default ΓöÇΓöÇΓöÇΓöÇΓöÇΓöÇΓöÇΓöÇΓöÇΓöÇΓöÇΓöÇΓöÇΓöÇΓöÇΓöÇΓöÇΓöÇΓöÇΓöÇΓöÇΓöÇΓöÇΓöÇΓöÇΓöÇΓöÇΓöÇΓöÇΓöÇΓöÇΓöÇΓöÇΓöÇΓöÇΓöÇΓöÇΓöÇΓöÇΓöÇΓöÇΓöÇΓöÇΓöÇΓöÇΓöÇΓöÇΓöÇΓöÇΓöÇΓöÇΓöÇΓöÇΓöÇΓöÇΓöÇΓöÇΓöÇΓöÇΓöÇΓöÇ
a = ""

# ΓöÇΓöÇ Helpers ΓöÇΓöÇΓöÇΓöÇΓöÇΓöÇΓöÇΓöÇΓöÇΓöÇΓöÇΓöÇΓöÇΓöÇΓöÇΓöÇΓöÇΓöÇΓöÇΓöÇΓöÇΓöÇΓöÇΓöÇΓöÇΓöÇΓöÇΓöÇΓöÇΓöÇΓöÇΓöÇΓöÇΓöÇΓöÇΓöÇΓöÇΓöÇΓöÇΓöÇΓöÇΓöÇΓöÇΓöÇΓöÇΓöÇΓöÇΓöÇΓöÇΓöÇΓöÇΓöÇΓöÇΓöÇΓöÇΓöÇΓöÇΓöÇΓöÇΓöÇΓöÇΓöÇΓöÇΓöÇΓöÇΓöÇΓöÇΓöÇ

def flatten_input(gh_input, exclude_type=None):
    result = []
    if hasattr(gh_input, 'Branches'):
        for branch in gh_input.Branches:
            for item in branch:
                if item is not None:
                    result.append(item)
    elif hasattr(gh_input, '__iter__') and (exclude_type is None or not isinstance(gh_input, exclude_type)):
        for item in gh_input:
            if item is not None:
                result.append(item)
    elif gh_input is not None:
        result.append(gh_input)
    return result

def diagnose_tree(name, gh_input):
    if hasattr(gh_input, 'Branches'):
        print(f"  {name}: DataTree {len(gh_input.Branches)} branches")
        for j, (path, branch) in enumerate(zip(gh_input.Paths, gh_input.Branches)):
            print(f"    branch[{j}] path={path} items={len(branch)}")
    elif hasattr(gh_input, '__iter__') and not isinstance(gh_input, (rg.Mesh, rg.Point3d, rg.Plane)):
        print(f"  {name}: list len={len(list(gh_input))}")
    else:
        print(f"  {name}: {type(gh_input).__name__}")

def resolve_plane(item):
    if item is None:
        return None
    if isinstance(item, rg.Plane):
        return item
    if isinstance(item, System.Guid):
        rhino_obj = sc.doc.Objects.FindId(item)
        if rhino_obj:
            geo = rhino_obj.Geometry
            if isinstance(geo, rg.Plane): return geo
            if isinstance(geo, rg.Point): item = geo.Location
            elif hasattr(geo, 'Location'): item = geo.Location
            else: item = geo.GetBoundingBox(True).Center
        else:
            print(f"  Could not find Guid: {item}")
            return None
    if isinstance(item, rg.Point3d):
        return rg.Plane(item, rg.Vector3d.XAxis, rg.Vector3d.YAxis)
    if isinstance(item, rg.Point):
        return rg.Plane(item.Location, rg.Vector3d.XAxis, rg.Vector3d.YAxis)
    if hasattr(item, 'X') and hasattr(item, 'Y') and hasattr(item, 'Z'):
        return rg.Plane(rg.Point3d(item.X, item.Y, item.Z), rg.Vector3d.XAxis, rg.Vector3d.YAxis)
    print(f"  Unknown plane type: {type(item)}")
    return None

def resolve_color(gh_color, default_rgba):
    if gh_color is None:
        return default_rgba
    def color_from_raw(raw):
        if raw is None: return None
        if type(raw).__name__ == 'Color' or (hasattr(raw,'R') and hasattr(raw,'G') and hasattr(raw,'B')):
            return [raw.R/255.0, raw.G/255.0, raw.B/255.0, raw.A/255.0]
        if isinstance(raw, (list, tuple)) and all(isinstance(v, (int, float)) for v in raw):
            vals = list(raw)[:4]
            if any(v > 1.0 for v in vals): vals = [v/255.0 for v in vals]
            while len(vals) < 4: vals.append(1.0)
            return vals
        return None
    if hasattr(gh_color, 'Branches'):
        try: return color_from_raw(list(gh_color.Branches[0])[0]) or default_rgba
        except: return default_rgba
    result = color_from_raw(gh_color)
    if result: return result
    if hasattr(gh_color, '__iter__') and not isinstance(gh_color, str):
        try:
            for item in gh_color:
                if item is not None:
                    result = color_from_raw(item)
                    if result: return result
                    break
        except: pass
    return default_rgba

def plane_to_xyzrpw(plane):
    """Convert Rhino Plane to world-space XYZ + ZYX Euler angles (degrees)."""
    ox, oy, oz = plane.Origin.X, plane.Origin.Y, plane.Origin.Z
    xax, yax, zax = plane.XAxis, plane.YAxis, plane.ZAxis
    sy = -xax.Z
    cy = math.sqrt(xax.X**2 + xax.Y**2)
    if cy > 1e-6:
        rx = math.atan2(yax.Z, zax.Z)
        ry = math.atan2(sy, cy)
        rz = math.atan2(xax.Y, xax.X)
    else:
        rx = math.atan2(-zax.Y, yax.Y)
        ry = math.atan2(sy, cy)
        rz = 0.0
    return (round(ox,4), round(oy,4), round(oz,4),
            round(math.degrees(rx),6), round(math.degrees(ry),6), round(math.degrees(rz),6))

def write_waypoints_yaml(waypoints, edges, path):
    lines = ["waypoints:"]
    for w in waypoints:
        lines.append(f"  - name: {w['name']}")
        lines.append(f"    x: {w['x']}")
        lines.append(f"    y: {w['y']}")
        lines.append(f"    z: {w['z']}")
        lines.append(f"    rx: {w['rx']}")
        lines.append(f"    ry: {w['ry']}")
        lines.append(f"    rz: {w['rz']}")
        lines.append(f"    frame: world")
        lines.append(f"    move_type: {w['move_type']}")
        lines.append(f"    j7: null")
        lines.append(f"    source: grasshopper")
        if w.get('note'):
            lines.append(f"    note: \"{w['note']}\"")
    lines.append("")
    lines.append("edges:")
    for e in edges:
        lines.append(f"  - from: {e['from']}")
        lines.append(f"    to:   {e['to']}")
        lines.append(f"    tested: null")
    os.makedirs(os.path.dirname(path), exist_ok=True)
    with open(path, "w", encoding="utf-8") as f:
        f.write("\n".join(lines) + "\n")

def build_and_write_stl(geo_list, stl_path):
    mesh_list = rg.Mesh()
    for geo in geo_list:
        if isinstance(geo, rg.Mesh):
            geo.Faces.ConvertQuadsToTriangles(); mesh_list.Append(geo)
        elif isinstance(geo, rg.Brep):
            meshes = rg.Mesh.CreateFromBrep(geo, rg.MeshingParameters.Coarse)
            if meshes:
                for m in meshes: m.Faces.ConvertQuadsToTriangles(); mesh_list.Append(m)
        elif isinstance(geo, System.Guid):
            rhino_obj = sc.doc.Objects.FindId(geo)
            if rhino_obj:
                obj_geo = rhino_obj.Geometry
                if isinstance(obj_geo, rg.Mesh):
                    obj_geo.Faces.ConvertQuadsToTriangles(); mesh_list.Append(obj_geo)
                elif isinstance(obj_geo, rg.Brep):
                    meshes = rg.Mesh.CreateFromBrep(obj_geo, rg.MeshingParameters.Coarse)
                    if meshes:
                        for m in meshes: m.Faces.ConvertQuadsToTriangles(); mesh_list.Append(m)
    mesh_list.Faces.ConvertQuadsToTriangles()
    triangles = []
    for i in range(mesh_list.Faces.Count):
        face = mesh_list.Faces[i]
        triangles.append((mesh_list.Vertices[face.A], mesh_list.Vertices[face.B], mesh_list.Vertices[face.C]))
    os.makedirs(os.path.dirname(stl_path), exist_ok=True)
    with open(stl_path, 'wb') as f:
        f.write(b'\0' * 80)
        f.write(struct.pack('<I', len(triangles)))
        for v0, v1, v2 in triangles:
            f.write(struct.pack('<fff', 0, 0, 0))
            f.write(struct.pack('<fff', v0.X, v0.Y, v0.Z))
            f.write(struct.pack('<fff', v1.X, v1.Y, v1.Z))
            f.write(struct.pack('<fff', v2.X, v2.Y, v2.Z))
            f.write(struct.pack('<H', 0))
    return len(triangles)

# ΓöÇΓöÇ Collect inputs ΓöÇΓöÇΓöÇΓöÇΓöÇΓöÇΓöÇΓöÇΓöÇΓöÇΓöÇΓöÇΓöÇΓöÇΓöÇΓöÇΓöÇΓöÇΓöÇΓöÇΓöÇΓöÇΓöÇΓöÇΓöÇΓöÇΓöÇΓöÇΓöÇΓöÇΓöÇΓöÇΓöÇΓöÇΓöÇΓöÇΓöÇΓöÇΓöÇΓöÇΓöÇΓöÇΓöÇΓöÇΓöÇΓöÇΓöÇΓöÇΓöÇΓöÇΓöÇΓöÇΓöÇΓöÇΓöÇΓöÇΓöÇΓöÇΓöÇΓöÇΓöÇ

print("=== INPUT DIAGNOSTICS ===")
diagnose_tree("cones",                   cones)
diagnose_tree("grab_points",             grab_points)
diagnose_tree("approach_points",         approach_points)
diagnose_tree("string_grab_points",      string_grab_points)
diagnose_tree("string_approach_points",  string_approach_points)
diagnose_tree("strings",                 strings)
print("=========================")

cone_rgba   = resolve_color(cone_color   if 'cone_color'   in dir() else None, [1.0, 0.0, 0.0, 1.0])
string_rgba = resolve_color(string_color if 'string_color' in dir() else None, [0.0, 1.0, 0.0, 1.0])

raw_names = flatten_input(names) if names is not None else []
def cone_name(i):
    if i < len(raw_names) and raw_names[i]:
        return str(raw_names[i])
    return f"cone_{i}"

cone_branches = []
if hasattr(cones, 'Branches') and len(cones.Branches) > 1:
    for branch in cones.Branches:
        items = [item for item in branch if item is not None]
        if items: cone_branches.append(items)
    print(f"MODE A: {len(cone_branches)} branches from DataTree")
else:
    flat = flatten_input(cones, exclude_type=rg.Mesh)
    for item in flat: cone_branches.append([item])
    print(f"MODE B: {len(cone_branches)} cones from flat list")

strings_list           = flatten_input(strings, exclude_type=rg.Mesh)
cone_grab_planes       = [resolve_plane(p) for p in flatten_input(grab_points)]
cone_approach_planes   = [resolve_plane(p) for p in flatten_input(approach_points)] if approach_points is not None else []
str_grab_planes        = [resolve_plane(p) for p in flatten_input(string_grab_points)]
str_approach_planes    = [resolve_plane(p) for p in flatten_input(string_approach_points)] if string_approach_points is not None else []

num_cones = len(cone_branches)
print(f"num_cones={num_cones}  cone_grabs={len(cone_grab_planes)}  cone_approaches={len(cone_approach_planes)}")
print(f"str_grabs={len(str_grab_planes)}  str_approaches={len(str_approach_planes)}")

if trigger:
    print("Rebuilding...")

    os.makedirs("C:/temp/cones", exist_ok=True)
    cone_stl_paths = []
    for i, branch_geos in enumerate(cone_branches):
        path = f"C:/temp/cones/{cone_name(i)}.stl"
        tris = build_and_write_stl(branch_geos, path)
        cone_stl_paths.append(path)
        print(f"  {cone_name(i)}: {tris} triangles -> {path}")

    strings_stl_path = "C:/temp/strings.stl"
    string_tris = build_and_write_stl(strings_list, strings_stl_path)
    print(f"Strings: {string_tris} triangles -> {strings_stl_path}")

    # ΓöÇΓöÇ YAML export ΓöÇΓöÇΓöÇΓöÇΓöÇΓöÇΓöÇΓöÇΓöÇΓöÇΓöÇΓöÇΓöÇΓöÇΓöÇΓöÇΓöÇΓöÇΓöÇΓöÇΓöÇΓöÇΓöÇΓöÇΓöÇΓöÇΓöÇΓöÇΓöÇΓöÇΓöÇΓöÇΓöÇΓöÇΓöÇΓöÇΓöÇΓöÇΓöÇΓöÇΓöÇΓöÇΓöÇΓöÇΓöÇΓöÇΓöÇΓöÇΓöÇΓöÇΓöÇΓöÇΓöÇΓöÇΓöÇΓöÇΓöÇΓöÇΓöÇ
    waypoints = []
    edges     = []

    for i, pl in enumerate(cone_grab_planes):
        if pl is None:
            print(f"  WARNING: cone_grab_{i} plane is None ΓÇö skipping")
            continue
        ap = cone_approach_planes[i] if i < len(cone_approach_planes) else None
        if ap is None:
            print(f"  WARNING: cone_grab_{i} approach plane is None ΓÇö skipping YAML entry")
        grab_name     = f"{cone_name(i)}_grab"
        approach_name = f"{cone_name(i)}_grab_approach"
        x,y,z,rx,ry,rz = plane_to_xyzrpw(pl)
        waypoints.append({"name": grab_name, "x":x,"y":y,"z":z,"rx":rx,"ry":ry,"rz":rz,
                          "move_type":"MoveL","note":"machine cone place"})
        if ap is not None:
            ax,ay,az,arx,ary,arz = plane_to_xyzrpw(ap)
            waypoints.append({"name": approach_name, "x":ax,"y":ay,"z":az,"rx":arx,"ry":ary,"rz":arz,
                              "move_type":"MoveJ","note":"machine cone approach"})
            edges.append({"from": approach_name, "to": grab_name})
            edges.append({"from": grab_name,     "to": approach_name})

    for i, pl in enumerate(str_grab_planes):
        if pl is None:
            print(f"  WARNING: str_grab_{i} plane is None ΓÇö skipping")
            continue
        ap = str_approach_planes[i] if i < len(str_approach_planes) else None
        grab_name     = f"{cone_name(i)}_string_grab"
        approach_name = f"{cone_name(i)}_string_grab_approach"
        x,y,z,rx,ry,rz = plane_to_xyzrpw(pl)
        waypoints.append({"name": grab_name, "x":x,"y":y,"z":z,"rx":rx,"ry":ry,"rz":rz,
                          "move_type":"MoveL","note":"machine string grab"})
        if ap is not None:
            ax,ay,az,arx,ary,arz = plane_to_xyzrpw(ap)
            waypoints.append({"name": approach_name, "x":ax,"y":ay,"z":az,"rx":arx,"ry":ary,"rz":arz,
                              "move_type":"MoveJ","note":"machine string approach"})
            edges.append({"from": approach_name, "to": grab_name})
            edges.append({"from": grab_name,     "to": approach_name})

    write_waypoints_yaml(waypoints, edges, YAML_PATH)
    print(f"[OK] {len(waypoints)} waypoints, {len(edges)} edges -> {YAML_PATH}")

    # ΓöÇΓöÇ RoboDK import ΓöÇΓöÇΓöÇΓöÇΓöÇΓöÇΓöÇΓöÇΓöÇΓöÇΓöÇΓöÇΓöÇΓöÇΓöÇΓöÇΓöÇΓöÇΓöÇΓöÇΓöÇΓöÇΓöÇΓöÇΓöÇΓöÇΓöÇΓöÇΓöÇΓöÇΓöÇΓöÇΓöÇΓöÇΓöÇΓöÇΓöÇΓöÇΓöÇΓöÇΓöÇΓöÇΓöÇΓöÇΓöÇΓöÇΓöÇΓöÇΓöÇΓöÇΓöÇΓöÇΓöÇΓöÇΓöÇΓöÇΓöÇ
    try:
        sys.path.append("C:/RoboDK/Python")
        from robodk.robolink import Robolink
        from robodk.robomath import Mat

        def identity():
            return Mat([[1,0,0,0],[0,1,0,0],[0,0,1,0],[0,0,0,1]])

        RDK = Robolink()
        station = RDK.Item("", 1)
        print(f"Station: {station.Name()}")

        def purge_all(name):
            count = 0
            for _ in range(50):
                item = RDK.Item(name)
                if not item.Valid(): break
                item.Delete()
                count += 1
            if count: print(f"  purged {count}x '{name}'")

        def add_file_and_get_item(stl_path):
            from robodk.robolink import ITEM_TYPE_OBJECT
            before = set(it.item for it in RDK.ItemList(ITEM_TYPE_OBJECT, False))
            RDK.AddFile(stl_path)
            for it in RDK.ItemList(ITEM_TYPE_OBJECT, False):
                if it.item not in before:
                    return it
            stem = os.path.splitext(os.path.basename(stl_path))[0]
            return RDK.Item(stem)

        # Purge only items added by previous runs of this script.
        # Deleting the "Cones" frame removes all cone frames and targets under it.
        purge_all("strings")
        purge_all("Cones")

        # Rebuild
        cones_frame = RDK.AddFrame("Cones", station)
        cones_frame.setPose(identity())
        print("Created Cones frame")

        strings_item = add_file_and_get_item(strings_stl_path)
        if strings_item.Valid():
            strings_item.setColor(string_rgba)
            strings_item.setParentStatic(cones_frame)
            print("Strings: ok")
        else:
            print("WARNING: strings item not valid")

        for i in range(num_cones):
            cn = cone_name(i)
            cone_frame = RDK.AddFrame(cn, cones_frame)
            cone_frame.setPose(identity())

            cone_obj = add_file_and_get_item(cone_stl_paths[i])
            if cone_obj.Valid():
                cone_obj.setColor(cone_rgba)
                cone_obj.setParentStatic(cone_frame)
                print(f"  {cn}: STL ok")
            else:
                print(f"  WARNING: {cn} STL not valid")


        print(f"Done -- {num_cones} cones in tree")
        a = cone_stl_paths[0] if cone_stl_paths else ""

    except Exception as e:
        print(f"RoboDK error: {e}")
        import traceback
        traceback.print_exc()

    # ΓöÇΓöÇ Amalgamate waypoints + re-import to RoboDK ΓöÇΓöÇΓöÇΓöÇΓöÇΓöÇΓöÇΓöÇΓöÇΓöÇΓöÇΓöÇΓöÇΓöÇΓöÇΓöÇΓöÇΓöÇΓöÇΓöÇΓöÇΓöÇΓöÇΓöÇΓöÇΓöÇΓöÇΓöÇ
    if update_and_amalgamate_waypoints:
        import subprocess
        REPO = r"C:\Users\samst\Framework\clones\custom_estimates_using_dhr_methods"
        amalgamate_script  = os.path.join(REPO, "robodk_code", "amalgamate_waypoints.py")
        import_script      = os.path.join(REPO, "robodk_code", "import_waypoints_to_robodk.py")

        # sys.executable in GhPython is Rhino.exe ΓÇö use the Rhino CPython interpreter directly
        PYTHON = r"C:\Users\samst\.rhinocode\py39-rh8\python.exe"

        print("\n--- amalgamate_waypoints ---")
        r1 = subprocess.run([PYTHON, amalgamate_script], capture_output=True, text=True)
        print(r1.stdout)
        if r1.returncode != 0:
            print(f"[ERROR] amalgamate_waypoints failed (rc={r1.returncode}):\n{r1.stderr}")
        else:
            print("\n--- import_waypoints_to_robodk ---")
            r2 = subprocess.run([PYTHON, import_script], capture_output=True, text=True)
            print(r2.stdout)
            if r2.returncode != 0:
                print(f"[ERROR] import_waypoints_to_robodk failed (rc={r2.returncode}):\n{r2.stderr}")
# ---------- end py3_6 ----------
Z_4 = UnitZ(Factor="70")
move_20 = Move(Geometry=move_19.Geometry, Motion=Z_4)  # -> Geometry, Transform
panel_15 = Panel(merge_14)
lng_3 = ListLength(List=merge_14)
merge_15 = Merge(Data1=move_14.Geometry, Data2=move_20.Geometry, Data3=arrlinear_2.Geometry)  # -> flatten(Result)
py3_7 = Python3Script(
    trigger=Button(),
    cones=mesh_3,
    grab_points=move_10.Geometry,
    string_grab_points=move_10.Geometry,
    cone_color=swatch,
    bins=merge_15,
    approach_points=move_11.Geometry,
    string_approach_points=move_11.Geometry,
    cone_names=cluster_9.out_names)  # -> out, a; inputs cones: list, grab_points: list, string_grab_points: list, bins: list, approach_points: list, string_approach_points: list, cone_names: list
# ---------- py3_7: Python ----------
# GhPython component (Rhino 8 / CPython 3)
# Export base cone grab points + approach offsets to YAML and import STLs into RoboDK.
#
# GH Inputs:
#   cones               : geometry (DataTree one branch per cone, or flat list)
#   grab_points         : flat list of Planes, one per cone ΓÇö cone grab planes
#   approach_points     : flat list of Planes, one per cone ΓÇö cone approach planes (pre-computed in GH)
#   string_grab_points  : flat list of Planes, one per cone
#   string_approach_points : flat list of Planes, one per cone ΓÇö string approach planes (pre-computed in GH)
#   bins                : geometry (flat list or DataTree, one branch per bin)
#   cone_names          : flat list of str ΓÇö one name per cone; used for RoboDK items and YAML (optional, defaults to "base_cone_0", ...)
#   bin_names           : flat list of str ΓÇö one name per bin; used for RoboDK items (optional, defaults to "bin_0", ...)
#   base_origin         : Point ΓÇö robot base origin in Rhino model space
#   yaml_path           : str   ΓÇö output YAML path (default: repo/robo_dk_output/base_cone_waypoints.yaml)
#   cone_color          : Colour (optional, default orange)
#   string_color        : Colour (optional, default yellow)
#   bin_color           : Colour (optional, default blue)
#   update_and_amalgamate_waypoints : Boolean ΓÇö if True, runs amalgamate_waypoints.py then import_waypoints_to_robodk.py after export
#   trigger             : Boolean
#
# GH Outputs:
#   grab_planes         : list of Plane ΓÇö cone grab planes (passthrough)
#   approach_planes     : list of Plane ΓÇö cone approach planes (passthrough)
#   str_planes          : list of Plane ΓÇö string grab planes (passthrough)
#   str_approach_planes : list of Plane ΓÇö string approach planes (passthrough)
#   stl_paths           : list of str  ΓÇö STL files written
#   yaml_out            : str          ΓÇö path to written YAML

import os
import sys
import math
import struct
import Rhino.Geometry as rg
import scriptcontext as sc
import System

# ΓöÇΓöÇ Optional inputs with defaults ΓöÇΓöÇΓöÇΓöÇΓöÇΓöÇΓöÇΓöÇΓöÇΓöÇΓöÇΓöÇΓöÇΓöÇΓöÇΓöÇΓöÇΓöÇΓöÇΓöÇΓöÇΓöÇΓöÇΓöÇΓöÇΓöÇΓöÇΓöÇΓöÇΓöÇΓöÇΓöÇΓöÇΓöÇΓöÇΓöÇΓöÇΓöÇΓöÇΓöÇΓöÇΓöÇΓöÇΓöÇ
try:
    yaml_path
except NameError:
    yaml_path = None

try:
    approach_points
except NameError:
    approach_points = None

try:
    string_approach_points
except NameError:
    string_approach_points = None

try:
    strings
except NameError:
    strings = None

try:
    cone_names
except NameError:
    cone_names = None

try:
    bin_names
except NameError:
    bin_names = None

try:
    update_and_amalgamate_waypoints
except NameError:
    update_and_amalgamate_waypoints = False

if yaml_path is None or yaml_path == "":
    yaml_path = r"C:\Users\samst\Framework\clones\custom_estimates_using_dhr_methods\robo_dk_output\base_cone_waypoints.yaml"

# ΓöÇΓöÇ Helpers (unchanged from original) ΓöÇΓöÇΓöÇΓöÇΓöÇΓöÇΓöÇΓöÇΓöÇΓöÇΓöÇΓöÇΓöÇΓöÇΓöÇΓöÇΓöÇΓöÇΓöÇΓöÇΓöÇΓöÇΓöÇΓöÇΓöÇΓöÇΓöÇΓöÇΓöÇΓöÇΓöÇΓöÇΓöÇΓöÇΓöÇΓöÇΓöÇΓöÇΓöÇΓöÇ

def flatten_input(gh_input, exclude_type=None):
    result = []
    if hasattr(gh_input, 'Branches'):
        for branch in gh_input.Branches:
            for item in branch:
                if item is not None:
                    result.append(item)
    elif hasattr(gh_input, '__iter__') and (exclude_type is None or not isinstance(gh_input, exclude_type)):
        for item in gh_input:
            if item is not None:
                result.append(item)
    elif gh_input is not None:
        result.append(gh_input)
    return result

def resolve_first_point(gh_input):
    def to_pt(item):
        if isinstance(item, System.Guid):
            rhino_obj = sc.doc.Objects.FindId(item)
            if rhino_obj:
                geo = rhino_obj.Geometry
                if isinstance(geo, rg.Point): return geo.Location
                elif hasattr(geo, 'Location'): return geo.Location
                else: return geo.GetBoundingBox(True).Center
            return None
        if isinstance(item, rg.Point3d): return item
        if isinstance(item, rg.Point): return item.Location
        if hasattr(item, 'X') and hasattr(item, 'Y') and hasattr(item, 'Z'):
            return rg.Point3d(item.X, item.Y, item.Z)
        return None
    items = flatten_input(gh_input, exclude_type=rg.Point3d)
    if not items:
        return to_pt(gh_input)
    for item in items:
        pt = to_pt(item)
        if pt is not None:
            return pt
    return None

def resolve_plane(item):
    if item is None:
        return None
    if isinstance(item, rg.Plane):
        return item
    if isinstance(item, System.Guid):
        rhino_obj = sc.doc.Objects.FindId(item)
        if rhino_obj:
            geo = rhino_obj.Geometry
            if isinstance(geo, rg.Plane): return geo
            if isinstance(geo, rg.Point): item = geo.Location
            elif hasattr(geo, 'Location'): item = geo.Location
            else: item = geo.GetBoundingBox(True).Center
        else:
            print(f"  Could not find Guid: {item}")
            return None
    if isinstance(item, rg.Point3d):
        return rg.Plane(item, rg.Vector3d.XAxis, rg.Vector3d.YAxis)
    if isinstance(item, rg.Point):
        return rg.Plane(item.Location, rg.Vector3d.XAxis, rg.Vector3d.YAxis)
    if hasattr(item, 'X') and hasattr(item, 'Y') and hasattr(item, 'Z'):
        return rg.Plane(rg.Point3d(item.X, item.Y, item.Z), rg.Vector3d.XAxis, rg.Vector3d.YAxis)
    print(f"  Unknown plane type: {type(item)}")
    return None

def resolve_color(gh_color, default_rgba):
    if gh_color is None:
        return default_rgba
    def color_from_raw(raw):
        if raw is None: return None
        if type(raw).__name__ == 'Color' or (hasattr(raw,'R') and hasattr(raw,'G') and hasattr(raw,'B') and hasattr(raw,'A')):
            return [raw.R/255.0, raw.G/255.0, raw.B/255.0, raw.A/255.0]
        if isinstance(raw,(list,tuple)) and all(isinstance(v,(int,float)) for v in raw):
            vals = list(raw)[:4]; vals = [v/255.0 for v in vals] if any(v>1.0 for v in vals) else vals
            while len(vals)<4: vals.append(1.0)
            return vals
        return None
    if hasattr(gh_color,'Branches'):
        try: return color_from_raw(list(gh_color.Branches[0])[0]) or default_rgba
        except: return default_rgba
    result = color_from_raw(gh_color)
    if result: return result
    if hasattr(gh_color,'__iter__') and not isinstance(gh_color,str):
        try:
            for item in gh_color:
                if item is not None:
                    result = color_from_raw(item)
                    if result: return result
                    break
        except: pass
    return default_rgba

def diagnose_tree(name, gh_input):
    if gh_input is None:
        print(f"  {name}: None")
        return
    if hasattr(gh_input, 'Branches'):
        print(f"  {name}: DataTree {len(gh_input.Branches)} branches")
        for j, (path, branch) in enumerate(zip(gh_input.Paths, gh_input.Branches)):
            print(f"    branch[{j}] path={path} items={len(branch)}")
    elif hasattr(gh_input, '__iter__') and not isinstance(gh_input, (rg.Mesh, rg.Point3d, rg.Plane)):
        items = list(gh_input)
        print(f"  {name}: list len={len(items)}")
    else:
        print(f"  {name}: {type(gh_input).__name__}")

# ΓöÇΓöÇ Pose conversion ΓöÇΓöÇΓöÇΓöÇΓöÇΓöÇΓöÇΓöÇΓöÇΓöÇΓöÇΓöÇΓöÇΓöÇΓöÇΓöÇΓöÇΓöÇΓöÇΓöÇΓöÇΓöÇΓöÇΓöÇΓöÇΓöÇΓöÇΓöÇΓöÇΓöÇΓöÇΓöÇΓöÇΓöÇΓöÇΓöÇΓöÇΓöÇΓöÇΓöÇΓöÇΓöÇΓöÇΓöÇΓöÇΓöÇΓöÇΓöÇΓöÇΓöÇΓöÇΓöÇΓöÇΓöÇΓöÇΓöÇΓöÇΓöÇΓöÇ

def plane_to_xyzrpw_robot_local(plane, base_orig):
    """Convert Rhino Plane to robot-local XYZ + ZYX Euler angles (degrees).

    base_orig is a Point3d marking the robot base in Rhino world space.
    If None, returns world-space coordinates.
    """
    ox = plane.Origin.X - (base_orig.X if base_orig else 0.0)
    oy = plane.Origin.Y - (base_orig.Y if base_orig else 0.0)
    oz = plane.Origin.Z - (base_orig.Z if base_orig else 0.0)

    xax, yax, zax = plane.XAxis, plane.YAxis, plane.ZAxis

    # ZYX Euler extraction from rotation matrix columns
    sy = -xax.Z
    cy = math.sqrt(xax.X**2 + xax.Y**2)
    if cy > 1e-6:
        rx = math.atan2(yax.Z, zax.Z)
        ry = math.atan2(sy, cy)
        rz = math.atan2(xax.Y, xax.X)
    else:
        rx = math.atan2(-zax.Y, yax.Y)
        ry = math.atan2(sy, cy)
        rz = 0.0

    return (
        round(ox, 4), round(oy, 4), round(oz, 4),
        round(math.degrees(rx), 6), round(math.degrees(ry), 6), round(math.degrees(rz), 6),
    )

# ΓöÇΓöÇ STL writer (unchanged) ΓöÇΓöÇΓöÇΓöÇΓöÇΓöÇΓöÇΓöÇΓöÇΓöÇΓöÇΓöÇΓöÇΓöÇΓöÇΓöÇΓöÇΓöÇΓöÇΓöÇΓöÇΓöÇΓöÇΓöÇΓöÇΓöÇΓöÇΓöÇΓöÇΓöÇΓöÇΓöÇΓöÇΓöÇΓöÇΓöÇΓöÇΓöÇΓöÇΓöÇΓöÇΓöÇΓöÇΓöÇΓöÇΓöÇΓöÇΓöÇΓöÇΓöÇΓöÇΓöÇ

def build_and_write_stl(geo_list, stl_path):
    mesh_list = rg.Mesh()
    for geo in geo_list:
        if isinstance(geo, rg.Mesh):
            geo.Faces.ConvertQuadsToTriangles(); mesh_list.Append(geo)
        elif isinstance(geo, rg.Brep):
            meshes = rg.Mesh.CreateFromBrep(geo, rg.MeshingParameters.Coarse)
            if meshes:
                for m in meshes: m.Faces.ConvertQuadsToTriangles(); mesh_list.Append(m)
        elif isinstance(geo, System.Guid):
            rhino_obj = sc.doc.Objects.FindId(geo)
            if rhino_obj:
                obj_geo = rhino_obj.Geometry
                if isinstance(obj_geo, rg.Mesh):
                    obj_geo.Faces.ConvertQuadsToTriangles(); mesh_list.Append(obj_geo)
                elif isinstance(obj_geo, rg.Brep):
                    meshes = rg.Mesh.CreateFromBrep(obj_geo, rg.MeshingParameters.Coarse)
                    if meshes:
                        for m in meshes: m.Faces.ConvertQuadsToTriangles(); mesh_list.Append(m)
    mesh_list.Faces.ConvertQuadsToTriangles()
    triangles = []
    for i in range(mesh_list.Faces.Count):
        face = mesh_list.Faces[i]
        triangles.append((mesh_list.Vertices[face.A], mesh_list.Vertices[face.B], mesh_list.Vertices[face.C]))
    os.makedirs(os.path.dirname(stl_path), exist_ok=True)
    with open(stl_path, 'wb') as f:
        f.write(b'\0' * 80)
        f.write(struct.pack('<I', len(triangles)))
        for v0, v1, v2 in triangles:
            f.write(struct.pack('<fff', 0, 0, 0))
            f.write(struct.pack('<fff', v0.X, v0.Y, v0.Z))
            f.write(struct.pack('<fff', v1.X, v1.Y, v1.Z))
            f.write(struct.pack('<fff', v2.X, v2.Y, v2.Z))
            f.write(struct.pack('<H', 0))
    return len(triangles)

# ΓöÇΓöÇ YAML writer ΓöÇΓöÇΓöÇΓöÇΓöÇΓöÇΓöÇΓöÇΓöÇΓöÇΓöÇΓöÇΓöÇΓöÇΓöÇΓöÇΓöÇΓöÇΓöÇΓöÇΓöÇΓöÇΓöÇΓöÇΓöÇΓöÇΓöÇΓöÇΓöÇΓöÇΓöÇΓöÇΓöÇΓöÇΓöÇΓöÇΓöÇΓöÇΓöÇΓöÇΓöÇΓöÇΓöÇΓöÇΓöÇΓöÇΓöÇΓöÇΓöÇΓöÇΓöÇΓöÇΓöÇΓöÇΓöÇΓöÇΓöÇΓöÇΓöÇΓöÇΓöÇΓöÇΓöÇ

def write_waypoints_yaml(waypoints, edges, path):
    """Write waypoints and edges to a valid YAML file."""
    lines = ["waypoints:"]
    for w in waypoints:
        lines.append(f"  - name: {w['name']}")
        lines.append(f"    x: {w['x']}")
        lines.append(f"    y: {w['y']}")
        lines.append(f"    z: {w['z']}")
        lines.append(f"    rx: {w['rx']}")
        lines.append(f"    ry: {w['ry']}")
        lines.append(f"    rz: {w['rz']}")
        lines.append(f"    frame: robot_local")
        lines.append(f"    move_type: {w['move_type']}")
        j7_val = w.get('j7')
        lines.append(f"    j7: {'null' if j7_val is None else j7_val}")
        if w.get('z_axis_free'):
            lines.append(f"    z_axis_free: true")
        if w.get('special_conditions'):
            conds = ", ".join(w['special_conditions'])
            lines.append(f"    special_conditions: [{conds}]")
        lines.append(f"    source: grasshopper")
        if w.get('note'):
            lines.append(f"    note: \"{w['note']}\"")

    lines.append("")
    lines.append("edges:")
    for e in edges:
        lines.append(f"  - from: {e['from']}")
        lines.append(f"    to:   {e['to']}")
        lines.append(f"    tested: null")

    os.makedirs(os.path.dirname(path), exist_ok=True)
    with open(path, "w", encoding="utf-8") as f:
        f.write("\n".join(lines) + "\n")

# ΓöÇΓöÇ Main ΓöÇΓöÇΓöÇΓöÇΓöÇΓöÇΓöÇΓöÇΓöÇΓöÇΓöÇΓöÇΓöÇΓöÇΓöÇΓöÇΓöÇΓöÇΓöÇΓöÇΓöÇΓöÇΓöÇΓöÇΓöÇΓöÇΓöÇΓöÇΓöÇΓöÇΓöÇΓöÇΓöÇΓöÇΓöÇΓöÇΓöÇΓöÇΓöÇΓöÇΓöÇΓöÇΓöÇΓöÇΓöÇΓöÇΓöÇΓöÇΓöÇΓöÇΓöÇΓöÇΓöÇΓöÇΓöÇΓöÇΓöÇΓöÇΓöÇΓöÇΓöÇΓöÇΓöÇΓöÇΓöÇΓöÇΓöÇΓöÇΓöÇΓöÇ

try:
    trigger
except NameError:
    trigger = True

# Initialise outputs so GH never gets an error even if trigger is off
grab_planes         = []
approach_planes     = []
str_planes          = []
str_approach_planes = []
stl_paths           = []
yaml_out            = ""

print("=== INPUT DIAGNOSTICS ===")
diagnose_tree("cones",                   cones)
diagnose_tree("grab_points",             grab_points)
diagnose_tree("approach_points",         approach_points)
diagnose_tree("string_grab_points",      string_grab_points)
diagnose_tree("string_approach_points",  string_approach_points)
diagnose_tree("strings",                 strings)
diagnose_tree("bins",                    bins if 'bins' in dir() else None)
print("=========================")

raw_cone_names = flatten_input(cone_names) if cone_names is not None else []
raw_bin_names  = flatten_input(bin_names)  if bin_names  is not None else []
def cone_name(i):
    if i < len(raw_cone_names) and raw_cone_names[i]:
        return str(raw_cone_names[i])
    return f"base_cone_{i}"
def bin_name(i):
    if i < len(raw_bin_names) and raw_bin_names[i]:
        return str(raw_bin_names[i])
    return f"bin_{i}"

# Collect inputs
cone_branches = []
if hasattr(cones, 'Branches') and len(cones.Branches) > 1:
    for branch in cones.Branches:
        items = [item for item in branch if item is not None]
        if items: cone_branches.append(items)
    print(f"MODE A: {len(cone_branches)} cone branches from DataTree")
else:
    flat = flatten_input(cones)
    for item in flat: cone_branches.append([item])
    print(f"MODE B: {len(cone_branches)} cones from flat list")

bin_branches = []
if 'bins' in dir() and bins is not None:
    if hasattr(bins, 'Branches') and len(bins.Branches) > 1:
        for branch in bins.Branches:
            items = [item for item in branch if item is not None]
            if items: bin_branches.append(items)
    else:
        flat = flatten_input(bins)
        for item in flat: bin_branches.append([item])

string_branches = []
if strings is not None:
    if hasattr(strings, 'Branches') and len(strings.Branches) > 1:
        for branch in strings.Branches:
            items = [item for item in branch if item is not None]
            if items: string_branches.append(items)
    else:
        flat = flatten_input(strings)
        for item in flat: string_branches.append([item])

cone_grab_planes_raw     = [resolve_plane(p) for p in flatten_input(grab_points)]
cone_approach_planes_raw = [resolve_plane(p) for p in flatten_input(approach_points)] if approach_points is not None else []
str_grab_planes_raw      = [resolve_plane(p) for p in flatten_input(string_grab_points)]
str_approach_planes_raw  = [resolve_plane(p) for p in flatten_input(string_approach_points)] if string_approach_points is not None else []
base_orig                = resolve_first_point(base_origin) if 'base_origin' in dir() else None

num_cones = len(cone_branches)
num_bins  = len(bin_branches)
print(f"num_cones={num_cones}  cone_grabs={len(cone_grab_planes_raw)}  cone_approaches={len(cone_approach_planes_raw)}")
print(f"str_grabs={len(str_grab_planes_raw)}  str_approaches={len(str_approach_planes_raw)}")
print(f"base_origin: {base_orig}")

# Always populate output planes from inputs
grab_planes         = [p for p in cone_grab_planes_raw     if p is not None]
approach_planes     = [p for p in cone_approach_planes_raw if p is not None]
str_planes          = [p for p in str_grab_planes_raw      if p is not None]
str_approach_planes = [p for p in str_approach_planes_raw  if p is not None]

if trigger:
    print("Rebuilding STLs and YAML...")

    os.makedirs("C:/temp/base_cones", exist_ok=True)
    os.makedirs("C:/temp/bins", exist_ok=True)
    os.makedirs("C:/temp/base_strings", exist_ok=True)

    # Write STLs
    for i, branch_geos in enumerate(cone_branches):
        path = f"C:/temp/base_cones/{cone_name(i)}.stl"
        tris = build_and_write_stl(branch_geos, path)
        stl_paths.append(path)
        print(f"  {cone_name(i)}: {tris} triangles -> {path}")

    bin_stl_paths = []
    for i, branch_geos in enumerate(bin_branches):
        path = f"C:/temp/bins/{bin_name(i)}.stl"
        tris = build_and_write_stl(branch_geos, path)
        bin_stl_paths.append(path)
        print(f"  {bin_name(i)}: {tris} triangles -> {path}")

    string_stl_paths = []
    for i, branch_geos in enumerate(string_branches):
        path = f"C:/temp/base_strings/{cone_name(i)}_string.stl"
        tris = build_and_write_stl(branch_geos, path)
        string_stl_paths.append(path)
        print(f"  {cone_name(i)}_string: {tris} triangles -> {path}")

    # Build output planes and YAML entries
    waypoints = []
    edges     = []

    for i, pl in enumerate(cone_grab_planes_raw):
        if pl is None:
            print(f"  WARNING: cone_grab_{i} plane is None ΓÇö skipping")
            continue

        ap = cone_approach_planes_raw[i] if i < len(cone_approach_planes_raw) else None
        if ap is None:
            print(f"  WARNING: cone_grab_{i} approach plane is None ΓÇö skipping")
            continue

        grab_name     = f"{cone_name(i)}_grab"
        approach_name = f"{cone_name(i)}_grab_approach"

        x,y,z,rx,ry,rz      = plane_to_xyzrpw_robot_local(pl, base_orig)
        ax,ay,az,arx,ary,arz = plane_to_xyzrpw_robot_local(ap, base_orig)

        waypoints.append({"name": approach_name, "x":ax,"y":ay,"z":az,"rx":arx,"ry":ary,"rz":arz,
                          "move_type":"MoveJ","j7":None,"z_axis_free":True,
                          "special_conditions":["attached_to_base"],
                          "note":"cone approach ΓÇö robot-relative, j7 free, rotation around cone Z axis free"})
        waypoints.append({"name": grab_name,     "x":x, "y":y, "z":z, "rx":rx, "ry":ry, "rz":rz,
                          "move_type":"MoveL","j7":None,
                          "special_conditions":["attached_to_base"],
                          "note":"cone grab ΓÇö robot-relative, j7 free"})

        # Bidirectional edges ΓÇö enter (approachΓåÆgrab) and exit (grabΓåÆapproach)
        edges.append({"from": approach_name, "to": grab_name})
        edges.append({"from": grab_name,     "to": approach_name})

        print(f"  cone_grab_{i}: grab=({x:.1f},{y:.1f},{z:.1f})  approach=({ax:.1f},{ay:.1f},{az:.1f})")

    for i, pl in enumerate(str_grab_planes_raw):
        if pl is None:
            print(f"  WARNING: str_grab_{i} plane is None ΓÇö skipping")
            continue

        ap = str_approach_planes_raw[i] if i < len(str_approach_planes_raw) else None
        if ap is None:
            print(f"  WARNING: str_grab_{i} approach plane is None ΓÇö skipping")
            continue

        grab_name     = f"{cone_name(i)}_string_grab"
        approach_name = f"{cone_name(i)}_string_grab_approach"

        x,y,z,rx,ry,rz      = plane_to_xyzrpw_robot_local(pl, base_orig)
        ax,ay,az,arx,ary,arz = plane_to_xyzrpw_robot_local(ap, base_orig)

        waypoints.append({"name": approach_name, "x":ax,"y":ay,"z":az,"rx":arx,"ry":ary,"rz":arz,
                          "move_type":"MoveJ","j7":None,"z_axis_free":True,
                          "special_conditions":["attached_to_base"],
                          "note":"string grab approach ΓÇö robot-relative, j7 free, rotation around cone Z axis free"})
        waypoints.append({"name": grab_name,     "x":x, "y":y, "z":z, "rx":rx, "ry":ry, "rz":rz,
                          "move_type":"MoveL","j7":None,
                          "special_conditions":["attached_to_base"],
                          "note":"string grab ΓÇö robot-relative, j7 free"})

        edges.append({"from": approach_name, "to": grab_name})
        edges.append({"from": grab_name,     "to": approach_name})

    # Write YAML
    write_waypoints_yaml(waypoints, edges, yaml_path)
    yaml_out = yaml_path
    print(f"\n[OK] {len(waypoints)} waypoints, {len(edges)} edges -> {yaml_path}")
    print(f"[OK] {len(stl_paths)} STL files written")

    # ΓöÇΓöÇ Import STLs into RoboDK ΓöÇΓöÇΓöÇΓöÇΓöÇΓöÇΓöÇΓöÇΓöÇΓöÇΓöÇΓöÇΓöÇΓöÇΓöÇΓöÇΓöÇΓöÇΓöÇΓöÇΓöÇΓöÇΓöÇΓöÇΓöÇΓöÇΓöÇΓöÇΓöÇΓöÇΓöÇΓöÇΓöÇΓöÇΓöÇΓöÇΓöÇΓöÇΓöÇΓöÇΓöÇΓöÇΓöÇΓöÇΓöÇΓöÇΓöÇ
    try:
        sys.path.append("C:/RoboDK/Python")
        from robodk.robolink import Robolink, ITEM_TYPE_OBJECT, ITEM_TYPE_ROBOT
        from robodk.robomath import Mat
        RDK = Robolink()
        RDK.Item("")  # ping

        _cone_rgba   = resolve_color(cone_color   if 'cone_color'   in dir() else None, [1.0, 0.5, 0.0, 1.0])
        _string_rgba = resolve_color(string_color if 'string_color' in dir() else None, [1.0, 1.0, 0.0, 1.0])
        _bin_rgba    = resolve_color(bin_color    if 'bin_color'    in dir() else None, [0.5, 0.5, 0.5, 1.0])

        robot = RDK.Item("Fanuc R2000iC 125L", ITEM_TYPE_ROBOT)
        robot_base = robot.Parent() if robot.Valid() else None
        if robot_base is not None and robot_base.Valid():
            print(f"  RoboDK: parenting under '{robot_base.Name()}'")
        else:
            robot_base = None
            print("  RoboDK: robot base not found, objects at world level")

        station = RDK.Item("", 1)

        def identity():
            return Mat([[1,0,0,0],[0,1,0,0],[0,0,1,0],[0,0,0,1]])

        def purge_all(name):
            for _ in range(50):
                item = RDK.Item(name)
                if not item.Valid(): break
                item.Delete()

        def add_file_and_get_item(stl_path):
            before = set(it.item for it in RDK.ItemList(ITEM_TYPE_OBJECT, False))
            RDK.AddFile(stl_path)
            for it in RDK.ItemList(ITEM_TYPE_OBJECT, False):
                if it.item not in before:
                    return it
            return RDK.Item(os.path.splitext(os.path.basename(stl_path))[0])

        # Purge only items added by previous runs ΓÇö delete parent frames
        purge_all("BaseCones")
        purge_all("BaseBins")

        # BaseCones frame parented to robot_base so it moves with the rail
        parent = robot_base if robot_base is not None else station
        base_cones_frame = RDK.AddFrame("BaseCones", parent)
        base_cones_frame.setPose(identity())

        base_bins_frame = RDK.AddFrame("BaseBins", parent)
        base_bins_frame.setPose(identity())

        for i, path in enumerate(stl_paths):
            obj = add_file_and_get_item(path)
            if obj.Valid():
                obj.setName(cone_name(i))
                obj.setParentStatic(base_cones_frame)
                obj.setColor(_cone_rgba)
                print(f"  RoboDK: {cone_name(i)} imported")
            else:
                print(f"  RoboDK: FAILED {os.path.basename(path)}")

        for i, path in enumerate(string_stl_paths):
            obj = add_file_and_get_item(path)
            if obj.Valid():
                obj.setName(f"{cone_name(i)}_string")
                obj.setParentStatic(base_cones_frame)
                obj.setColor(_string_rgba)
                print(f"  RoboDK: {cone_name(i)}_string imported")
            else:
                print(f"  RoboDK: FAILED {os.path.basename(path)}")

        for i, path in enumerate(bin_stl_paths):
            obj = add_file_and_get_item(path)
            if obj.Valid():
                obj.setName(bin_name(i))
                obj.setParentStatic(base_bins_frame)
                obj.setColor(_bin_rgba)
                print(f"  RoboDK: {bin_name(i)} imported")
            else:
                print(f"  RoboDK: FAILED {os.path.basename(path)}")

        print("[OK] STLs imported into RoboDK")
    except Exception as e:
        print(f"[WARN] RoboDK import skipped: {e}")

    # ΓöÇΓöÇ Amalgamate waypoints + re-import to RoboDK ΓöÇΓöÇΓöÇΓöÇΓöÇΓöÇΓöÇΓöÇΓöÇΓöÇΓöÇΓöÇΓöÇΓöÇΓöÇΓöÇΓöÇΓöÇΓöÇΓöÇΓöÇΓöÇΓöÇΓöÇΓöÇΓöÇΓöÇΓöÇ
    if update_and_amalgamate_waypoints:
        import subprocess
        REPO   = r"C:\Users\samst\Framework\clones\custom_estimates_using_dhr_methods"
        PYTHON = r"C:\Users\samst\.rhinocode\py39-rh8\python.exe"
        amalgamate_script = os.path.join(REPO, "robodk_code", "amalgamate_waypoints.py")
        import_script     = os.path.join(REPO, "robodk_code", "import_waypoints_to_robodk.py")

        print("\n--- amalgamate_waypoints ---")
        r1 = subprocess.run([PYTHON, amalgamate_script], capture_output=True, text=True)
        print(r1.stdout)
        if r1.returncode != 0:
            print(f"[ERROR] amalgamate_waypoints failed (rc={r1.returncode}):\n{r1.stderr}")
        else:
            print("\n--- import_waypoints_to_robodk ---")
            r2 = subprocess.run([PYTHON, import_script], capture_output=True, text=True)
            print(r2.stdout)
            if r2.returncode != 0:
                print(f"[ERROR] import_waypoints_to_robodk failed (rc={r2.returncode}):\n{r2.stderr}")
# ---------- end py3_7 ----------
lng_4 = ListLength(List=move_15.Geometry)
lng_5 = ListLength(List=move_12.Geometry)
lng_6 = ListLength(List=move_13.Geometry)
panel_16 = Panel(py3_7.out)
lng_7 = ListLength(List=move_10.Geometry)
lng_8 = ListLength(List=move_11.Geometry)
lng_9 = ListLength(List=move_10.Geometry)
lng_10 = ListLength(List=move_11.Geometry)
addition_9 = Addition(A=lng_6, B=lng_4, C=lng_5, D=lng_3)
addition_10 = Addition(A=lng_9, B=lng_7, C=lng_8, D=lng_10)
panel_17 = Panel(addition_9)
panel_18 = Panel(addition_10)
addition_11 = Addition(A=addition_9, B=addition_10)
panel_19 = Panel(addition_11)

# ==== cluster Cluster
relay = ClusterInput()
relay_2 = ClusterInput()
relay_3 = ClusterInput()
A = ClusterInput()
B = ClusterInput()
N = ClusterInput()
C = ClusterInput()
B_2 = ClusterInput()
row_2_prefix = ClusterInput()
row_1_prefix = ClusterInput()
Y = ClusterInput()
vec2pt = Vector2Pt(PointA=A, PointB=B, Unitize=False)  # -> Vector, Length
series = Series(Start=0, Step=N, Count=C)
pt = ConstructPoint(XCoordinate=relay, YCoordinate=relay_3, ZCoordinate=0)
subtraction = Subtraction(A=relay_2, B=relay)
addition = Addition(A=relay_3, B=B_2)
rectangle = Rectangle(Plane=PlaneXY(0, 0, 0), XSize=relay_2, YSize=Y, Radius=0)  # -> Rectangle, Length
pt_2 = ConstructPoint(XCoordinate=subtraction, YCoordinate=addition, ZCoordinate=0)
Y_2 = UnitY(Factor=series)
move = Move(Geometry=graft(pt_2), Motion=Y_2)  # -> Geometry, Transform
lng = ListLength(List=move.Geometry)
py3 = Python3Script(s=row_2_prefix, n=lng)  # -> out, a
# ---------- py3: Python ----------
# Inputs:  s (string), n (number)
# Output:  a (list of strings)

a = [s + str(i) for i in range(int(n))]
# ---------- end py3 ----------
move_2 = Move(Geometry=graft(pt), Motion=Y_2)  # -> Geometry, Transform
lng_2 = ListLength(List=move_2.Geometry)
py3_2 = Python3Script(s=row_1_prefix, n=lng_2)  # -> out, a; same code as py3
move_3 = Move(Geometry=rectangle.Rectangle, Motion=vec2pt.Vector)  # -> Geometry, Transform
merge = Merge(Data1=py3_2.a, Data2=py3.a)
merge_2 = Merge(Data1=move_2.Geometry, Data2=move.Geometry)
out_rectangle = ClusterOutput(move_3.Geometry)
move_4 = Move(Geometry=merge_2, Motion=vec2pt.Vector)  # -> flatten(Geometry), Transform
G = ClusterInput()
Z = UnitZ(Factor=1)
move_5 = Move(Geometry=G, Motion=move_4.Geometry)  # -> Geometry, Transform
panel = Panel(merge)
lng_3 = ListLength(List=flatten(move_5.Geometry))
pl = PlaneNormal(Origin=move_4.Geometry, ZAxis=Z)
out_names = ClusterOutput(merge)
out_cones = ClusterOutput(move_5.Geometry)
L = ClusterOutput(lng_3)
out_cone_centroid_bottoms = ClusterOutput(pl)

# ==== cluster Cluster_2
A = ClusterInput()
A_2 = ClusterInput()
B = ClusterInput()
P = ClusterInput()
t = ClusterInput()
division = Division(A=A_2, B=2)
D = ClusterInput()
multiplication = Multiplication(A=A, B=B)
cir = Circle(Plane=P, Radius=division)
rad = Radians(Degrees=D)
subtraction = Subtraction(A=A, B=multiplication)
R = ClusterInput()
Z = UnitZ(Factor=1)
Z_2 = UnitZ(Factor=subtraction)
eval = EvaluateCurve(Curve=reparameterize(cir), Parameter=t)  # -> Point, Tangent, Angle
move = Move(Geometry=P, Motion=Z_2)  # -> Geometry, Transform
vec2pt = Vector2Pt(PointA=move.Geometry, PointB=eval.Point, Unitize=False)  # -> Vector, Length
neg = Negative(Value=eval.Tangent)
filter = StreamFilter(Gate=Toggle(True), Stream0=eval.Tangent, Stream1=neg)
line = LineSDL(Start=move.Geometry, Direction=Z, Length=multiplication)
xprod = CrossProduct(VectorA=vec2pt.Vector, VectorB=Z, Unitize=False)  # -> Vector, Length
vrot = Rotate(Vector=Z, Axis=xprod.Vector, Angle=rad)
end = EndPoints(Curve=line)  # -> Start, End
biarc = BiArc(StartPoint=eval.Point, StartTangent=filter, EndPoint=move.Geometry, EndTangent=vrot, Ratio=R)  # -> FirstArc, SecondArc, flatten(BiArc)
weave = Weave(Pattern=[0, 1], Stream0=line, Stream1=biarc.BiArc, NullGaps=False)  # -> flatten(Weave)
partition = PartitionList(List=weave, Size="2")
panel = Panel(partition)
panel_2 = Panel(biarc.BiArc)
ln = Line(StartPoint=eval.Point, EndPoint=end.End)
join = JoinCurves(Curves=partition, Preserve=False)  # -> flatten(Curves)
panel_3 = ClusterInput()
panel_4 = Panel(ln)
p_n_c = PickNChoose(Pattern=panel_3, Stream0=ln, Stream1=join)
panel_5 = Panel(panel_3)
panel_6 = Panel(p_n_c)
R_2 = ClusterOutput(p_n_c)
panel_7 = Panel(join)

# ==== cluster Cluster_3
C = ClusterInput()
bbox = BoundingBox(Content=C, Plane=PlaneXY(0, 0, 0))  # -> Box, Box_2
debox = DeconstructBox(Box=bbox.Box)  # -> Plane, X, Y, Z
dedomain = DeconstructDomain(Domain=debox.Z)  # -> Start, End
subtraction = Subtraction(A=dedomain.End, B=dedomain.Start)
R = ClusterOutput(subtraction)

# ==== cluster Cluster_4
start_line_1 = ClusterInput()
B = ClusterInput()
A = ClusterInput()
B_2 = ClusterInput()
ln = Line(StartPoint=start_line_1, EndPoint=B)
ln_2 = Line(StartPoint=A, EndPoint=B_2)
N = ClusterInput()
divide = DivideCurve(Curve=ln, Count=expr("x-1", N), Kinks=False)  # -> Points, Tangents, Parameters
divide_2 = DivideCurve(Curve=ln_2, Count=expr("x-1", N), Kinks=False)  # -> Points, Tangents, Parameters
ln_3 = Line(StartPoint=divide.Points, EndPoint=divide_2.Points)
L = ClusterOutput(ln_3)

# ==== cluster Cluster_5
relay = ClusterInput()
relay_2 = ClusterInput()
B = ClusterInput()
Z = ClusterInput()
pt = ConstructPoint(XCoordinate="0", YCoordinate="0", ZCoordinate="0")
pt_2 = ConstructPoint(XCoordinate="0", YCoordinate="0", ZCoordinate=Z)
pdecon = Deconstruct(Point=pt_2)  # -> XComponent, YComponent, ZComponent
addition = Addition(A=pdecon.ZComponent, B=B)
division = Division(A=relay_2, B="-2")
division_2 = Division(A=relay, B="-2")
vec = VectorXYZ(XComponent="1", YComponent="0", ZComponent="0")  # -> Vector, Length
rectangle = Rectangle(Plane=pt, XSize=relay_2, YSize=relay, Radius=0)  # -> Rectangle, Length
pt_3 = ConstructPoint(XCoordinate=pdecon.XComponent, YCoordinate=pdecon.YComponent, ZCoordinate=addition)
vec_2 = VectorXYZ(XComponent=division, YComponent=division_2, ZComponent="0")  # -> Vector, Length
pdecon_2 = Deconstruct(Point=pt_2)  # -> XComponent, YComponent, ZComponent
division_3 = Division(A=relay_2, B="2")
division_4 = Division(A=relay, B="2")
pdecon_3 = Deconstruct(Point=pt)  # -> XComponent, YComponent, ZComponent
move = Move(Geometry=rectangle.Rectangle, Motion=vec_2.Vector)  # -> Geometry, Transform
subtraction = Subtraction(A=pdecon_2.XComponent, B=division_3)
pt_4 = ConstructPoint(XCoordinate=subtraction, YCoordinate=pdecon_2.YComponent, ZCoordinate=pdecon_2.ZComponent)
subtraction_2 = Subtraction(A=pdecon_2.ZComponent, B=pdecon_3.ZComponent)
vec_3 = VectorXYZ(XComponent="0", YComponent="0", ZComponent=subtraction_2)  # -> Vector, Length
extr = Extrude(Base=move.Geometry, Direction=vec_3.Vector)
cap = CapHoles(Brep=extr)
pdecon_4 = Deconstruct(Point=pt_3)  # -> XComponent, YComponent, ZComponent
B_2 = ClusterInput()
vec_4 = VectorXYZ(XComponent=0, YComponent=0, ZComponent=pdecon_4.ZComponent)  # -> Vector, Length
move_2 = Move(Geometry=move.Geometry, Motion=vec_4.Vector)  # -> Geometry, Transform
pl = PlaneNormal(Origin=pt_4, ZAxis=vec.Vector)
cyl = Cylinder(Base=pl, Radius=division_4, Length=relay_2)
cap_2 = CapHoles(Brep=cyl)
merge = Merge(Data1=cap, Data2=cap_2)
sunion = SolidUnion(Breps=merge)
bbox = BoundingBox(Content=sunion, Plane=PlaneXY(0, 0, 0))  # -> Box, Box_2
debox = DeconstructBox(Box=bbox.Box)  # -> Plane, X, Y, Z
num = Number(debox.Z)
subtraction_3 = Subtraction(A=pdecon_4.ZComponent, B=num)
panel = Panel(num)
subtraction_4 = Subtraction(A=subtraction_3, B=B_2)
multiplication = Multiplication(A=subtraction_4, B="-1")
vec_5 = VectorXYZ(XComponent=0, YComponent=0, ZComponent=multiplication)  # -> Vector, Length
extr_2 = Extrude(Base=move_2.Geometry, Direction=vec_5.Vector)
cap_3 = CapHoles(Brep=extr_2)
R = ClusterOutput(sunion)
B_3 = ClusterOutput(cap_3)
P = ClusterOutput(pl)

# ==== cluster Cluster_6
C = ClusterInput()
bbox = BoundingBox(Content=C, Plane=PlaneXY(0, 0, 0), UnionBox=True)  # -> Box, Box_2
debox = DeconstructBox(Box=bbox.Box)  # -> Plane, X, Y, Z
dedomain = DeconstructDomain(Domain=debox.X)  # -> Start, End
dedomain_2 = DeconstructDomain(Domain=debox.Z)  # -> Start, End
dedomain_3 = DeconstructDomain(Domain=debox.Y)  # -> Start, End
addition = Addition(A=dedomain.Start, B=dedomain.End)
addition_2 = Addition(A=dedomain_3.Start, B=dedomain_3.End)
division = Division(A=addition, B="2")
division_2 = Division(A=addition_2, B="2")
pt = ConstructPoint(XCoordinate=division, YCoordinate=division_2, ZCoordinate=dedomain_2.End)
pt_2 = ClusterOutput(pt)

# ==== cluster Cluster_7
P = ClusterInput()

deplane = DeconstructPlane(Plane=P)  # -> Origin, XAxis, YAxis, ZAxis

# ---- group: Global Settings & Scaling
num = Number(Slider(2.25, range=0..5))
multiplication = Multiplication(A=Slider(6, range=0..50), B=num)
multiplication_2 = Multiplication(A=Slider(2, range=0..20), B=num)
multiplication_3 = Multiplication(A=Slider(20, range=0..100), B=num)
multiplication_4 = Multiplication(A=Slider(30, range=0..500), B=num)
num_2 = Number(multiplication)
num_3 = Number(multiplication_2)
num_4 = Number(multiplication_3)
num_5 = Number(multiplication_4)

# ---- group: Z Axis (Blue)
pl = PlaneNormal(Origin=deplane.Origin, ZAxis=deplane.ZAxis)
multiplication_5 = Multiplication(A=deplane.ZAxis, B=num_5)
move = Move(Geometry=pl, Motion=multiplication_5)  # -> Geometry, Transform
cyl = Cylinder(Base=pl, Radius=num_3, Length=num_5)
cone = Cone(Base=move.Geometry, Radius=num_2, Length=num_4)  # -> Cone, Tip
merge = Merge(Data1=[cyl, cone.Cone])
preview = CustomPreview(Geometry=merge, Material=ColourSwatch(SwatchColor=RGB(0, 0, 255)))

# ---- group: Y Axis (Green)
pl_2 = PlaneNormal(Origin=deplane.Origin, ZAxis=deplane.YAxis)
multiplication_6 = Multiplication(A=deplane.YAxis, B=num_5)
move_2 = Move(Geometry=pl_2, Motion=multiplication_6)  # -> Geometry, Transform
cyl_2 = Cylinder(Base=pl_2, Radius=num_3, Length=num_5)
cone_2 = Cone(Base=move_2.Geometry, Radius=num_2, Length=num_4)  # -> Cone, Tip
merge_2 = Merge(Data1=[cyl_2, cone_2.Cone])
preview_2 = CustomPreview(Geometry=merge_2, Material=ColourSwatch(SwatchColor=RGB(0, 255, 0)))

# ---- group: X Axis (Red)
pl_3 = PlaneNormal(Origin=deplane.Origin, ZAxis=deplane.XAxis)
multiplication_7 = Multiplication(A=deplane.XAxis, B=num_5)
move_3 = Move(Geometry=pl_3, Motion=multiplication_7)  # -> Geometry, Transform
cyl_3 = Cylinder(Base=pl_3, Radius=num_3, Length=num_5)
cone_3 = Cone(Base=move_3.Geometry, Radius=num_2, Length=num_4)  # -> Cone, Tip
merge_3 = Merge(Data1=[cyl_3, cone_3.Cone])
preview_3 = CustomPreview(Geometry=merge_3, Material=ColourSwatch(SwatchColor=RGB(255, 0, 0)))

# ---- group: Global Settings & Scaling (continued)
geo = Geometry([merge_3, merge_2, merge])

# ==== cluster Cluster_8
A = ClusterInput()
multiplication = Multiplication(A=A, B="pi/180")
A_2 = ClusterInput()
dom = ConstructDomain(DomainStart="0", DomainEnd=multiplication)
subtraction = Subtraction(A=A_2, B="1")
range = Range(Domain=dom, Steps=subtraction)
R = ClusterOutput(range)
