# Grasshopper definition frames_maker.gh (Grasshopper 1.0.8)

xy = XYPlane(Origin=Point(0, 0, 0))
pln = Plane(xy)
cluster = Cluster(P=pln)

# ==== cluster Cluster
P = ClusterInput()

deplane = DeconstructPlane(Plane=P)  # -> Origin, XAxis, YAxis, ZAxis

# ---- group: Global Settings & Scaling
num = Number(Slider(1, range=0..5))
multiplication = Multiplication(A=Slider(6, range=0..50), B=num)
multiplication_2 = Multiplication(A=Slider(2, range=0..20), B=num)
multiplication_3 = Multiplication(A=Slider(20, range=0..100), B=num)
multiplication_4 = Multiplication(A=Slider(100, range=0..500), B=num)
num_2 = Number(multiplication)
num_3 = Number(multiplication_2)
num_4 = Number(multiplication_3)
num_5 = Number(multiplication_4)

# ---- group: Z Axis (Blue)
pl = PlaneNormal(Origin=deplane.Origin, ZAxis=deplane.ZAxis)
multiplication_5 = Multiplication(A=deplane.ZAxis, B=num_5)
move = Move(Geometry=pl, Motion=multiplication_5)  # -> Geometry, Transform
cyl = Cylinder(Base=pl, Radius=num_3, Length=num_5)
cone = Cone(Base=move.Geometry, Radius=num_2, Length=num_4)  # -> Cone, Tip
merge = Merge(Data1=[cyl, cone.Cone])
preview = CustomPreview(Geometry=merge, Material=ColourSwatch(SwatchColor=RGB(0, 0, 255)))

# ---- group: Y Axis (Green)
pl_2 = PlaneNormal(Origin=deplane.Origin, ZAxis=deplane.YAxis)
multiplication_6 = Multiplication(A=deplane.YAxis, B=num_5)
move_2 = Move(Geometry=pl_2, Motion=multiplication_6)  # -> Geometry, Transform
cyl_2 = Cylinder(Base=pl_2, Radius=num_3, Length=num_5)
cone_2 = Cone(Base=move_2.Geometry, Radius=num_2, Length=num_4)  # -> Cone, Tip
merge_2 = Merge(Data1=[cyl_2, cone_2.Cone])
preview_2 = CustomPreview(Geometry=merge_2, Material=ColourSwatch(SwatchColor=RGB(0, 255, 0)))

# ---- group: X Axis (Red)
pl_3 = PlaneNormal(Origin=deplane.Origin, ZAxis=deplane.XAxis)
multiplication_7 = Multiplication(A=deplane.XAxis, B=num_5)
move_3 = Move(Geometry=pl_3, Motion=multiplication_7)  # -> Geometry, Transform
cyl_3 = Cylinder(Base=pl_3, Radius=num_3, Length=num_5)
cone_3 = Cone(Base=move_3.Geometry, Radius=num_2, Length=num_4)  # -> Cone, Tip
merge_3 = Merge(Data1=[cyl_3, cone_3.Cone])
preview_3 = CustomPreview(Geometry=merge_3, Material=ColourSwatch(SwatchColor=RGB(255, 0, 0)))

# ---- group: Global Settings & Scaling (continued)
geo = Geometry([merge_3, merge_2, merge])
