# Grasshopper definition grass_hopper_to_make_point_pairs.gh (Grasshopper 1.0.8)

number_slider = Slider(4, range=2..50)
pt = Point(Point(89, 70, 0))
pt_2 = Point(Point(21, 37, 0))
pt_3 = Point(Point(-10, 191, 0))
pt_4 = Point(Point(0, 163, 166))
cluster = Cluster(A=pt, B=pt_2, A_2=pt_3, N=number_slider, B_2=pt_4, N_2=number_slider)

# ==== cluster Cluster
A = ClusterInput()
B = ClusterInput()
A_2 = ClusterInput()
B_2 = ClusterInput()
ln = Line(StartPoint=A, EndPoint=B)
ln_2 = Line(StartPoint=A_2, EndPoint=B_2)
N = ClusterInput()
N_2 = ClusterInput()
divide = DivideCurve(Curve=ln, Count=expr("x-1", N), Kinks=False)  # -> Points, Tangents, Parameters
divide_2 = DivideCurve(Curve=ln_2, Count=expr("x-1", N_2), Kinks=False)  # -> Points, Tangents, Parameters
ln_3 = Line(StartPoint=divide.Points, EndPoint=divide_2.Points)
L = ClusterOutput(ln_3)
