# Grasshopper definition grasshopper_to_place_percentage_use.gh (Grasshopper 1.0.8)

number_slider = Slider(44.6, range=0..1000)
pt = Point(Point(0, 0, 0))
number_slider_2 = Slider(150, range=0..5000)
number_slider_3 = Slider(406.4, range=0..1000)
number_slider_4 = Slider(339.6, range=0..1000)
number_slider_5 = Slider(2679.7, range=0..5000)
brep = Brep(<brep referenced from the Rhino model>)
pt_2 = Point(Point(2409.247621, 1159.851361, 1369.105749))
pt_3 = Point(Point(2409.247621, 943.7312349, 2083.044141))
division = Division(A=number_slider_4, B="2")
cluster = Cluster(
    relay_2=number_slider_3,
    Y=number_slider_5,
    N=number_slider_4,
    C=Slider(2, range=1..50),
    relay_3=number_slider_2,
    B_2=division,
    G=brep,
    A=pt,
    relay=number_slider,
    B=pt_3)  # -> L, out_cone_centroid_bottoms, out_cones, out_rectangle
cluster_2 = Cluster(
    relay_2=number_slider_3,
    Y=number_slider_5,
    N=number_slider_4,
    C=Slider(7, range=1..50),
    relay_3=number_slider_2,
    B_2=division,
    G=brep,
    A=pt,
    relay=number_slider,
    B=pt_2)  # -> L, out_cone_centroid_bottoms, out_cones, out_rectangle
panel = Panel("""white stars and REINDUSTRIALIZE text replaced 0.0313 times a day
white stars and REINDUSTRIALIZE text replaced 0.0313 times a day
white stripes of flag replaced 0.0939 times a day
white stripes of flag replaced 0.0939 times a day
light blue of flag replaced 0.0522 times a day
light blue of flag replaced 0.0522 times a day
bind-off replaced 0.0042 times a day
bind-off replaced 0.0042 times a day
bind-off lycra replaced 0.0001 times a day
bind-off lycra replaced 0.0001 times a day
red stripes of flag replaced 0.1043 times a day
red stripes of flag replaced 0.1043 times a day
sleeve replaced 0.7304 times a day
sleeve replaced 0.7304 times a day
sleeve replaced 0.7304 times a day
sleeve replaced 0.7304 times a day
body replaced 3.4852 times a day
body replaced 3.4852 times a day""")
merge = Merge(Data1=cluster_2.out_cones, Data2=cluster.out_cones)
preview = CustomPreview(
    Geometry=merge,
    Material={diffuse=RGB(221, 160, 221), emission=RGB(66, 48, 66), shine=0.5, specular=RGB(255, 255, 255), transparency=0})
merge_2 = Merge(Data1=cluster_2.out_cone_centroid_bottoms, Data2=cluster.out_cone_centroid_bottoms)
vec = VectorXYZ(XComponent="0", YComponent="0", ZComponent="170")  # -> Vector, Length
panel_2 = Panel(cluster_2.L)
panel_3 = Panel(cluster.L)
move = Move(Geometry=merge_2, Motion=vec.Vector)  # -> Geometry, Transform
addition = Addition(A=cluster_2.L, B=cluster.L)
panel_4 = Panel(addition)
panel_5 = Panel(cluster_2.out_cone_centroid_bottoms)
col = Colour(RGB(0, 102, 255))
tag = TextTag(Location=move.Geometry, Text=panel, Colour=col)

# ==== cluster Cluster
relay = ClusterInput()
relay_2 = ClusterInput()
relay_3 = ClusterInput()
A = ClusterInput()
B = ClusterInput()
N = ClusterInput()
C = ClusterInput()
B_2 = ClusterInput()
Y = ClusterInput()
vec2pt = Vector2Pt(PointA=A, PointB=B, Unitize=False)  # -> Vector, Length
series = Series(Start=0, Step=N, Count=C)
pt = ConstructPoint(XCoordinate=relay, YCoordinate=relay_3, ZCoordinate=0)
subtraction = Subtraction(A=relay_2, B=relay)
addition = Addition(A=relay_3, B=B_2)
rectangle = Rectangle(Plane=PlaneXY(0, 0, 0), XSize=relay_2, YSize=Y, Radius=0)  # -> Rectangle, Length
pt_2 = ConstructPoint(XCoordinate=subtraction, YCoordinate=addition, ZCoordinate=0)
Y_2 = UnitY(Factor=series)
move = Move(Geometry=rectangle.Rectangle, Motion=vec2pt.Vector)  # -> Geometry, Transform
merge = Merge(Data1=pt, Data2=pt_2)
move_2 = Move(Geometry=graft(merge), Motion=Y_2)  # -> flatten(Geometry), Transform
move_3 = Move(Geometry=move_2.Geometry, Motion=vec2pt.Vector)  # -> Geometry, Transform
G = ClusterInput()
move_4 = Move(Geometry=G, Motion=move_3.Geometry)  # -> Geometry, Transform
lng = ListLength(List=flatten(move_4.Geometry))
L = ClusterOutput(lng)
out_rectangle = ClusterOutput(move.Geometry)
out_cone_centroid_bottoms = ClusterOutput(move_3.Geometry)
out_cones = ClusterOutput(move_4.Geometry)
