# Grasshopper definition grasshopper_to_place_points_to_check.gh (Grasshopper 1.0.8)

brep = Brep(<brep referenced from the Rhino model>)
brep_2 = Brep(<brep referenced from the Rhino model>)
bbox = BoundingBox(Content=brep, Plane=PlaneXY(0, 0, 0))  # -> Box, Box_2
bbox_2 = BoundingBox(Content=brep_2, Plane=PlaneXY(0, 0, 0))  # -> Box, Box_2
debox = DeconstructBox(Box=bbox.Box)  # -> Plane, X, Y, Z
debox_2 = DeconstructBox(Box=bbox_2.Box)  # -> Plane, X, Y, Z
dedomain = DeconstructDomain(Domain=debox.X)  # -> Start, End
dedomain_2 = DeconstructDomain(Domain=debox.Y)  # -> Start, End
dedomain_3 = DeconstructDomain(Domain=debox.Z)  # -> Start, End
dedomain_4 = DeconstructDomain(Domain=debox_2.X)  # -> Start, End
number_slider = Slider(600, range=0..5000)
pt = Point(Point(0, 0, 0))
number_slider_2 = Slider(400, range=0..1000)
division = Division(A=number_slider_2, B="-2")
division_2 = Division(A=number_slider, B="2")
subtraction = Subtraction(A=dedomain_4.End, B=dedomain_4.Start)
machine_cone_pickup_offset = Slider(100, range=0..500)
pt_2 = ConstructPoint(XCoordinate=dedomain.Start, YCoordinate=dedomain_2.Start, ZCoordinate=dedomain_3.End)
addition = Addition(A=division_2, B="1200")
pt_3 = Point(pt_2)
pt_4 = ConstructPoint(XCoordinate=addition, YCoordinate=division, ZCoordinate="500")
vec = VectorXYZ(
    XComponent=Slider(-50, range=-8000..2000),
    YComponent=Slider(-354.036, range=-2000..2000),
    ZComponent=Slider(243.836, range=-2000..2000))  # -> Vector, Length
pt_5 = Point(pt_4)
yarn_radius = Slider(2, range=0..5)
pt_6 = ConstructPoint(XCoordinate=0, YCoordinate=0, ZCoordinate=0)
division_3 = Division(A=subtraction, B="2")
mesh = Mesh(<mesh referenced from the Rhino model>)
vec_2 = VectorXYZ(XComponent="0", YComponent="1", ZComponent="0")  # -> Vector, Length
cluster = Cluster_2(
    relay_2=number_slider_2,
    Y=number_slider,
    N=subtraction,
    C=Slider(3, range=1..50),
    relay_3=division_3,
    B_2="0",
    G=brep_2,
    A=pt,
    relay=division_3,
    B=pt_5,
    row_1_prefix="Base_Right_",
    row_2_prefix="Base_Left_")  # -> out_cones, L, out_cone_centroid_bottoms, out_rectangle, out_names
pl = PlaneNormal(Origin=pt_6, ZAxis=vec_2.Vector)
pdecon = Deconstruct(Point=pt_5)  # -> XComponent, YComponent, ZComponent
Z = UnitZ(Factor="-1")
pl_2 = PlaneNormal(Origin=cluster.out_cone_centroid_bottoms, ZAxis=Z)
pt_7 = Point(Point(2826.387464, -1536.22881, 1373.879708))
pt_8 = Point(Point(2826.387464, -3589.649863, 1373.879708))
pt_9 = Point(Point(2581.387464, -3475.570915, 1373.879708))
pt_10 = Point(Point(2581.387464, -1422.149863, 1373.879708))
cluster_2 = Cluster_6(relay=pt_7, B=pt_8, relay_2="3")
cluster_3 = Cluster_6(relay=pt_10, B=pt_9, relay_2="3")
py3 = Python3Script(x=cluster_2, y="Back_")  # -> out, a; inputs x: list
# ---------- py3: Python ----------
"""Grasshopper Script"""
a = [y + str(element) for element in range(len(x))]
# ---------- end py3 ----------
pt_11 = Point(cluster_3)
py3_2 = Python3Script(x=cluster_3, y="Front_")  # -> out, a; inputs x: list; same code as py3
pt_12 = Point(cluster_2)
rotate = Rotate(Geometry=mesh, Angle="-1*pi/180*90", Plane=pl)  # -> Geometry, Transform
subtraction_2 = Subtraction(A=pdecon.YComponent, B=division)
subtraction_3 = Subtraction(A=pdecon.XComponent, B=division_2)
pt_13 = ConstructPoint(XCoordinate=subtraction_3, YCoordinate=subtraction_2, ZCoordinate=pdecon.ZComponent)
merge = Merge(Data1=py3_2.a, Data2=py3.a)
merge_2 = Merge(Data1=pt_11, Data2=pt_12)
cluster_4 = Cluster_8(G=brep_2, T=merge_2)
rotate_2 = Rotate(Geometry=pl_2, Angle="pi/2", Plane=pt_5)  # -> Geometry, Transform
rotate_3 = Rotate(Geometry=cluster.out_cones, Angle="pi/2", Plane=pt_5)  # -> Geometry, Transform
vec_3 = VectorXYZ(XComponent="0", YComponent="1", ZComponent="0")  # -> Vector, Length
cluster_5 = Cluster_3(C=rotate.Geometry)
cluster_6 = Cluster_3(C=rotate_3.Geometry)
multiplication = Multiplication(A=Slider(-25, range=-180..180), B="pi/180")
pl_3 = PlaneNormal(Origin=pt_13, ZAxis=vec_3.Vector)
vec2pt = Vector2Pt(PointA=cluster_5, PointB=cluster_6, Unitize=False)  # -> Vector, Length
rotate_4 = Rotate(Geometry=rotate_3.Geometry, Angle=multiplication, Plane=pl_3)  # -> Geometry, Transform
move = Move(Geometry=rotate.Geometry, Motion=vec2pt.Vector)  # -> Geometry, Transform
vec_4 = VectorXYZ(XComponent=0, YComponent=0, ZComponent=Slider(0, range=0..500))  # -> Vector, Length
xz = XZPlane(Origin=Point(0, 0, 0))
multiplication_2 = Multiplication(A="-1", B=Slider(300, range=0..500))
move_2 = Move(Geometry=rotate_4.Geometry, Motion=vec.Vector)  # -> flatten(Geometry), Transform
move_3 = Move(Geometry=move.Geometry, Motion=vec_4.Vector)  # -> Geometry, Transform
mesh_2 = MeshBrep(
    Brep=move_2.Geometry,
    Settings={GridMaxCount=0, GridMinCount=16, JaggedSeams=False, MaxEdgeLength=5000, MinEdgeLength=50, MinTolerance=0, Refine=True, RefineAngle=0, RelativeTolerance=0.65, SimplePlanes=True, Tolerance=0})  # -> flatten(Mesh)
rotate_5 = Rotate(Geometry=move_3.Geometry, Angle=multiplication, Plane=pl_3)  # -> Geometry, Transform
move_4 = Move(Geometry=rotate_5.Geometry, Motion=vec.Vector)  # -> flatten(Geometry), Transform
cluster_7 = Cluster_12(C=move_4.Geometry)
cluster_8 = Cluster(C=brep_2)
Z_2 = UnitZ(Factor=cluster_8)
move_5 = Move(Geometry=rotate_2.Geometry, Motion=Z_2)  # -> flatten(Geometry), Transform
rotate_6 = Rotate(Geometry=move_5.Geometry, Angle=multiplication, Plane=pl_3)  # -> Geometry, Transform
move_6 = Move(Geometry=rotate_6.Geometry, Motion=vec.Vector)  # -> flatten(Geometry), Transform
mirror = Mirror(Geometry=move_6.Geometry, Plane=xz)  # -> Geometry, Transform
xz_2 = XZPlane(Origin=mirror.Geometry)
mirror_2 = Mirror(Geometry=mirror.Geometry, Plane=xz_2)  # -> Geometry, Transform
merge_3 = Merge(Data1=move_6.Geometry, Data2=mirror_2.Geometry)
deplane = DeconstructPlane(Plane=merge_3)  # -> Origin, XAxis, YAxis, ZAxis
amp = Amplitude(Vector=deplane.ZAxis, Amplitude=multiplication_2)
rotate_7 = Rotate(Geometry=merge_3, Angle="pi/2", Plane=merge_3)  # -> Geometry, Transform
xz_3 = XZPlane(Origin=Point(0, 0, 0))
move_7 = Move(Geometry=merge_3, Motion=amp)  # -> Geometry, Transform
move_8 = Move(Geometry=rotate_7.Geometry, Motion=amp)  # -> Geometry, Transform
Z_3 = UnitZ(Factor="-1")
mirror_3 = Mirror(Geometry=move_4.Geometry, Plane=xz_3)  # -> Geometry, Transform
cluster_9 = Cluster_12(C=mirror_3.Geometry)
vec2pt_2 = Vector2Pt(PointA=cluster_7, PointB=cluster_9, Unitize=False)  # -> Vector, Length
cluster_10 = Cluster_4(P=flatten(mirror_2.Geometry))  # -> geometry, colors
py3_3 = Python3Script()  # -> out, a, planes, frame_names
# ---------- py3_3: Python ----------
"""# GhPython component (Rhino 8 / CPython 3): RoboDK frames as Rhino Planes
#
# Inputs:
#   yaml_path  (str)   -- path to robodk.yaml (optional, uses default if blank)
#   group      (str)   -- "rail_points" or "approach_frames" (default: "rail_points")
#   scale      (float) -- unit scale for x/y/z (default 1.0 mm; use 0.001 for metres)
#
# Outputs:
#   planes      -- list of Rhino.Geometry.Plane
#   origins     -- list of Rhino.Geometry.Point3d
#   frame_names -- list of str

import sys
sys.path.insert(0, r"C:\Users\samst\Framework\clones\custom_estimates_using_dhr_methods\misc_extraction_utils")

from robodk_yaml_reader import load_all_frames, filter_frames
import Rhino.Geometry as rg

try:
    yaml_path
except NameError:
    yaml_path = None

try:
    group
except NameError:
    group = None

try:
    scale
except NameError:
    scale = None

if group is None or group == "":
    group = "rail_points"

if scale is None:
    scale = 1.0

PATTERNS = {
    "rail_points":     r"^OptimizationApproachMachine\d+$",
    "approach_frames": r"CurtainSafe$",
}

if group not in PATTERNS:
    raise KeyError("group must be one of: {}".format(list(PATTERNS.keys())))

all_frames = load_all_frames(yaml_path)
entries    = filter_frames(all_frames, PATTERNS[group])

planes      = []
origins     = []
frame_names = []

for e in entries:
    origin = rg.Point3d(e["x"] * scale, e["y"] * scale, e["z"] * scale)
    xaxis  = rg.Vector3d(e["xaxis"][0], e["xaxis"][1], e["xaxis"][2])
    yaxis  = rg.Vector3d(e["yaxis"][0], e["yaxis"][1], e["yaxis"][2])

    planes.append(rg.Plane(origin, xaxis, yaxis))
    origins.append(origin)
    frame_names.append(e["name"])"""
# ---------- end py3_3 ----------
merge_4 = Merge(Data1=move_4.Geometry, Data2=mirror_3.Geometry)  # -> flatten(Result)
preview = CustomPreview(Geometry=cluster_10.geometry, Material=cluster_10.colors)
pl_4 = PlaneNormal(Origin=merge_2, ZAxis=Z_3)
move_9 = Move(Geometry=mesh_2, Motion=vec2pt_2.Vector)  # -> Geometry, Transform
Z_4 = UnitZ(Factor=cluster_8)
Z_5 = UnitZ(Factor="600")
panel = Panel(py3_3.frame_names)
merge_5 = Merge(Data1=mesh_2, Data2=move_9.Geometry)
move_10 = Move(Geometry=pl_4, Motion=Z_4)  # -> Geometry, Transform
cluster_11 = Cluster_4(P=py3_3.planes)  # -> geometry, colors
tag = TextTag(Location=py3_3.planes, Text=py3_3.frame_names)
Z_6 = UnitZ(Factor="150")
move_11 = Move(Geometry=merge_2, Motion=Z_5)  # -> Geometry, Transform
X = UnitX(Factor="-1")
move_12 = Move(Geometry=move_10.Geometry, Motion=Z_6)  # -> Geometry, Transform
move_13 = Move(Geometry=merge_2, Motion=Z_4)  # -> Geometry, Transform
pl_5 = PlaneNormal(Origin=move_11.Geometry, ZAxis=X)
cluster_12 = Cluster_11(A=Slider(-1700, range=-2000..1000), G=merge_4, C=merge_4)
Z_7 = UnitZ(Factor="500")
Z_8 = UnitZ(Factor="50")
pl_6 = PlaneNormal(Origin=merge_2, ZAxis=X)
pl_7 = PlaneNormal(Origin=move_13.Geometry, ZAxis=X)
X_2 = UnitX(Factor="-50")
multiplication_3 = Multiplication(A="-50", B="-1")
X_3 = UnitX(Factor="300")
panel_2 = Panel(cluster.out_names)
move_14 = Move(Geometry=pl_6, Motion=Z_7)  # -> Geometry, Transform
move_15 = Move(Geometry=pl_7, Motion=Z_8)  # -> Geometry, Transform
swatch = ColourSwatch(SwatchColor=RGB(204, 35, 35))
cluster_13 = Cluster_10(P=move_11.Geometry, T=X_3)
addition_2 = Addition(A="300", B=multiplication_3)
move_16 = Move(Geometry=move_14.Geometry, Motion=X_2)  # -> Geometry, Transform
move_17 = Move(Geometry=move_15.Geometry, Motion=X_2)  # -> Geometry, Transform
panel_3 = Panel(addition_2)
py3_4 = Python3Script(x=panel_2)  # -> out, a; inputs x: list
# ---------- py3_4: Python ----------
a = [ "alt_" + element for element in x]
# ---------- end py3_4 ----------
merge_6 = Merge(Data1=merge_4)  # -> flatten(Result)
pl_8 = PlaneNormal(Origin=cluster_13, ZAxis=X)
merge_7 = Merge(Data1=panel_2, Data2=py3_4.a)  # -> flatten(Result)
X_4 = UnitX(Factor=panel_3)
panel_4 = Panel(merge_7)
X_5 = UnitX(Factor=panel_3)
cluster_14 = Cluster_10(P=move_17.Geometry, T=X_4)
cluster_15 = Cluster_10(P=move_16.Geometry, T=X_5)
pl_9 = PlaneNormal(Origin=cluster_14, ZAxis=X)
merge_8 = Merge(Data1=rotate_7.Geometry, Data2=move_8.Geometry, Data3=move_7.Geometry, Data4=merge_3)
pl_10 = PlaneNormal(Origin=cluster_15, ZAxis=X)
py3_5 = Python3Script(
    trigger=Button(),
    cones=merge_5,
    grab_points=rotate_7.Geometry,
    string_grab_points=merge_3,
    cone_color=swatch,
    bins=merge_6,
    approach_points=move_8.Geometry,
    string_approach_points=move_7.Geometry,
    cone_names=merge_7,
    update_and_amalgamate_waypoints=Toggle(True),
    z_axis_free=Toggle(True))  # -> out, a; inputs cones: list, grab_points: list, string_grab_points: list, bins: list, approach_points: list, string_approach_points: list, cone_names: list
# ---------- py3_5: Python ----------
# GhPython component (Rhino 8 / CPython 3)
# Export base cone grab points + approach offsets to YAML and import STLs into RoboDK.
#
# GH Inputs:
#   cones               : geometry (DataTree one branch per cone, or flat list)
#   grab_points         : flat list of Planes, one per cone ΓÇö cone grab planes
#   approach_points     : flat list of Planes, one per cone ΓÇö cone approach planes (pre-computed in GH)
#   string_grab_points  : flat list of Planes, one per cone
#   string_approach_points : flat list of Planes, one per cone ΓÇö string approach planes (pre-computed in GH)
#   bins                : geometry (flat list or DataTree, one branch per bin)
#   cone_names          : flat list of str ΓÇö one name per cone; used for RoboDK items and YAML (optional, defaults to "base_cone_0", ...)
#   bin_names           : flat list of str ΓÇö one name per bin; used for RoboDK items (optional, defaults to "bin_0", ...)
#   base_origin         : Point ΓÇö robot base origin in Rhino model space
#   yaml_path           : str   ΓÇö output YAML path (default: repo/robo_dk_output/base_cone_waypoints.yaml)
#   cone_color          : Colour (optional, default orange)
#   string_color        : Colour (optional, default yellow)
#   bin_color           : Colour (optional, default blue)
#   z_axis_free         : Boolean (optional, default False) ΓÇö if True, marks points as z_axis_free in checker config JSON
#   update_and_amalgamate_waypoints : Boolean ΓÇö if True, runs amalgamate_waypoints.py then import_waypoints_to_robodk.py after export
#   trigger             : Boolean
#
# GH Outputs:
#   grab_planes         : list of Plane ΓÇö cone grab planes (passthrough)
#   approach_planes     : list of Plane ΓÇö cone approach planes (passthrough)
#   str_planes          : list of Plane ΓÇö string grab planes (passthrough)
#   str_approach_planes : list of Plane ΓÇö string approach planes (passthrough)
#   stl_paths           : list of str  ΓÇö STL files written
#   yaml_out            : str          ΓÇö path to written YAML

import os
import sys
import json
import math
import struct
import Rhino.Geometry as rg
import scriptcontext as sc
import System

# ΓöÇΓöÇ End effector names for robert_end_checker_config.json ΓöÇΓöÇΓöÇΓöÇΓöÇΓöÇΓöÇΓöÇΓöÇΓöÇΓöÇΓöÇΓöÇΓöÇΓöÇΓöÇΓöÇΓöÇΓöÇΓöÇΓöÇΓöÇ
PICKUP_END_EFFECTOR_NAME   = "pickup"
KNOTTING_END_EFFECTOR_NAME = "knotting"
SOURCE_SCRIPT = "export_base_cone_waypoints"

REPO_ROOT = r"C:\Users\samst\Framework\clones\custom_estimates_using_dhr_methods"
CHECKER_CONFIG_PATH = os.path.join(REPO_ROOT, "robert_checker_stuff", "robert_end_checker_config.json")

# ΓöÇΓöÇ Optional inputs with defaults ΓöÇΓöÇΓöÇΓöÇΓöÇΓöÇΓöÇΓöÇΓöÇΓöÇΓöÇΓöÇΓöÇΓöÇΓöÇΓöÇΓöÇΓöÇΓöÇΓöÇΓöÇΓöÇΓöÇΓöÇΓöÇΓöÇΓöÇΓöÇΓöÇΓöÇΓöÇΓöÇΓöÇΓöÇΓöÇΓöÇΓöÇΓöÇΓöÇΓöÇΓöÇΓöÇΓöÇΓöÇ
try:
    yaml_path
except NameError:
    yaml_path = None

try:
    approach_points
except NameError:
    approach_points = None

try:
    string_approach_points
except NameError:
    string_approach_points = None

try:
    strings
except NameError:
    strings = None

try:
    cone_names
except NameError:
    cone_names = None

try:
    bin_names
except NameError:
    bin_names = None

try:
    z_axis_free
except NameError:
    z_axis_free = False

try:
    update_and_amalgamate_waypoints
except NameError:
    update_and_amalgamate_waypoints = False

if yaml_path is None or yaml_path == "":
    yaml_path = r"C:\Users\samst\Framework\clones\custom_estimates_using_dhr_methods\robo_dk_output\base_cone_waypoints.yaml"

# ΓöÇΓöÇ Helpers (unchanged from original) ΓöÇΓöÇΓöÇΓöÇΓöÇΓöÇΓöÇΓöÇΓöÇΓöÇΓöÇΓöÇΓöÇΓöÇΓöÇΓöÇΓöÇΓöÇΓöÇΓöÇΓöÇΓöÇΓöÇΓöÇΓöÇΓöÇΓöÇΓöÇΓöÇΓöÇΓöÇΓöÇΓöÇΓöÇΓöÇΓöÇΓöÇΓöÇΓöÇΓöÇ

def flatten_input(gh_input, exclude_type=None):
    result = []
    if hasattr(gh_input, 'Branches'):
        for branch in gh_input.Branches:
            for item in branch:
                if item is not None:
                    result.append(item)
    elif hasattr(gh_input, '__iter__') and (exclude_type is None or not isinstance(gh_input, exclude_type)):
        for item in gh_input:
            if item is not None:
                result.append(item)
    elif gh_input is not None:
        result.append(gh_input)
    return result

def resolve_first_point(gh_input):
    def to_pt(item):
        if isinstance(item, System.Guid):
            rhino_obj = sc.doc.Objects.FindId(item)
            if rhino_obj:
                geo = rhino_obj.Geometry
                if isinstance(geo, rg.Point): return geo.Location
                elif hasattr(geo, 'Location'): return geo.Location
                else: return geo.GetBoundingBox(True).Center
            return None
        if isinstance(item, rg.Point3d): return item
        if isinstance(item, rg.Point): return item.Location
        if hasattr(item, 'X') and hasattr(item, 'Y') and hasattr(item, 'Z'):
            return rg.Point3d(item.X, item.Y, item.Z)
        return None
    items = flatten_input(gh_input, exclude_type=rg.Point3d)
    if not items:
        return to_pt(gh_input)
    for item in items:
        pt = to_pt(item)
        if pt is not None:
            return pt
    return None

def resolve_plane(item):
    if item is None:
        return None
    if isinstance(item, rg.Plane):
        return item
    if isinstance(item, System.Guid):
        rhino_obj = sc.doc.Objects.FindId(item)
        if rhino_obj:
            geo = rhino_obj.Geometry
            if isinstance(geo, rg.Plane): return geo
            if isinstance(geo, rg.Point): item = geo.Location
            elif hasattr(geo, 'Location'): item = geo.Location
            else: item = geo.GetBoundingBox(True).Center
        else:
            print(f"  Could not find Guid: {item}")
            return None
    if isinstance(item, rg.Point3d):
        return rg.Plane(item, rg.Vector3d.XAxis, rg.Vector3d.YAxis)
    if isinstance(item, rg.Point):
        return rg.Plane(item.Location, rg.Vector3d.XAxis, rg.Vector3d.YAxis)
    if hasattr(item, 'X') and hasattr(item, 'Y') and hasattr(item, 'Z'):
        return rg.Plane(rg.Point3d(item.X, item.Y, item.Z), rg.Vector3d.XAxis, rg.Vector3d.YAxis)
    print(f"  Unknown plane type: {type(item)}")
    return None

def resolve_color(gh_color, default_rgba):
    if gh_color is None:
        return default_rgba
    def color_from_raw(raw):
        if raw is None: return None
        if type(raw).__name__ == 'Color' or (hasattr(raw,'R') and hasattr(raw,'G') and hasattr(raw,'B') and hasattr(raw,'A')):
            return [raw.R/255.0, raw.G/255.0, raw.B/255.0, raw.A/255.0]
        if isinstance(raw,(list,tuple)) and all(isinstance(v,(int,float)) for v in raw):
            vals = list(raw)[:4]; vals = [v/255.0 for v in vals] if any(v>1.0 for v in vals) else vals
            while len(vals)<4: vals.append(1.0)
            return vals
        return None
    if hasattr(gh_color,'Branches'):
        try: return color_from_raw(list(gh_color.Branches[0])[0]) or default_rgba
        except: return default_rgba
    result = color_from_raw(gh_color)
    if result: return result
    if hasattr(gh_color,'__iter__') and not isinstance(gh_color,str):
        try:
            for item in gh_color:
                if item is not None:
                    result = color_from_raw(item)
                    if result: return result
                    break
        except: pass
    return default_rgba

def diagnose_tree(name, gh_input):
    if gh_input is None:
        print(f"  {name}: None")
        return
    if hasattr(gh_input, 'Branches'):
        print(f"  {name}: DataTree {len(gh_input.Branches)} branches")
        for j, (path, branch) in enumerate(zip(gh_input.Paths, gh_input.Branches)):
            print(f"    branch[{j}] path={path} items={len(branch)}")
    elif hasattr(gh_input, '__iter__') and not isinstance(gh_input, (rg.Mesh, rg.Point3d, rg.Plane)):
        items = list(gh_input)
        print(f"  {name}: list len={len(items)}")
    else:
        print(f"  {name}: {type(gh_input).__name__}")

# ΓöÇΓöÇ Pose conversion ΓöÇΓöÇΓöÇΓöÇΓöÇΓöÇΓöÇΓöÇΓöÇΓöÇΓöÇΓöÇΓöÇΓöÇΓöÇΓöÇΓöÇΓöÇΓöÇΓöÇΓöÇΓöÇΓöÇΓöÇΓöÇΓöÇΓöÇΓöÇΓöÇΓöÇΓöÇΓöÇΓöÇΓöÇΓöÇΓöÇΓöÇΓöÇΓöÇΓöÇΓöÇΓöÇΓöÇΓöÇΓöÇΓöÇΓöÇΓöÇΓöÇΓöÇΓöÇΓöÇΓöÇΓöÇΓöÇΓöÇΓöÇΓöÇΓöÇ

def plane_to_xyzrpw_robot_local(plane, base_orig):
    """Convert Rhino Plane to robot-local XYZ + ZYX Euler angles (degrees).

    base_orig is a Point3d marking the robot base in Rhino world space.
    If None, returns world-space coordinates.
    """
    ox = plane.Origin.X - (base_orig.X if base_orig else 0.0)
    oy = plane.Origin.Y - (base_orig.Y if base_orig else 0.0)
    oz = plane.Origin.Z - (base_orig.Z if base_orig else 0.0)

    xax, yax, zax = plane.XAxis, plane.YAxis, plane.ZAxis

    # ZYX Euler extraction from rotation matrix columns
    sy = -xax.Z
    cy = math.sqrt(xax.X**2 + xax.Y**2)
    if cy > 1e-6:
        rx = math.atan2(yax.Z, zax.Z)
        ry = math.atan2(sy, cy)
        rz = math.atan2(xax.Y, xax.X)
    else:
        rx = math.atan2(-zax.Y, yax.Y)
        ry = math.atan2(sy, cy)
        rz = 0.0

    return (
        round(ox, 4), round(oy, 4), round(oz, 4),
        round(math.degrees(rx), 6), round(math.degrees(ry), 6), round(math.degrees(rz), 6),
    )

# ΓöÇΓöÇ STL writer (unchanged) ΓöÇΓöÇΓöÇΓöÇΓöÇΓöÇΓöÇΓöÇΓöÇΓöÇΓöÇΓöÇΓöÇΓöÇΓöÇΓöÇΓöÇΓöÇΓöÇΓöÇΓöÇΓöÇΓöÇΓöÇΓöÇΓöÇΓöÇΓöÇΓöÇΓöÇΓöÇΓöÇΓöÇΓöÇΓöÇΓöÇΓöÇΓöÇΓöÇΓöÇΓöÇΓöÇΓöÇΓöÇΓöÇΓöÇΓöÇΓöÇΓöÇΓöÇΓöÇΓöÇ

def build_and_write_stl(geo_list, stl_path):
    mesh_list = rg.Mesh()
    for geo in geo_list:
        if isinstance(geo, rg.Mesh):
            geo.Faces.ConvertQuadsToTriangles(); mesh_list.Append(geo)
        elif isinstance(geo, rg.Brep):
            meshes = rg.Mesh.CreateFromBrep(geo, rg.MeshingParameters.Coarse)
            if meshes:
                for m in meshes: m.Faces.ConvertQuadsToTriangles(); mesh_list.Append(m)
        elif isinstance(geo, System.Guid):
            rhino_obj = sc.doc.Objects.FindId(geo)
            if rhino_obj:
                obj_geo = rhino_obj.Geometry
                if isinstance(obj_geo, rg.Mesh):
                    obj_geo.Faces.ConvertQuadsToTriangles(); mesh_list.Append(obj_geo)
                elif isinstance(obj_geo, rg.Brep):
                    meshes = rg.Mesh.CreateFromBrep(obj_geo, rg.MeshingParameters.Coarse)
                    if meshes:
                        for m in meshes: m.Faces.ConvertQuadsToTriangles(); mesh_list.Append(m)
    mesh_list.Faces.ConvertQuadsToTriangles()
    triangles = []
    for i in range(mesh_list.Faces.Count):
        face = mesh_list.Faces[i]
        triangles.append((mesh_list.Vertices[face.A], mesh_list.Vertices[face.B], mesh_list.Vertices[face.C]))
    os.makedirs(os.path.dirname(stl_path), exist_ok=True)
    with open(stl_path, 'wb') as f:
        f.write(b'\0' * 80)
        f.write(struct.pack('<I', len(triangles)))
        for v0, v1, v2 in triangles:
            f.write(struct.pack('<fff', 0, 0, 0))
            f.write(struct.pack('<fff', v0.X, v0.Y, v0.Z))
            f.write(struct.pack('<fff', v1.X, v1.Y, v1.Z))
            f.write(struct.pack('<fff', v2.X, v2.Y, v2.Z))
            f.write(struct.pack('<H', 0))
    return len(triangles)

# ΓöÇΓöÇ YAML writer ΓöÇΓöÇΓöÇΓöÇΓöÇΓöÇΓöÇΓöÇΓöÇΓöÇΓöÇΓöÇΓöÇΓöÇΓöÇΓöÇΓöÇΓöÇΓöÇΓöÇΓöÇΓöÇΓöÇΓöÇΓöÇΓöÇΓöÇΓöÇΓöÇΓöÇΓöÇΓöÇΓöÇΓöÇΓöÇΓöÇΓöÇΓöÇΓöÇΓöÇΓöÇΓöÇΓöÇΓöÇΓöÇΓöÇΓöÇΓöÇΓöÇΓöÇΓöÇΓöÇΓöÇΓöÇΓöÇΓöÇΓöÇΓöÇΓöÇΓöÇΓöÇΓöÇΓöÇ

def write_waypoints_yaml(waypoints, edges, path):
    """Write waypoints and edges to a valid YAML file."""
    lines = ["waypoints:"]
    for w in waypoints:
        lines.append(f"  - name: {w['name']}")
        lines.append(f"    x: {w['x']}")
        lines.append(f"    y: {w['y']}")
        lines.append(f"    z: {w['z']}")
        lines.append(f"    rx: {w['rx']}")
        lines.append(f"    ry: {w['ry']}")
        lines.append(f"    rz: {w['rz']}")
        lines.append(f"    frame: robot_local")
        lines.append(f"    move_type: {w['move_type']}")
        j7_val = w.get('j7')
        lines.append(f"    j7: {'null' if j7_val is None else j7_val}")
        if w.get('z_axis_free'):
            lines.append(f"    z_axis_free: true")
        if w.get('special_conditions'):
            conds = ", ".join(w['special_conditions'])
            lines.append(f"    special_conditions: [{conds}]")
        lines.append(f"    source: grasshopper")
        if w.get('note'):
            lines.append(f"    note: \"{w['note']}\"")

    lines.append("")
    lines.append("edges:")
    for e in edges:
        lines.append(f"  - from: {e['from']}")
        lines.append(f"    to:   {e['to']}")
        lines.append(f"    tested: null")

    os.makedirs(os.path.dirname(path), exist_ok=True)
    with open(path, "w", encoding="utf-8") as f:
        f.write("\n".join(lines) + "\n")

# ΓöÇΓöÇ Main ΓöÇΓöÇΓöÇΓöÇΓöÇΓöÇΓöÇΓöÇΓöÇΓöÇΓöÇΓöÇΓöÇΓöÇΓöÇΓöÇΓöÇΓöÇΓöÇΓöÇΓöÇΓöÇΓöÇΓöÇΓöÇΓöÇΓöÇΓöÇΓöÇΓöÇΓöÇΓöÇΓöÇΓöÇΓöÇΓöÇΓöÇΓöÇΓöÇΓöÇΓöÇΓöÇΓöÇΓöÇΓöÇΓöÇΓöÇΓöÇΓöÇΓöÇΓöÇΓöÇΓöÇΓöÇΓöÇΓöÇΓöÇΓöÇΓöÇΓöÇΓöÇΓöÇΓöÇΓöÇΓöÇΓöÇΓöÇΓöÇΓöÇΓöÇ

try:
    trigger
except NameError:
    trigger = True

# Initialise outputs so GH never gets an error even if trigger is off
grab_planes         = []
approach_planes     = []
str_planes          = []
str_approach_planes = []
stl_paths           = []
yaml_out            = ""

print("=== INPUT DIAGNOSTICS ===")
diagnose_tree("cones",                   cones)
diagnose_tree("grab_points",             grab_points)
diagnose_tree("approach_points",         approach_points)
diagnose_tree("string_grab_points",      string_grab_points)
diagnose_tree("string_approach_points",  string_approach_points)
diagnose_tree("strings",                 strings)
diagnose_tree("bins",                    bins if 'bins' in dir() else None)
print("=========================")

raw_cone_names = flatten_input(cone_names) if cone_names is not None else []
raw_bin_names  = flatten_input(bin_names)  if bin_names  is not None else []
def cone_name(i):
    if i < len(raw_cone_names) and raw_cone_names[i]:
        return str(raw_cone_names[i])
    return f"base_cone_{i}"
def bin_name(i):
    if i < len(raw_bin_names) and raw_bin_names[i]:
        return str(raw_bin_names[i])
    return f"bin_{i}"

# Collect inputs
cone_branches = []
if hasattr(cones, 'Branches') and len(cones.Branches) > 1:
    for branch in cones.Branches:
        items = [item for item in branch if item is not None]
        if items: cone_branches.append(items)
    print(f"MODE A: {len(cone_branches)} cone branches from DataTree")
else:
    flat = flatten_input(cones)
    for item in flat: cone_branches.append([item])
    print(f"MODE B: {len(cone_branches)} cones from flat list")

bin_branches = []
if 'bins' in dir() and bins is not None:
    if hasattr(bins, 'Branches') and len(bins.Branches) > 1:
        for branch in bins.Branches:
            items = [item for item in branch if item is not None]
            if items: bin_branches.append(items)
    else:
        flat = flatten_input(bins)
        for item in flat: bin_branches.append([item])

string_branches = []
if strings is not None:
    if hasattr(strings, 'Branches') and len(strings.Branches) > 1:
        for branch in strings.Branches:
            items = [item for item in branch if item is not None]
            if items: string_branches.append(items)
    else:
        flat = flatten_input(strings)
        for item in flat: string_branches.append([item])

cone_grab_planes_raw     = [resolve_plane(p) for p in flatten_input(grab_points)]
cone_approach_planes_raw = [resolve_plane(p) for p in flatten_input(approach_points)] if approach_points is not None else []
str_grab_planes_raw      = [resolve_plane(p) for p in flatten_input(string_grab_points)]
str_approach_planes_raw  = [resolve_plane(p) for p in flatten_input(string_approach_points)] if string_approach_points is not None else []
base_orig                = resolve_first_point(base_origin) if 'base_origin' in dir() else None

num_cones = len(cone_branches)
num_bins  = len(bin_branches)
print(f"num_cones={num_cones}  cone_grabs={len(cone_grab_planes_raw)}  cone_approaches={len(cone_approach_planes_raw)}")
print(f"str_grabs={len(str_grab_planes_raw)}  str_approaches={len(str_approach_planes_raw)}")
print(f"base_origin: {base_orig}")

# Always populate output planes from inputs
grab_planes         = [p for p in cone_grab_planes_raw     if p is not None]
approach_planes     = [p for p in cone_approach_planes_raw if p is not None]
str_planes          = [p for p in str_grab_planes_raw      if p is not None]
str_approach_planes = [p for p in str_approach_planes_raw  if p is not None]

if trigger:
    print("Rebuilding STLs and YAML...")

    os.makedirs("C:/temp/base_cones", exist_ok=True)
    os.makedirs("C:/temp/bins", exist_ok=True)
    os.makedirs("C:/temp/base_strings", exist_ok=True)

    # Write STLs
    for i, branch_geos in enumerate(cone_branches):
        path = f"C:/temp/base_cones/{cone_name(i)}.stl"
        tris = build_and_write_stl(branch_geos, path)
        stl_paths.append(path)
        print(f"  {cone_name(i)}: {tris} triangles -> {path}")

    bin_stl_paths = []
    for i, branch_geos in enumerate(bin_branches):
        path = f"C:/temp/bins/{bin_name(i)}.stl"
        tris = build_and_write_stl(branch_geos, path)
        bin_stl_paths.append(path)
        print(f"  {bin_name(i)}: {tris} triangles -> {path}")

    string_stl_paths = []
    for i, branch_geos in enumerate(string_branches):
        path = f"C:/temp/base_strings/{cone_name(i)}_string.stl"
        tris = build_and_write_stl(branch_geos, path)
        string_stl_paths.append(path)
        print(f"  {cone_name(i)}_string: {tris} triangles -> {path}")

    # Build output planes and YAML entries
    waypoints = []
    edges     = []

    for i, pl in enumerate(cone_grab_planes_raw):
        if pl is None:
            print(f"  WARNING: cone_grab_{i} plane is None ΓÇö skipping")
            continue

        ap = cone_approach_planes_raw[i] if i < len(cone_approach_planes_raw) else None
        if ap is None:
            print(f"  WARNING: cone_grab_{i} approach plane is None ΓÇö skipping")
            continue

        grab_name     = f"{cone_name(i)}_grab"
        approach_name = f"{cone_name(i)}_grab_approach"

        x,y,z,rx,ry,rz      = plane_to_xyzrpw_robot_local(pl, base_orig)
        ax,ay,az,arx,ary,arz = plane_to_xyzrpw_robot_local(ap, base_orig)

        waypoints.append({"name": approach_name, "x":ax,"y":ay,"z":az,"rx":arx,"ry":ary,"rz":arz,
                          "move_type":"MoveJ","j7":None,"z_axis_free":True,
                          "special_conditions":["attached_to_base"],
                          "note":"cone approach - robot-relative, j7 free, rotation around cone Z axis free"})
        waypoints.append({"name": grab_name,     "x":x, "y":y, "z":z, "rx":rx, "ry":ry, "rz":rz,
                          "move_type":"MoveL","j7":None,
                          "special_conditions":["attached_to_base"],
                          "note":"cone grab - robot-relative, j7 free"})

        # Bidirectional edges ΓÇö enter (approachΓåÆgrab) and exit (grabΓåÆapproach)
        edges.append({"from": approach_name, "to": grab_name})
        edges.append({"from": grab_name,     "to": approach_name})

        print(f"  cone_grab_{i}: grab=({x:.1f},{y:.1f},{z:.1f})  approach=({ax:.1f},{ay:.1f},{az:.1f})")

    for i, pl in enumerate(str_grab_planes_raw):
        if pl is None:
            print(f"  WARNING: str_grab_{i} plane is None ΓÇö skipping")
            continue

        ap = str_approach_planes_raw[i] if i < len(str_approach_planes_raw) else None
        if ap is None:
            print(f"  WARNING: str_grab_{i} approach plane is None ΓÇö skipping")
            continue

        grab_name     = f"{cone_name(i)}_string_grab"
        approach_name = f"{cone_name(i)}_string_grab_approach"

        x,y,z,rx,ry,rz      = plane_to_xyzrpw_robot_local(pl, base_orig)
        ax,ay,az,arx,ary,arz = plane_to_xyzrpw_robot_local(ap, base_orig)

        waypoints.append({"name": approach_name, "x":ax,"y":ay,"z":az,"rx":arx,"ry":ary,"rz":arz,
                          "move_type":"MoveJ","j7":None,"z_axis_free":True,
                          "special_conditions":["attached_to_base"],
                          "note":"string grab approach - robot-relative, j7 free, rotation around cone Z axis free"})
        waypoints.append({"name": grab_name,     "x":x, "y":y, "z":z, "rx":rx, "ry":ry, "rz":rz,
                          "move_type":"MoveL","j7":None,
                          "special_conditions":["attached_to_base"],
                          "note":"string grab - robot-relative, j7 free"})

        edges.append({"from": approach_name, "to": grab_name})
        edges.append({"from": grab_name,     "to": approach_name})

    # Write YAML
    write_waypoints_yaml(waypoints, edges, yaml_path)
    yaml_out = yaml_path
    print(f"\n[OK] {len(waypoints)} waypoints, {len(edges)} edges -> {yaml_path}")
    print(f"[OK] {len(stl_paths)} STL files written")

    # ΓöÇΓöÇ Write robert_end_checker_config.json ΓöÇΓöÇΓöÇΓöÇΓöÇΓöÇΓöÇΓöÇΓöÇΓöÇΓöÇΓöÇΓöÇΓöÇΓöÇΓöÇΓöÇΓöÇΓöÇΓöÇΓöÇΓöÇΓöÇΓöÇΓöÇΓöÇΓöÇΓöÇΓöÇΓöÇΓöÇΓöÇΓöÇΓöÇΓöÇ
    if os.path.exists(CHECKER_CONFIG_PATH):
        with open(CHECKER_CONFIG_PATH, "r", encoding="utf-8") as f:
            checker_config = json.load(f)
    else:
        checker_config = {}
    if "end_effectors" not in checker_config:
        checker_config["end_effectors"] = []

    # Build pickup points (base cone grab + approach)
    pickup_points = []
    for i, pl in enumerate(cone_grab_planes_raw):
        if pl is None:
            continue
        grab_name     = f"{cone_name(i)}_grab"
        approach_name = f"{cone_name(i)}_grab_approach"
        pickup_points.append({
            "name": grab_name,
            "type": "point",
            "name_path": f"WaypointTargets/{grab_name}",
            "source_script": SOURCE_SCRIPT,
            "z_axis_free": bool(z_axis_free),
            "special_track_conditions": {"type": "Locked_at_j7_0"}
        })
        ap = cone_approach_planes_raw[i] if i < len(cone_approach_planes_raw) else None
        if ap is not None:
            pickup_points.append({
                "name": approach_name,
                "type": "point",
                "name_path": f"WaypointTargets/{approach_name}",
                "source_script": SOURCE_SCRIPT,
                "z_axis_free": bool(z_axis_free),
                "special_track_conditions": {"type": "Locked_at_j7_0"}
            })

    # Build knotting points (string grab + approach)
    knotting_points = []
    for i, pl in enumerate(str_grab_planes_raw):
        if pl is None:
            continue
        grab_name     = f"{cone_name(i)}_string_grab"
        approach_name = f"{cone_name(i)}_string_grab_approach"
        knotting_points.append({
            "name": grab_name,
            "type": "point",
            "name_path": f"WaypointTargets/{grab_name}",
            "source_script": SOURCE_SCRIPT,
            "z_axis_free": bool(z_axis_free),
            "special_track_conditions": {"type": "Locked_at_j7_0"}
        })
        ap = str_approach_planes_raw[i] if i < len(str_approach_planes_raw) else None
        if ap is not None:
            knotting_points.append({
                "name": approach_name,
                "type": "point",
                "name_path": f"WaypointTargets/{approach_name}",
                "source_script": SOURCE_SCRIPT,
                "z_axis_free": bool(z_axis_free),
                "special_track_conditions": {"type": "Locked_at_j7_0"}
            })

    def upsert_end_effector(config, ee_name, new_points, source):
        """Replace only points from this source_script, keep points from other sources."""
        for ee in config["end_effectors"]:
            if ee["end_effector_name"] == ee_name:
                other_points = [p for p in ee["paths_and_points_to_check"] if p.get("source_script") != source]
                ee["paths_and_points_to_check"] = other_points + new_points
                return
        config["end_effectors"].append({
            "end_effector_name": ee_name,
            "paths_and_points_to_check": new_points
        })

    upsert_end_effector(checker_config, PICKUP_END_EFFECTOR_NAME, pickup_points, SOURCE_SCRIPT)
    upsert_end_effector(checker_config, KNOTTING_END_EFFECTOR_NAME, knotting_points, SOURCE_SCRIPT)

    with open(CHECKER_CONFIG_PATH, "w", encoding="utf-8") as f:
        json.dump(checker_config, f, indent=2)
    print(f"[OK] robert_end_checker_config.json updated: {len(pickup_points)} pickup, {len(knotting_points)} knotting points")

    # ΓöÇΓöÇ Import STLs into RoboDK ΓöÇΓöÇΓöÇΓöÇΓöÇΓöÇΓöÇΓöÇΓöÇΓöÇΓöÇΓöÇΓöÇΓöÇΓöÇΓöÇΓöÇΓöÇΓöÇΓöÇΓöÇΓöÇΓöÇΓöÇΓöÇΓöÇΓöÇΓöÇΓöÇΓöÇΓöÇΓöÇΓöÇΓöÇΓöÇΓöÇΓöÇΓöÇΓöÇΓöÇΓöÇΓöÇΓöÇΓöÇΓöÇΓöÇΓöÇ
    try:
        sys.path.append("C:/RoboDK/Python")
        from robodk.robolink import Robolink, ITEM_TYPE_OBJECT, ITEM_TYPE_ROBOT
        from robodk.robomath import Mat
        RDK = Robolink()
        RDK.Item("")  # ping

        _cone_rgba   = resolve_color(cone_color   if 'cone_color'   in dir() else None, [1.0, 0.5, 0.0, 1.0])
        _string_rgba = resolve_color(string_color if 'string_color' in dir() else None, [1.0, 1.0, 0.0, 1.0])
        _bin_rgba    = resolve_color(bin_color    if 'bin_color'    in dir() else None, [0.5, 0.5, 0.5, 1.0])

        robot = RDK.Item("Fanuc R2000iC 125L", ITEM_TYPE_ROBOT)
        if not robot.Valid():
            # Robot was replaced ΓÇö find the first robot in the station
            all_robots = RDK.ItemList(ITEM_TYPE_ROBOT, False)
            robot = all_robots[0] if all_robots else None
            if robot and robot.Valid():
                print(f"  RoboDK: 'Fanuc R2000iC 125L' not found, using '{robot.Name()}' instead")
            else:
                robot = None
        # Parent cones to the moving rail carriage so they travel with j7.
        # Try "RailMechanism" by name first (the moving part), then fall back
        # to the robot's direct parent.
        rail_mech = RDK.Item("RailMechanism")
        if rail_mech.Valid():
            robot_base = rail_mech
            print(f"  RoboDK: parenting under 'RailMechanism' (moving carriage)")
        elif robot is not None and robot.Valid():
            robot_base = robot.Parent()
            if robot_base is not None and robot_base.Valid():
                print(f"  RoboDK: 'RailMechanism' not found, parenting under '{robot_base.Name()}'")
            else:
                robot_base = None
                print("  RoboDK: robot base not found, objects at world level")
        else:
            robot_base = None
            print("  RoboDK: no robot or rail found, objects at world level")

        station = RDK.Item("", 1)

        def identity():
            return Mat([[1,0,0,0],[0,1,0,0],[0,0,1,0],[0,0,0,1]])

        def purge_all(name):
            for _ in range(50):
                item = RDK.Item(name)
                if not item.Valid(): break
                item.Delete()

        def add_file_and_get_item(stl_path):
            before = set(it.item for it in RDK.ItemList(ITEM_TYPE_OBJECT, False))
            RDK.AddFile(stl_path)
            for it in RDK.ItemList(ITEM_TYPE_OBJECT, False):
                if it.item not in before:
                    return it
            return RDK.Item(os.path.splitext(os.path.basename(stl_path))[0])

        # Purge only items added by previous runs ΓÇö delete parent frames
        purge_all("BaseCones")
        purge_all("BaseBins")

        # BaseCones frame parented to robot_base so it moves with the rail
        parent = robot_base if robot_base is not None else station
        base_cones_frame = RDK.AddFrame("BaseCones", parent)
        base_cones_frame.setPose(identity())

        base_bins_frame = RDK.AddFrame("BaseBins", parent)
        base_bins_frame.setPose(identity())

        for i, path in enumerate(stl_paths):
            obj = add_file_and_get_item(path)
            if obj.Valid():
                obj.setName(cone_name(i))
                obj.setParentStatic(base_cones_frame)
                obj.setColor(_cone_rgba)
                print(f"  RoboDK: {cone_name(i)} imported")
            else:
                print(f"  RoboDK: FAILED {os.path.basename(path)}")

        for i, path in enumerate(string_stl_paths):
            obj = add_file_and_get_item(path)
            if obj.Valid():
                obj.setName(f"{cone_name(i)}_string")
                obj.setParentStatic(base_cones_frame)
                obj.setColor(_string_rgba)
                print(f"  RoboDK: {cone_name(i)}_string imported")
            else:
                print(f"  RoboDK: FAILED {os.path.basename(path)}")

        for i, path in enumerate(bin_stl_paths):
            obj = add_file_and_get_item(path)
            if obj.Valid():
                obj.setName(bin_name(i))
                obj.setParentStatic(base_bins_frame)
                obj.setColor(_bin_rgba)
                print(f"  RoboDK: {bin_name(i)} imported")
            else:
                print(f"  RoboDK: FAILED {os.path.basename(path)}")

        print("[OK] STLs imported into RoboDK")
    except Exception as e:
        print(f"[WARN] RoboDK import skipped: {e}")

    # ΓöÇΓöÇ Amalgamate waypoints + re-import to RoboDK ΓöÇΓöÇΓöÇΓöÇΓöÇΓöÇΓöÇΓöÇΓöÇΓöÇΓöÇΓöÇΓöÇΓöÇΓöÇΓöÇΓöÇΓöÇΓöÇΓöÇΓöÇΓöÇΓöÇΓöÇΓöÇΓöÇΓöÇΓöÇ
    if update_and_amalgamate_waypoints:
        import subprocess
        REPO   = r"C:\Users\samst\Framework\clones\custom_estimates_using_dhr_methods"
        PYTHON = r"C:\Users\samst\.rhinocode\py39-rh8\python.exe"
        amalgamate_script = os.path.join(REPO, "robodk_code", "amalgamate_waypoints.py")
        import_script     = os.path.join(REPO, "robodk_code", "import_waypoints_to_robodk.py")

        print("\n--- amalgamate_waypoints ---")
        r1 = subprocess.run([PYTHON, amalgamate_script], capture_output=True, text=True)
        print(r1.stdout)
        if r1.returncode != 0:
            print(f"[ERROR] amalgamate_waypoints failed (rc={r1.returncode}):\n{r1.stderr}")
        else:
            print("\n--- import_waypoints_to_robodk ---")
            r2 = subprocess.run([PYTHON, import_script], capture_output=True, text=True)
            print(r2.stdout)
            if r2.returncode != 0:
                print(f"[ERROR] import_waypoints_to_robodk failed (rc={r2.returncode}):\n{r2.stderr}")
# ---------- end py3_5 ----------
merge_9 = Merge(Data1=move_10.Geometry, Data2=move_12.Geometry)
merge_10 = Merge(Data1=pl_5, Data2=pl_8)
merge_11 = Merge(Data1=pl_9, Data2=move_16.Geometry, Data3=move_17.Geometry, Data4=pl_10)
py3_6 = Python3Script(
    cones=flatten(cluster_4),
    grab_points=flatten(move_10.Geometry),
    trigger=flatten(Button()),
    string_grab_points=flatten(pl_5),
    cone_color=swatch,
    string_color=swatch,
    approach_points=flatten(move_12.Geometry),
    string_approach_points=flatten(pl_8),
    names=flatten(merge),
    update_and_amalgamate_waypoints=Toggle(True),
    cut_approach_planes=flatten(pl_9),
    cut_top_planes=flatten(move_16.Geometry),
    cut_bottom_planes=flatten(move_17.Geometry),
    cut_pull_away_planes=flatten(pl_10))  # -> out, a; inputs cones: list, grab_points: list, trigger: list, strings: list, string_grab_points: list, approach_points: list, string_approach_points: list, names: list, cut_approach_planes: list, cut_top_planes: list, cut_bottom_planes: list, cut_pull_away_planes: list
# ---------- py3_6: Python ----------
# GhPython component (Rhino 8 / CPython 3)
# Export machine cone grab points to YAML and import STLs + targets into RoboDK.
#
# GH Inputs:
#   cones                  : geometry (DataTree one branch per cone, or flat list)
#   grab_points            : flat list of Planes ΓÇö cone grab planes
#   approach_points        : flat list of Planes ΓÇö cone approach planes (pre-computed in GH)
#   string_grab_points     : flat list of Planes ΓÇö string grab planes
#   string_approach_points : flat list of Planes ΓÇö string approach planes (pre-computed in GH)
#   cut_approach_planes    : flat list of Planes ΓÇö cut approach planes
#   cut_top_planes         : flat list of Planes ΓÇö cut top planes
#   cut_bottom_planes      : flat list of Planes ΓÇö cut bottom planes
#   cut_pull_away_planes   : flat list of Planes ΓÇö cut pull away planes
#   strings                : geometry (flat list)
#   names                  : flat list of str ΓÇö one name per cone; used for RoboDK items and YAML (optional, defaults to "cone_0", "cone_1", ...)
#   cone_color             : Colour (optional, default red)
#   string_color           : Colour (optional, default green)
#   trigger                : Boolean (default True)
#
# GH Outputs:
#   a : last STL path written (str)

from Grasshopper import DataTree
import Rhino
import Rhino.Geometry as rg
import scriptcontext as sc
import System
import struct
import os
import sys
import math
import json

# ΓöÇΓöÇ End effector names for robert_end_checker_config.json ΓöÇΓöÇΓöÇΓöÇΓöÇΓöÇΓöÇΓöÇΓöÇΓöÇΓöÇΓöÇΓöÇΓöÇΓöÇΓöÇΓöÇΓöÇΓöÇΓöÇΓöÇΓöÇ
PICKUP_END_EFFECTOR_NAME   = "pickup"
KNOTTING_END_EFFECTOR_NAME = "knotting"
CUTTING_END_EFFECTOR_NAME  = "cutting"
MACHINE_CONE_J7_OPTIMIZE_VALUE = 3600.0
SOURCE_SCRIPT = "export_machine_cone_waypoints_gh"

REPO_ROOT = r"C:\Users\samst\Framework\clones\custom_estimates_using_dhr_methods"
CHECKER_CONFIG_PATH = os.path.join(REPO_ROOT, "robert_checker_stuff", "robert_end_checker_config.json")

# ΓöÇΓöÇ Optional inputs with defaults ΓöÇΓöÇΓöÇΓöÇΓöÇΓöÇΓöÇΓöÇΓöÇΓöÇΓöÇΓöÇΓöÇΓöÇΓöÇΓöÇΓöÇΓöÇΓöÇΓöÇΓöÇΓöÇΓöÇΓöÇΓöÇΓöÇΓöÇΓöÇΓöÇΓöÇΓöÇΓöÇΓöÇΓöÇΓöÇΓöÇΓöÇΓöÇΓöÇΓöÇΓöÇΓöÇΓöÇΓöÇΓöÇ
try:
    trigger
except NameError:
    trigger = True

try:
    approach_points
except NameError:
    approach_points = None

try:
    string_approach_points
except NameError:
    string_approach_points = None

try:
    cut_approach_planes
except NameError:
    cut_approach_planes = None

try:
    cut_top_planes
except NameError:
    cut_top_planes = None

try:
    cut_bottom_planes
except NameError:
    cut_bottom_planes = None

try:
    cut_pull_away_planes
except NameError:
    cut_pull_away_planes = None

try:
    names
except NameError:
    names = None

try:
    update_and_amalgamate_waypoints
except NameError:
    update_and_amalgamate_waypoints = False

YAML_PATH = r"C:\Users\samst\Framework\clones\custom_estimates_using_dhr_methods\robo_dk_output\machine_cone_waypoints.yaml"

# ΓöÇΓöÇ Output default ΓöÇΓöÇΓöÇΓöÇΓöÇΓöÇΓöÇΓöÇΓöÇΓöÇΓöÇΓöÇΓöÇΓöÇΓöÇΓöÇΓöÇΓöÇΓöÇΓöÇΓöÇΓöÇΓöÇΓöÇΓöÇΓöÇΓöÇΓöÇΓöÇΓöÇΓöÇΓöÇΓöÇΓöÇΓöÇΓöÇΓöÇΓöÇΓöÇΓöÇΓöÇΓöÇΓöÇΓöÇΓöÇΓöÇΓöÇΓöÇΓöÇΓöÇΓöÇΓöÇΓöÇΓöÇΓöÇΓöÇΓöÇΓöÇΓöÇΓöÇΓöÇ
a = ""

# ΓöÇΓöÇ Helpers ΓöÇΓöÇΓöÇΓöÇΓöÇΓöÇΓöÇΓöÇΓöÇΓöÇΓöÇΓöÇΓöÇΓöÇΓöÇΓöÇΓöÇΓöÇΓöÇΓöÇΓöÇΓöÇΓöÇΓöÇΓöÇΓöÇΓöÇΓöÇΓöÇΓöÇΓöÇΓöÇΓöÇΓöÇΓöÇΓöÇΓöÇΓöÇΓöÇΓöÇΓöÇΓöÇΓöÇΓöÇΓöÇΓöÇΓöÇΓöÇΓöÇΓöÇΓöÇΓöÇΓöÇΓöÇΓöÇΓöÇΓöÇΓöÇΓöÇΓöÇΓöÇΓöÇΓöÇΓöÇΓöÇΓöÇΓöÇΓöÇ

def flatten_input(gh_input, exclude_type=None):
    result = []
    if hasattr(gh_input, 'Branches'):
        for branch in gh_input.Branches:
            for item in branch:
                if item is not None:
                    result.append(item)
    elif hasattr(gh_input, '__iter__') and (exclude_type is None or not isinstance(gh_input, exclude_type)):
        for item in gh_input:
            if item is not None:
                result.append(item)
    elif gh_input is not None:
        result.append(gh_input)
    return result

def diagnose_tree(name, gh_input):
    if hasattr(gh_input, 'Branches'):
        print(f"  {name}: DataTree {len(gh_input.Branches)} branches")
        for j, (path, branch) in enumerate(zip(gh_input.Paths, gh_input.Branches)):
            print(f"    branch[{j}] path={path} items={len(branch)}")
    elif hasattr(gh_input, '__iter__') and not isinstance(gh_input, (rg.Mesh, rg.Point3d, rg.Plane)):
        print(f"  {name}: list len={len(list(gh_input))}")
    else:
        print(f"  {name}: {type(gh_input).__name__}")

def resolve_plane(item):
    if item is None:
        return None
    if isinstance(item, rg.Plane):
        return item
    if isinstance(item, System.Guid):
        rhino_obj = sc.doc.Objects.FindId(item)
        if rhino_obj:
            geo = rhino_obj.Geometry
            if isinstance(geo, rg.Plane): return geo
            if isinstance(geo, rg.Point): item = geo.Location
            elif hasattr(geo, 'Location'): item = geo.Location
            else: item = geo.GetBoundingBox(True).Center
        else:
            print(f"  Could not find Guid: {item}")
            return None
    if isinstance(item, rg.Point3d):
        return rg.Plane(item, rg.Vector3d.XAxis, rg.Vector3d.YAxis)
    if isinstance(item, rg.Point):
        return rg.Plane(item.Location, rg.Vector3d.XAxis, rg.Vector3d.YAxis)
    if hasattr(item, 'X') and hasattr(item, 'Y') and hasattr(item, 'Z'):
        return rg.Plane(rg.Point3d(item.X, item.Y, item.Z), rg.Vector3d.XAxis, rg.Vector3d.YAxis)
    print(f"  Unknown plane type: {type(item)}")
    return None

def resolve_color(gh_color, default_rgba):
    if gh_color is None:
        return default_rgba
    def color_from_raw(raw):
        if raw is None: return None
        if type(raw).__name__ == 'Color' or (hasattr(raw,'R') and hasattr(raw,'G') and hasattr(raw,'B')):
            return [raw.R/255.0, raw.G/255.0, raw.B/255.0, raw.A/255.0]
        if isinstance(raw, (list, tuple)) and all(isinstance(v, (int, float)) for v in raw):
            vals = list(raw)[:4]
            if any(v > 1.0 for v in vals): vals = [v/255.0 for v in vals]
            while len(vals) < 4: vals.append(1.0)
            return vals
        return None
    if hasattr(gh_color, 'Branches'):
        try: return color_from_raw(list(gh_color.Branches[0])[0]) or default_rgba
        except: return default_rgba
    result = color_from_raw(gh_color)
    if result: return result
    if hasattr(gh_color, '__iter__') and not isinstance(gh_color, str):
        try:
            for item in gh_color:
                if item is not None:
                    result = color_from_raw(item)
                    if result: return result
                    break
        except: pass
    return default_rgba

def plane_to_xyzrpw(plane):
    """Convert Rhino Plane to world-space XYZ + ZYX Euler angles (degrees)."""
    ox, oy, oz = plane.Origin.X, plane.Origin.Y, plane.Origin.Z
    xax, yax, zax = plane.XAxis, plane.YAxis, plane.ZAxis
    sy = -xax.Z
    cy = math.sqrt(xax.X**2 + xax.Y**2)
    if cy > 1e-6:
        rx = math.atan2(yax.Z, zax.Z)
        ry = math.atan2(sy, cy)
        rz = math.atan2(xax.Y, xax.X)
    else:
        rx = math.atan2(-zax.Y, yax.Y)
        ry = math.atan2(sy, cy)
        rz = 0.0
    return (round(ox,4), round(oy,4), round(oz,4),
            round(math.degrees(rx),6), round(math.degrees(ry),6), round(math.degrees(rz),6))

def write_waypoints_yaml(waypoints, edges, path):
    lines = ["waypoints:"]
    for w in waypoints:
        lines.append(f"  - name: {w['name']}")
        lines.append(f"    x: {w['x']}")
        lines.append(f"    y: {w['y']}")
        lines.append(f"    z: {w['z']}")
        lines.append(f"    rx: {w['rx']}")
        lines.append(f"    ry: {w['ry']}")
        lines.append(f"    rz: {w['rz']}")
        lines.append(f"    frame: world")
        lines.append(f"    move_type: {w['move_type']}")
        lines.append(f"    j7: null")
        lines.append(f"    source: grasshopper")
        if w.get('note'):
            lines.append(f"    note: \"{w['note']}\"")
    lines.append("")
    lines.append("edges:")
    for e in edges:
        lines.append(f"  - from: {e['from']}")
        lines.append(f"    to:   {e['to']}")
        lines.append(f"    tested: null")
    os.makedirs(os.path.dirname(path), exist_ok=True)
    with open(path, "w", encoding="utf-8") as f:
        f.write("\n".join(lines) + "\n")

def build_and_write_stl(geo_list, stl_path):
    mesh_list = rg.Mesh()
    for geo in geo_list:
        if isinstance(geo, rg.Mesh):
            geo.Faces.ConvertQuadsToTriangles(); mesh_list.Append(geo)
        elif isinstance(geo, rg.Brep):
            meshes = rg.Mesh.CreateFromBrep(geo, rg.MeshingParameters.Coarse)
            if meshes:
                for m in meshes: m.Faces.ConvertQuadsToTriangles(); mesh_list.Append(m)
        elif isinstance(geo, System.Guid):
            rhino_obj = sc.doc.Objects.FindId(geo)
            if rhino_obj:
                obj_geo = rhino_obj.Geometry
                if isinstance(obj_geo, rg.Mesh):
                    obj_geo.Faces.ConvertQuadsToTriangles(); mesh_list.Append(obj_geo)
                elif isinstance(obj_geo, rg.Brep):
                    meshes = rg.Mesh.CreateFromBrep(obj_geo, rg.MeshingParameters.Coarse)
                    if meshes:
                        for m in meshes: m.Faces.ConvertQuadsToTriangles(); mesh_list.Append(m)
    mesh_list.Faces.ConvertQuadsToTriangles()
    triangles = []
    for i in range(mesh_list.Faces.Count):
        face = mesh_list.Faces[i]
        triangles.append((mesh_list.Vertices[face.A], mesh_list.Vertices[face.B], mesh_list.Vertices[face.C]))
    os.makedirs(os.path.dirname(stl_path), exist_ok=True)
    with open(stl_path, 'wb') as f:
        f.write(b'\0' * 80)
        f.write(struct.pack('<I', len(triangles)))
        for v0, v1, v2 in triangles:
            f.write(struct.pack('<fff', 0, 0, 0))
            f.write(struct.pack('<fff', v0.X, v0.Y, v0.Z))
            f.write(struct.pack('<fff', v1.X, v1.Y, v1.Z))
            f.write(struct.pack('<fff', v2.X, v2.Y, v2.Z))
            f.write(struct.pack('<H', 0))
    return len(triangles)

# ΓöÇΓöÇ Collect inputs ΓöÇΓöÇΓöÇΓöÇΓöÇΓöÇΓöÇΓöÇΓöÇΓöÇΓöÇΓöÇΓöÇΓöÇΓöÇΓöÇΓöÇΓöÇΓöÇΓöÇΓöÇΓöÇΓöÇΓöÇΓöÇΓöÇΓöÇΓöÇΓöÇΓöÇΓöÇΓöÇΓöÇΓöÇΓöÇΓöÇΓöÇΓöÇΓöÇΓöÇΓöÇΓöÇΓöÇΓöÇΓöÇΓöÇΓöÇΓöÇΓöÇΓöÇΓöÇΓöÇΓöÇΓöÇΓöÇΓöÇΓöÇΓöÇΓöÇΓöÇΓöÇ

print("=== INPUT DIAGNOSTICS ===")
diagnose_tree("cones",                   cones)
diagnose_tree("grab_points",             grab_points)
diagnose_tree("approach_points",         approach_points)
diagnose_tree("string_grab_points",      string_grab_points)
diagnose_tree("string_approach_points",  string_approach_points)
diagnose_tree("strings",                 strings)
print("=========================")

cone_rgba   = resolve_color(cone_color   if 'cone_color'   in dir() else None, [1.0, 0.0, 0.0, 1.0])
string_rgba = resolve_color(string_color if 'string_color' in dir() else None, [0.0, 1.0, 0.0, 1.0])

raw_names = flatten_input(names) if names is not None else []
def cone_name(i):
    if i < len(raw_names) and raw_names[i]:
        return str(raw_names[i])
    return f"cone_{i}"

cone_branches = []
if hasattr(cones, 'Branches') and len(cones.Branches) > 1:
    for branch in cones.Branches:
        items = [item for item in branch if item is not None]
        if items: cone_branches.append(items)
    print(f"MODE A: {len(cone_branches)} branches from DataTree")
else:
    flat = flatten_input(cones, exclude_type=rg.Mesh)
    for item in flat: cone_branches.append([item])
    print(f"MODE B: {len(cone_branches)} cones from flat list")

strings_list           = flatten_input(strings, exclude_type=rg.Mesh)
cone_grab_planes       = [resolve_plane(p) for p in flatten_input(grab_points)]
cone_approach_planes   = [resolve_plane(p) for p in flatten_input(approach_points)] if approach_points is not None else []
str_grab_planes        = [resolve_plane(p) for p in flatten_input(string_grab_points)]
str_approach_planes    = [resolve_plane(p) for p in flatten_input(string_approach_points)] if string_approach_points is not None else []
cut_approach_planes    = [resolve_plane(p) for p in flatten_input(cut_approach_planes)] if cut_approach_planes is not None else []
cut_top_planes         = [resolve_plane(p) for p in flatten_input(cut_top_planes)] if cut_top_planes is not None else []
cut_bottom_planes      = [resolve_plane(p) for p in flatten_input(cut_bottom_planes)] if cut_bottom_planes is not None else []
cut_pull_away_planes   = [resolve_plane(p) for p in flatten_input(cut_pull_away_planes)] if cut_pull_away_planes is not None else []

num_cones = len(cone_branches)
print(f"num_cones={num_cones}  cone_grabs={len(cone_grab_planes)}  cone_approaches={len(cone_approach_planes)}")
print(f"str_grabs={len(str_grab_planes)}  str_approaches={len(str_approach_planes)}")
print(f"cut: approach={len(cut_approach_planes)} top={len(cut_top_planes)} bottom={len(cut_bottom_planes)} pull_away={len(cut_pull_away_planes)}")

if trigger:
    print("Rebuilding...")

    os.makedirs("C:/temp/cones", exist_ok=True)
    cone_stl_paths = []
    for i, branch_geos in enumerate(cone_branches):
        path = f"C:/temp/cones/{cone_name(i)}.stl"
        tris = build_and_write_stl(branch_geos, path)
        cone_stl_paths.append(path)
        print(f"  {cone_name(i)}: {tris} triangles -> {path}")

    strings_stl_path = "C:/temp/strings.stl"
    string_tris = build_and_write_stl(strings_list, strings_stl_path)
    print(f"Strings: {string_tris} triangles -> {strings_stl_path}")

    # ΓöÇΓöÇ YAML export ΓöÇΓöÇΓöÇΓöÇΓöÇΓöÇΓöÇΓöÇΓöÇΓöÇΓöÇΓöÇΓöÇΓöÇΓöÇΓöÇΓöÇΓöÇΓöÇΓöÇΓöÇΓöÇΓöÇΓöÇΓöÇΓöÇΓöÇΓöÇΓöÇΓöÇΓöÇΓöÇΓöÇΓöÇΓöÇΓöÇΓöÇΓöÇΓöÇΓöÇΓöÇΓöÇΓöÇΓöÇΓöÇΓöÇΓöÇΓöÇΓöÇΓöÇΓöÇΓöÇΓöÇΓöÇΓöÇΓöÇΓöÇΓöÇΓöÇ
    waypoints = []
    edges     = []

    for i, pl in enumerate(cone_grab_planes):
        if pl is None:
            print(f"  WARNING: cone_grab_{i} plane is None ΓÇö skipping")
            continue
        ap = cone_approach_planes[i] if i < len(cone_approach_planes) else None
        if ap is None:
            print(f"  WARNING: cone_grab_{i} approach plane is None ΓÇö skipping YAML entry")
        grab_name     = f"{cone_name(i)}_grab"
        approach_name = f"{cone_name(i)}_grab_approach"
        x,y,z,rx,ry,rz = plane_to_xyzrpw(pl)
        waypoints.append({"name": grab_name, "x":x,"y":y,"z":z,"rx":rx,"ry":ry,"rz":rz,
                          "move_type":"MoveL","note":"machine cone place"})
        if ap is not None:
            ax,ay,az,arx,ary,arz = plane_to_xyzrpw(ap)
            waypoints.append({"name": approach_name, "x":ax,"y":ay,"z":az,"rx":arx,"ry":ary,"rz":arz,
                              "move_type":"MoveJ","note":"machine cone approach"})
            edges.append({"from": approach_name, "to": grab_name})
            edges.append({"from": grab_name,     "to": approach_name})

    for i, pl in enumerate(str_grab_planes):
        if pl is None:
            print(f"  WARNING: str_grab_{i} plane is None ΓÇö skipping")
            continue
        ap = str_approach_planes[i] if i < len(str_approach_planes) else None
        grab_name     = f"{cone_name(i)}_string_grab"
        approach_name = f"{cone_name(i)}_string_grab_approach"
        x,y,z,rx,ry,rz = plane_to_xyzrpw(pl)
        waypoints.append({"name": grab_name, "x":x,"y":y,"z":z,"rx":rx,"ry":ry,"rz":rz,
                          "move_type":"MoveL","note":"machine string grab"})
        if ap is not None:
            ax,ay,az,arx,ary,arz = plane_to_xyzrpw(ap)
            waypoints.append({"name": approach_name, "x":ax,"y":ay,"z":az,"rx":arx,"ry":ary,"rz":arz,
                              "move_type":"MoveJ","note":"machine string approach"})
            edges.append({"from": approach_name, "to": grab_name})
            edges.append({"from": grab_name,     "to": approach_name})

    # Cut points: approach ΓåÆ top ΓåÆ bottom ΓåÆ pull_away (sequential chain)
    for i in range(len(cut_approach_planes)):
        ca = cut_approach_planes[i] if i < len(cut_approach_planes) else None
        ct = cut_top_planes[i] if i < len(cut_top_planes) else None
        cb = cut_bottom_planes[i] if i < len(cut_bottom_planes) else None
        cp = cut_pull_away_planes[i] if i < len(cut_pull_away_planes) else None

        ca_name = f"{cone_name(i)}_cut_approach"
        ct_name = f"{cone_name(i)}_cut_top"
        cb_name = f"{cone_name(i)}_cut_bottom"
        cp_name = f"{cone_name(i)}_cut_pull_away"

        if ca is not None:
            x,y,z,rx,ry,rz = plane_to_xyzrpw(ca)
            waypoints.append({"name": ca_name, "x":x,"y":y,"z":z,"rx":rx,"ry":ry,"rz":rz,
                              "move_type":"MoveJ","note":"cut approach"})
        if ct is not None:
            x,y,z,rx,ry,rz = plane_to_xyzrpw(ct)
            waypoints.append({"name": ct_name, "x":x,"y":y,"z":z,"rx":rx,"ry":ry,"rz":rz,
                              "move_type":"MoveJ","note":"cut top"})
        if cb is not None:
            x,y,z,rx,ry,rz = plane_to_xyzrpw(cb)
            waypoints.append({"name": cb_name, "x":x,"y":y,"z":z,"rx":rx,"ry":ry,"rz":rz,
                              "move_type":"MoveJ","note":"cut bottom"})
        if cp is not None:
            x,y,z,rx,ry,rz = plane_to_xyzrpw(cp)
            waypoints.append({"name": cp_name, "x":x,"y":y,"z":z,"rx":rx,"ry":ry,"rz":rz,
                              "move_type":"MoveJ","note":"cut pull away"})

        # Edges: approachΓåÆtopΓåÆbottomΓåÆpull_away (sequential, bidirectional)
        if ca is not None and ct is not None:
            edges.append({"from": ca_name, "to": ct_name})
            edges.append({"from": ct_name, "to": ca_name})
        if ct is not None and cb is not None:
            edges.append({"from": ct_name, "to": cb_name})
            edges.append({"from": cb_name, "to": ct_name})
        if cb is not None and cp is not None:
            edges.append({"from": cb_name, "to": cp_name})
            edges.append({"from": cp_name, "to": cb_name})

    write_waypoints_yaml(waypoints, edges, YAML_PATH)
    print(f"[OK] {len(waypoints)} waypoints, {len(edges)} edges -> {YAML_PATH}")

    # ΓöÇΓöÇ Write robert_end_checker_config.json ΓöÇΓöÇΓöÇΓöÇΓöÇΓöÇΓöÇΓöÇΓöÇΓöÇΓöÇΓöÇΓöÇΓöÇΓöÇΓöÇΓöÇΓöÇΓöÇΓöÇΓöÇΓöÇΓöÇΓöÇΓöÇΓöÇΓöÇΓöÇΓöÇΓöÇΓöÇΓöÇΓöÇΓöÇΓöÇ
    if os.path.exists(CHECKER_CONFIG_PATH):
        with open(CHECKER_CONFIG_PATH, "r", encoding="utf-8") as f:
            checker_config = json.load(f)
    else:
        checker_config = {}
    if "end_effectors" not in checker_config:
        checker_config["end_effectors"] = []

    # Build pickup points (cone grab + approach)
    pickup_points = []
    for i, pl in enumerate(cone_grab_planes):
        if pl is None:
            continue
        grab_name     = f"{cone_name(i)}_grab"
        approach_name = f"{cone_name(i)}_grab_approach"
        pickup_points.append({
            "name": grab_name,
            "type": "point",
            "name_path": f"WaypointTargets/{grab_name}",
            "source_script": SOURCE_SCRIPT,
            "special_track_conditions": {"type": "Optimized_for_j7_at", "j7_value": MACHINE_CONE_J7_OPTIMIZE_VALUE}
        })
        ap = cone_approach_planes[i] if i < len(cone_approach_planes) else None
        if ap is not None:
            pickup_points.append({
                "name": approach_name,
                "type": "point",
                "name_path": f"WaypointTargets/{approach_name}",
                "source_script": SOURCE_SCRIPT,
                "special_track_conditions": {"type": "Optimized_for_j7_at", "j7_value": MACHINE_CONE_J7_OPTIMIZE_VALUE}
            })

    # Build knotting points (string grab + approach)
    knotting_points = []
    for i, pl in enumerate(str_grab_planes):
        if pl is None:
            continue
        grab_name     = f"{cone_name(i)}_string_grab"
        approach_name = f"{cone_name(i)}_string_grab_approach"
        knotting_points.append({
            "name": grab_name,
            "type": "point",
            "name_path": f"WaypointTargets/{grab_name}",
            "source_script": SOURCE_SCRIPT,
            "special_track_conditions": {"type": "Optimized_for_j7_at", "j7_value": MACHINE_CONE_J7_OPTIMIZE_VALUE}
        })
        ap = str_approach_planes[i] if i < len(str_approach_planes) else None
        if ap is not None:
            knotting_points.append({
                "name": approach_name,
                "type": "point",
                "name_path": f"WaypointTargets/{approach_name}",
                "source_script": SOURCE_SCRIPT,
                "special_track_conditions": {"type": "Optimized_for_j7_at", "j7_value": MACHINE_CONE_J7_OPTIMIZE_VALUE}
            })

    def upsert_end_effector(config, ee_name, new_points, source):
        """Replace only points from this source_script, keep points from other sources."""
        for ee in config["end_effectors"]:
            if ee["end_effector_name"] == ee_name:
                # Keep points from other scripts, replace ours
                other_points = [p for p in ee["paths_and_points_to_check"] if p.get("source_script") != source]
                ee["paths_and_points_to_check"] = other_points + new_points
                return
        config["end_effectors"].append({
            "end_effector_name": ee_name,
            "paths_and_points_to_check": new_points
        })

    # Build cutting points (cut_approach, cut_top, cut_bottom, cut_pull_away)
    cutting_points = []
    cut_names_map = [
        (cut_approach_planes,  "cut_approach"),
        (cut_top_planes,       "cut_top"),
        (cut_bottom_planes,    "cut_bottom"),
        (cut_pull_away_planes, "cut_pull_away"),
    ]
    for planes, suffix in cut_names_map:
        for i, pl in enumerate(planes):
            if pl is None:
                continue
            pt_name = f"{cone_name(i)}_{suffix}"
            cutting_points.append({
                "name": pt_name,
                "type": "point",
                "name_path": f"WaypointTargets/{pt_name}",
                "source_script": SOURCE_SCRIPT,
                "special_track_conditions": {"type": "Optimized_for_j7_at", "j7_value": MACHINE_CONE_J7_OPTIMIZE_VALUE}
            })

    upsert_end_effector(checker_config, PICKUP_END_EFFECTOR_NAME, pickup_points, SOURCE_SCRIPT)
    upsert_end_effector(checker_config, KNOTTING_END_EFFECTOR_NAME, knotting_points, SOURCE_SCRIPT)
    upsert_end_effector(checker_config, CUTTING_END_EFFECTOR_NAME, cutting_points, SOURCE_SCRIPT)

    with open(CHECKER_CONFIG_PATH, "w", encoding="utf-8") as f:
        json.dump(checker_config, f, indent=2)
    print(f"[OK] robert_end_checker_config.json updated: {len(pickup_points)} pickup, {len(knotting_points)} knotting, {len(cutting_points)} cutting points")

    # ΓöÇΓöÇ RoboDK import (with re-entry guard via sc.sticky) ΓöÇΓöÇΓöÇΓöÇΓöÇΓöÇΓöÇΓöÇΓöÇΓöÇΓöÇΓöÇΓöÇΓöÇΓöÇΓöÇΓöÇΓöÇΓöÇΓöÇ
    import hashlib as _hl
    _hash_data = str([(w.get("name"), w.get("x"), w.get("y"), w.get("z")) for w in waypoints]).encode()
    _hash_data += str([(e.get("from"), e.get("to")) for e in edges]).encode()
    _hash_data += str(len(cone_stl_paths)).encode()
    _input_hash = _hl.md5(_hash_data).hexdigest()
    _sticky_key = "export_machine_cone_last_hash"
    _skip_robodk = sc.sticky.get(_sticky_key) == _input_hash
    if _skip_robodk:
        print(f"[SKIP] RoboDK import ΓÇö inputs unchanged since last run")
    else:
        sc.sticky[_sticky_key] = _input_hash

    if not _skip_robodk:
      try:
        sys.path.append("C:/RoboDK/Python")
        from robodk.robolink import Robolink
        from robodk.robomath import Mat

        def identity():
            return Mat([[1,0,0,0],[0,1,0,0],[0,0,1,0],[0,0,0,1]])

        RDK = Robolink()
        station = RDK.Item("", 1)
        print(f"Station: {station.Name()}")

        def purge_all(name):
            count = 0
            for _ in range(50):
                item = RDK.Item(name)
                if not item.Valid(): break
                item.Delete()
                count += 1
            if count: print(f"  purged {count}x '{name}'")

        def add_file_and_get_item(stl_path):
            from robodk.robolink import ITEM_TYPE_OBJECT
            before = set(it.item for it in RDK.ItemList(ITEM_TYPE_OBJECT, False))
            RDK.AddFile(stl_path)
            for it in RDK.ItemList(ITEM_TYPE_OBJECT, False):
                if it.item not in before:
                    return it
            stem = os.path.splitext(os.path.basename(stl_path))[0]
            return RDK.Item(stem)

        # Purge only items added by previous runs of this script.
        # Deleting the "Cones" frame removes all cone frames and targets under it.
        purge_all("strings")
        purge_all("Cones")

        # Rebuild
        cones_frame = RDK.AddFrame("Cones", station)
        cones_frame.setPose(identity())
        print("Created Cones frame")

        strings_item = add_file_and_get_item(strings_stl_path)
        if strings_item.Valid():
            strings_item.setColor(string_rgba)
            strings_item.setParentStatic(cones_frame)
            print("Strings: ok")
        else:
            print("WARNING: strings item not valid")

        for i in range(num_cones):
            cn = cone_name(i)
            cone_frame = RDK.AddFrame(cn, cones_frame)
            cone_frame.setPose(identity())

            cone_obj = add_file_and_get_item(cone_stl_paths[i])
            if cone_obj.Valid():
                cone_obj.setColor(cone_rgba)
                cone_obj.setParentStatic(cone_frame)
                print(f"  {cn}: STL ok")
            else:
                print(f"  WARNING: {cn} STL not valid")


        print(f"Done -- {num_cones} cones in tree")
        a = cone_stl_paths[0] if cone_stl_paths else ""

      except Exception as e:
        print(f"RoboDK error: {e}")
        import traceback
        traceback.print_exc()

    # ΓöÇΓöÇ Amalgamate waypoints + re-import to RoboDK ΓöÇΓöÇΓöÇΓöÇΓöÇΓöÇΓöÇΓöÇΓöÇΓöÇΓöÇΓöÇΓöÇΓöÇΓöÇΓöÇΓöÇΓöÇΓöÇΓöÇΓöÇΓöÇΓöÇΓöÇΓöÇΓöÇΓöÇΓöÇ
    if update_and_amalgamate_waypoints and not _skip_robodk:
        import subprocess
        REPO = r"C:\Users\samst\Framework\clones\custom_estimates_using_dhr_methods"
        amalgamate_script  = os.path.join(REPO, "robodk_code", "amalgamate_waypoints.py")
        import_script      = os.path.join(REPO, "robodk_code", "import_waypoints_to_robodk.py")

        # sys.executable in GhPython is Rhino.exe ΓÇö use the Rhino CPython interpreter directly
        PYTHON = r"C:\Users\samst\.rhinocode\py39-rh8\python.exe"

        print("\n--- amalgamate_waypoints ---")
        r1 = subprocess.run([PYTHON, amalgamate_script], capture_output=True, text=True)
        print(r1.stdout)
        if r1.returncode != 0:
            print(f"[ERROR] amalgamate_waypoints failed (rc={r1.returncode}):\n{r1.stderr}")
        else:
            print("\n--- import_waypoints_to_robodk ---")
            r2 = subprocess.run([PYTHON, import_script], capture_output=True, text=True)
            print(r2.stdout)
            if r2.returncode != 0:
                print(f"[ERROR] import_waypoints_to_robodk failed (rc={r2.returncode}):\n{r2.stderr}")
# ---------- end py3_6 ----------
cluster_16 = Cluster_4(P=flatten(move_8.Geometry))  # -> geometry, colors
preview_2 = CustomPreview(Geometry=cluster_16.geometry, Material=cluster_16.colors)
merge_12 = Merge(Data1=merge_9, Data2=merge_10, Data3=merge_11)
cluster_17 = Cluster_4(P=flatten(merge_12))  # -> geometry, colors
cluster_18 = Cluster_4(P=flatten(merge_8))  # -> geometry, colors
preview_3 = CustomPreview(Geometry=cluster_17.geometry, Material=cluster_17.colors)
cluster_19 = Cluster_4(P=flatten(merge_12))  # -> geometry, colors
panel_5 = Panel(py3_5.out)
preview_4 = CustomPreview(Geometry=cluster_18.geometry, Material=cluster_18.colors)
preview_5 = CustomPreview(Geometry=cluster_19.geometry, Material=cluster_19.colors)
panel_6 = Panel(py3_5.a)
panel_7 = Panel(py3_6.out)
panel_8 = Panel(pl_10)

# ==== cluster Cluster
C = ClusterInput()
bbox = BoundingBox(Content=C, Plane=PlaneXY(0, 0, 0))  # -> Box, Box_2
debox = DeconstructBox(Box=bbox.Box)  # -> Plane, X, Y, Z
dedomain = DeconstructDomain(Domain=debox.Z)  # -> Start, End
subtraction = Subtraction(A=dedomain.End, B=dedomain.Start)
R = ClusterOutput(subtraction)

# ==== cluster Cluster_2
relay = ClusterInput()
relay_2 = ClusterInput()
relay_3 = ClusterInput()
A = ClusterInput()
B = ClusterInput()
N = ClusterInput()
C = ClusterInput()
B_2 = ClusterInput()
row_2_prefix = ClusterInput()
row_1_prefix = ClusterInput()
Y = ClusterInput()
vec2pt = Vector2Pt(PointA=A, PointB=B, Unitize=False)  # -> Vector, Length
series = Series(Start=0, Step=N, Count=C)
pt = ConstructPoint(XCoordinate=relay, YCoordinate=relay_3, ZCoordinate=0)
subtraction = Subtraction(A=relay_2, B=relay)
addition = Addition(A=relay_3, B=B_2)
rectangle = Rectangle(Plane=PlaneXY(0, 0, 0), XSize=relay_2, YSize=Y, Radius=0)  # -> Rectangle, Length
pt_2 = ConstructPoint(XCoordinate=subtraction, YCoordinate=addition, ZCoordinate=0)
Y_2 = UnitY(Factor=series)
move = Move(Geometry=graft(pt_2), Motion=Y_2)  # -> Geometry, Transform
lng = ListLength(List=move.Geometry)
py3 = Python3Script(s=row_2_prefix, n=lng)  # -> out, a
# ---------- py3: Python ----------
# Inputs:  s (string), n (number)
# Output:  a (list of strings)

a = [s + str(i) for i in range(int(n))]
# ---------- end py3 ----------
move_2 = Move(Geometry=graft(pt), Motion=Y_2)  # -> Geometry, Transform
lng_2 = ListLength(List=move_2.Geometry)
py3_2 = Python3Script(s=row_1_prefix, n=lng_2)  # -> out, a; same code as py3
move_3 = Move(Geometry=rectangle.Rectangle, Motion=vec2pt.Vector)  # -> Geometry, Transform
merge = Merge(Data1=py3_2.a, Data2=py3.a)
merge_2 = Merge(Data1=move_2.Geometry, Data2=move.Geometry)
out_rectangle = ClusterOutput(move_3.Geometry)
move_4 = Move(Geometry=merge_2, Motion=vec2pt.Vector)  # -> flatten(Geometry), Transform
G = ClusterInput()
Z = UnitZ(Factor=1)
move_5 = Move(Geometry=G, Motion=move_4.Geometry)  # -> Geometry, Transform
panel = Panel(merge)
lng_3 = ListLength(List=flatten(move_5.Geometry))
pl = PlaneNormal(Origin=move_4.Geometry, ZAxis=Z)
out_names = ClusterOutput(merge)
out_cones = ClusterOutput(move_5.Geometry)
L = ClusterOutput(lng_3)
out_cone_centroid_bottoms = ClusterOutput(pl)

# ==== cluster Cluster_3
C = ClusterInput()
bbox = BoundingBox(Content=C, Plane=PlaneXY(0, 0, 0), UnionBox=True)  # -> Box, Box_2
debox = DeconstructBox(Box=bbox.Box)  # -> Plane, X, Y, Z
dedomain = DeconstructDomain(Domain=debox.X)  # -> Start, End
dedomain_2 = DeconstructDomain(Domain=debox.Z)  # -> Start, End
dedomain_3 = DeconstructDomain(Domain=debox.Y)  # -> Start, End
addition = Addition(A=dedomain.Start, B=dedomain.End)
addition_2 = Addition(A=dedomain_3.Start, B=dedomain_3.End)
division = Division(A=addition, B="2")
division_2 = Division(A=addition_2, B="2")
pt = ConstructPoint(XCoordinate=division, YCoordinate=division_2, ZCoordinate=dedomain_2.End)
pt_2 = ClusterOutput(pt)

# ==== cluster Cluster_4
P = ClusterInput()

deplane = DeconstructPlane(Plane=P)  # -> Origin, XAxis, YAxis, ZAxis

# ---- group: Global Settings & Scaling
num = Number(Slider(2.25, range=0..5))
multiplication = Multiplication(A=Slider(6, range=0..50), B=num)
multiplication_2 = Multiplication(A=Slider(2, range=0..20), B=num)
multiplication_3 = Multiplication(A=Slider(20, range=0..100), B=num)
multiplication_4 = Multiplication(A=Slider(30, range=0..500), B=num)
num_2 = Number(multiplication)
num_3 = Number(multiplication_2)
num_4 = Number(multiplication_3)
num_5 = Number(multiplication_4)

# ---- group: Z Axis (Blue)
swatch = ColourSwatch(SwatchColor=RGB(0, 0, 255))
pl = PlaneNormal(Origin=deplane.Origin, ZAxis=deplane.ZAxis)
multiplication_5 = Multiplication(A=deplane.ZAxis, B=num_5)
move = Move(Geometry=pl, Motion=multiplication_5)  # -> Geometry, Transform
cyl = Cylinder(Base=pl, Radius=num_3, Length=num_5)
cone = Cone(Base=move.Geometry, Radius=num_2, Length=num_4)  # -> Cone, Tip
merge = Merge(Data1=[cyl, cone.Cone])

# ---- group: Y Axis (Green)
swatch_2 = ColourSwatch(SwatchColor=RGB(0, 255, 0))
pl_2 = PlaneNormal(Origin=deplane.Origin, ZAxis=deplane.YAxis)
multiplication_6 = Multiplication(A=deplane.YAxis, B=num_5)
move_2 = Move(Geometry=pl_2, Motion=multiplication_6)  # -> Geometry, Transform
cyl_2 = Cylinder(Base=pl_2, Radius=num_3, Length=num_5)
cone_2 = Cone(Base=move_2.Geometry, Radius=num_2, Length=num_4)  # -> Cone, Tip
merge_2 = Merge(Data1=[cyl_2, cone_2.Cone])

# ---- group: X Axis (Red)
swatch_3 = ColourSwatch(SwatchColor=RGB(255, 0, 0))
pl_3 = PlaneNormal(Origin=deplane.Origin, ZAxis=deplane.XAxis)
multiplication_7 = Multiplication(A=deplane.XAxis, B=num_5)
move_3 = Move(Geometry=pl_3, Motion=multiplication_7)  # -> Geometry, Transform
cyl_3 = Cylinder(Base=pl_3, Radius=num_3, Length=num_5)
cone_3 = Cone(Base=move_3.Geometry, Radius=num_2, Length=num_4)  # -> Cone, Tip
merge_3 = Merge(Data1=[cyl_3, cone_3.Cone])

# ---- group: Global Settings & Scaling (continued)
geo = Geometry([merge_3, merge_2, merge])

# ----
entwine = Entwine(Branch00=merge, Branch01=merge_2, Branch02=merge_3, FlattenInputs=True)
entwine_2 = Entwine(Branch00=swatch, Branch01=swatch_2, Branch02=swatch_3, FlattenInputs=True)
colors = ClusterOutput(entwine_2)
geometry = ClusterOutput(entwine)

# ==== cluster Cluster_6
relay = ClusterInput()
B = ClusterInput()
relay_2 = ClusterInput()
cluster = Cluster_5(relay=relay, B=B, relay_2=relay_2)
G = ClusterOutput(cluster)

# ==== cluster Cluster_8
G = ClusterInput()
T = ClusterInput()
move = Move(Geometry=G, Motion=T)  # -> Geometry, Transform
cluster = Cluster_7(T=move.Geometry)
M = ClusterOutput(cluster)

# ==== cluster Cluster_10
P = ClusterInput()
cluster = Cluster_9(P=P)
T = ClusterInput()
move = Move(Geometry=cluster, Motion=T)  # -> Geometry, Transform
G = ClusterOutput(move.Geometry)

# ==== cluster Cluster_11
G = ClusterInput()
C = ClusterInput()
A = ClusterInput()
bbox = BoundingBox(Content=C, Plane=PlaneXY(0, 0, 0), UnionBox=True)  # -> Box, Box_2
debox = DeconstructBox(Box=bbox.Box)  # -> Plane, X, Y, Z
dedomain = DeconstructDomain(Domain=debox.X)  # -> Start, End

# ---- group: Absolute Maximum
merge = Merge(Data1=dedomain.Start, Data2=dedomain.End)
abs = Absolute(Value=merge)
sort = SortList(Keys=abs, ValuesA=merge)  # -> Keys, ValuesA
item = ListItem(List=sort.ValuesA, Index=1, Wrap=True)

# ----
division = Division(A=A, B="2")
addition = Addition(A=division, B=item)
yz = YZPlane(Origin=Point(0, 0, 0))
vec = VectorXYZ(XComponent=addition, YComponent=0, ZComponent=0)  # -> Vector, Length
move = Move(Geometry=yz, Motion=vec.Vector)  # -> Geometry, Transform
mirror = Mirror(Geometry=G, Plane=move.Geometry)  # -> Geometry, Transform

# ==== cluster Cluster_12
C = ClusterInput()
bbox = BoundingBox(Content=C, Plane=PlaneXY(0, 0, 0), UnionBox=True)  # -> Box, Box_2
debox = DeconstructBox(Box=bbox.Box)  # -> Plane, X, Y, Z
dedomain = DeconstructDomain(Domain=debox.Z)  # -> Start, End
dedomain_2 = DeconstructDomain(Domain=debox.X)  # -> Start, End
dedomain_3 = DeconstructDomain(Domain=debox.Y)  # -> Start, End
pt = ConstructPoint(XCoordinate=dedomain_2.Start, YCoordinate=dedomain_3.Start, ZCoordinate=dedomain.Start)
pt_2 = ClusterOutput(pt)

# ==== cluster Cluster_5
relay = ClusterInput()
B = ClusterInput()
relay_2 = ClusterInput()
vec2pt = Vector2Pt(PointA=relay, PointB=B, Unitize=False)  # -> Vector, Length
subtraction = Subtraction(A=relay_2, B="1")
division = Division(A=vec2pt.Vector, B=subtraction)
arrlinear = LinearArray(Geometry=relay, Direction=division, Count=relay_2)  # -> Geometry, Transform
G = ClusterOutput(arrlinear.Geometry)

# ==== cluster Cluster_7
T = ClusterInput()
flatten = FlattenTree(Tree=T, Path="{0}")
mesh = MeshBrep(
    Brep=flatten,
    Settings={GridMaxCount=0, GridMinCount=16, JaggedSeams=False, MaxEdgeLength=5000, MinEdgeLength=50, MinTolerance=0, Refine=True, RefineAngle=0, RelativeTolerance=0.65, SimplePlanes=True, Tolerance=0})  # -> flatten(Mesh)
M = ClusterOutput(mesh)

# ==== cluster Cluster_9
P = ClusterInput()
pdecon = Deconstruct(Point=P)  # -> XComponent, YComponent, ZComponent
bnd = Bounds(Numbers=pdecon.XComponent)
dedomain = DeconstructDomain(Domain=bnd)  # -> Start, End
pt = ConstructPoint(XCoordinate=dedomain.End, YCoordinate=pdecon.YComponent, ZCoordinate=pdecon.ZComponent)
pt_2 = ClusterOutput(pt)
