# Grasshopper definition parameterized_elipsoid.gh (Grasshopper 1.0.8)

sph = Sphere(Base=PlaneXY(0, 0, 0), Radius=1)
scale_nu = ScaleNU(
    Geometry=sph,
    Plane=PlaneXY(0, 0, 0),
    ScaleX=Slider(3.26, range=0..100),
    ScaleY=Slider(24.5, range=0..100),
    ScaleZ=Slider(6.81, range=0..100))  # -> Geometry, Transform
preview = CustomPreview(Geometry=scale_nu.Geometry, Material=ColourSwatch(SwatchColor=RGB(54, 91, 186)))
