# Grasshopper definition pivoting_end_effector_v1.gh (Grasshopper 1.0.8)

cluster = Cluster(
    Z=Slider(104.051, range=0..2000),
    B=Slider(116.429, range=0..2000),
    relay_2=Slider(78.26, range=0..2000),
    relay=Slider(24.182, range=0..2000),
    B_2=Slider(3, range=0..2000))  # -> R, B_3, P
vec = VectorXYZ(XComponent=0, YComponent=0, ZComponent=0)  # -> Vector, Length
pl = PlaneNormal(Origin=Point(0, 0, 0), ZAxis=vec.Vector)

# ==== cluster Cluster
relay = ClusterInput()
relay_2 = ClusterInput()
B = ClusterInput()
Z = ClusterInput()
pt = ConstructPoint(XCoordinate="0", YCoordinate="0", ZCoordinate="0")
pt_2 = ConstructPoint(XCoordinate="0", YCoordinate="0", ZCoordinate=Z)
pdecon = Deconstruct(Point=pt_2)  # -> XComponent, YComponent, ZComponent
addition = Addition(A=pdecon.ZComponent, B=B)
division = Division(A=relay_2, B="-2")
division_2 = Division(A=relay, B="-2")
vec = VectorXYZ(XComponent="1", YComponent="0", ZComponent="0")  # -> Vector, Length
rectangle = Rectangle(Plane=pt, XSize=relay_2, YSize=relay, Radius=0)  # -> Rectangle, Length
pt_3 = ConstructPoint(XCoordinate=pdecon.XComponent, YCoordinate=pdecon.YComponent, ZCoordinate=addition)
vec_2 = VectorXYZ(XComponent=division, YComponent=division_2, ZComponent="0")  # -> Vector, Length
pdecon_2 = Deconstruct(Point=pt_2)  # -> XComponent, YComponent, ZComponent
division_3 = Division(A=relay_2, B="2")
division_4 = Division(A=relay, B="2")
pdecon_3 = Deconstruct(Point=pt)  # -> XComponent, YComponent, ZComponent
move = Move(Geometry=rectangle.Rectangle, Motion=vec_2.Vector)  # -> Geometry, Transform
subtraction = Subtraction(A=pdecon_2.XComponent, B=division_3)
pt_4 = ConstructPoint(XCoordinate=subtraction, YCoordinate=pdecon_2.YComponent, ZCoordinate=pdecon_2.ZComponent)
subtraction_2 = Subtraction(A=pdecon_2.ZComponent, B=pdecon_3.ZComponent)
vec_3 = VectorXYZ(XComponent="0", YComponent="0", ZComponent=subtraction_2)  # -> Vector, Length
extr = Extrude(Base=move.Geometry, Direction=vec_3.Vector)
cap = CapHoles(Brep=extr)
pdecon_4 = Deconstruct(Point=pt_3)  # -> XComponent, YComponent, ZComponent
B_2 = ClusterInput()
vec_4 = VectorXYZ(XComponent=0, YComponent=0, ZComponent=pdecon_4.ZComponent)  # -> Vector, Length
move_2 = Move(Geometry=move.Geometry, Motion=vec_4.Vector)  # -> Geometry, Transform
pl = PlaneNormal(Origin=pt_4, ZAxis=vec.Vector)
cyl = Cylinder(Base=pl, Radius=division_4, Length=relay_2)
cap_2 = CapHoles(Brep=cyl)
merge = Merge(Data1=cap, Data2=cap_2)
sunion = SolidUnion(Breps=merge)
bbox = BoundingBox(Content=sunion, Plane=PlaneXY(0, 0, 0))  # -> Box, Box_2
debox = DeconstructBox(Box=bbox.Box)  # -> Plane, X, Y, Z
num = Number(debox.Z)
subtraction_3 = Subtraction(A=pdecon_4.ZComponent, B=num)
panel = Panel(num)
subtraction_4 = Subtraction(A=subtraction_3, B=B_2)
multiplication = Multiplication(A=subtraction_4, B="-1")
vec_5 = VectorXYZ(XComponent=0, YComponent=0, ZComponent=multiplication)  # -> Vector, Length
extr_2 = Extrude(Base=move_2.Geometry, Direction=vec_5.Vector)
cap_3 = CapHoles(Brep=extr_2)
R = ClusterOutput(sunion)
B_3 = ClusterOutput(cap_3)
P = ClusterOutput(pl)
